# Grasshopper definition crossbracings-beams.gh (Grasshopper 1.0.7)
# Copyright: Safdie Architects, LLC
# plug-ins: PTComponentLibrary, Pufferfish, Wombat

crv = Curve(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)
crv_2 = Curve(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)
crv_3 = Curve(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)
crv_4 = Curve(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)
flip = FlipCurve(Curve=crv_3)  # -> Curve, Flag
edgesrf = EdgeSurface(CurveA=crv, CurveB=crv_2, CurveC=crv_3, CurveD=crv_4)
# specify your curve and surface
specify_the_distance = Slider(2, range=0..10)
flip_2 = Flip(Surface=edgesrf)  # -> Surface, Result

pick_a_curve = Curve(flip.Curve)
pick_a_surface = Surface(flip_2.Surface)

# ----
# NOTES: Author: Mesut Sala
# Version: v0.0, November, 2021
# Use: Skypark Details / Cross Bracing and Beams
# 
# Rhino file: Anyfile - Specify a curve and a Surface
# 
# Plugins used:
panel = Panel("Input/Output")
divlength = DivideLength(Curve=pick_a_curve, Length=specify_the_distance)  # -> Points, Tangents, Parameters
panel_2 = Panel("Geometry Creation")
lng = ListLength(List=divlength.Points)
panel_3 = Panel(lng)
divide = DivideCurve(Curve=pick_a_curve, Count=lng, Kinks=False)  # -> Points, Tangents, Parameters
xy = XYPlane(Origin=divide.Points)
align = AlignPlane(Plane=xy, Direction=divide.Tangents)  # -> Plane, Angle
srf = Surface(graft(pick_a_surface))
number_slider = Slider(2, range=0..10)
deplane = DeconstructPlane(Plane=align.Plane)  # -> Origin, XAxis, YAxis, ZAxis
line = LineSDL(Start=align.Plane, Direction=deplane.YAxis, Length=Slider(100, range=0..100))
srf_2 = Surface(srf)
trim = TrimTree(Tree=line, Depth=1)
trim_2 = TrimTree(Tree=trim, Depth=1)  # -> graft(Tree)
trim_3 = TrimTree(Tree=trim_2, Depth=1)
project = Project(Curve=trim_3, Brep=pick_a_surface, Direction=Vector(0, 0, 1))
srf_3 = Surface(srf_2)
neg = Negative(Value=Slider(0.1, range=0..1))

# ---- group: Seung's Contribution
projected_crvs_to_design_srf = Curve(graft(project))
surface_for_normals = Surface(srf_3)

width_top = Slider(0.25, range=0..10)
# beams size
depth = Slider(0.6, range=0..10)
prismatic_profile = PrismaticProfile(depth=depth, width_top=width_top, width_bot=width_top)

# ----
crv_5 = Curve(crv_4)

# ---- group: CROSS BRACINGS
number_slider_2 = Slider(0.15, range=0..1)
offsrf = OffsetSurface(Surface=srf, Distance=number_slider_2, BothSides=False, CreateSolid=False)
offset_srf = Surface(offsrf)
# cross bracings
project_2 = Project(Curve=trim_2, Brep=offset_srf, Direction=Vector(0, 0, 1))
projected_crvs_to_design_srf_2 = Curve(graft(project_2))
srf_4 = Surface(offset_srf)
crv_6 = Curve(simplify(projected_crvs_to_design_srf_2))
divide_2 = DivideCurve(Curve=crv_5, Count=Slider(6, range=0..10), Kinks=False)  # -> Points, Tangents, Parameters
srf_cp = SurfaceClosestPoint(Point=divide_2.Points, Surface=srf_4)  # -> Point, UVPoint, Distance
iso = IsoCurve(Surface=srf_4, UVPoint=srf_cp.UVPoint)  # -> UIsocurve, VIsocurve
toggle = BooleanToggle(True)
crv_7 = Curve(iso.VIsocurve)
clean = CleanTree(RemoveNulls=toggle, RemoveInvalid=True, RemoveEmpty=toggle, Tree=crv_7)  # -> simplify(Tree)
ptuvcrvs = IntersectCurves(CU=flatten(crv_6), CV=flatten(clean))
points = PointList(Points=ptuvcrvs, Size=Slider(5, range=0..10))
relitem = RelativeItem(Tree=ptuvcrvs, Offset="{0;0;1}[-1]", WrapPaths=False, WrapItems=False)  # -> ItemA, ItemB
relitem_2 = RelativeItem(Tree=ptuvcrvs, Offset="{0;0;1}[+1]", WrapPaths=False, WrapItems=False)  # -> ItemA, ItemB
ln = Line(StartPoint=relitem_2.ItemA, EndPoint=relitem_2.ItemB)
ln_2 = Line(StartPoint=relitem.ItemA, EndPoint=relitem.ItemB)
pipe = Pipe(Curve=[ln, ln_2], Radius=Slider(0.02, range=0..0.1), Caps=0)

# ----
neg_2 = Negative(Value=number_slider_2)
extendsrf = ExtendSurface(Surface=offsrf, WestEdge=number_slider, SouthEdge=0, EastEdge=number_slider, NorthEdge=0, ExtensionType=True)
offsrf_2 = OffsetSurface(Surface=extendsrf, Distance=neg, BothSides=False, CreateSolid=True)  # -> simplify(Offset)
srf_5 = Surface(offsrf)

# ---- group: Seung's Contribution
projected_crvs_to_design_srf_3 = Curve(graft(clean))
surface_for_normals_2 = Surface(srf_5)

width_top_2 = Slider(0.15, range=0..10)
depth_2 = Slider(0.2, range=0..10)
prismatic_profile_2 = PrismaticProfile(depth=depth_2, width_top=width_top_2, width_bot=width_top_2)

# ----
profile_curve = Curve(prismatic_profile)

X = UnitX(Factor=depth)
move = Move(Geometry=profile_curve, Motion=X)  # -> Geometry, Transform

# ---- group: Seung's Contribution
crv_8 = Curve(reparameterize(projected_crvs_to_design_srf))
midpt = CurveMiddle(Curve=crv_8)
number = Number(0)
srf_cp_2 = SurfaceClosestPoint(Point=midpt, Surface=surface_for_normals)  # -> Point, UVPoint, Distance
pframe = PerpFrame(Curve=crv_8, Parameter=number)
xy_2 = XYPlane(Origin=Point(0, 0, 0))
evalsrf = EvaluateSurface(Surface=surface_for_normals, Point=srf_cp_2.UVPoint)  # -> Point, Normal, UDirection, VDirection, Frame
align_2 = AlignPlane(Plane=pframe, Direction=evalsrf.Normal)  # -> Plane, Angle
orient = Orient(Geometry=move.Geometry, Source=xy_2, Target=align_2.Plane)  # -> Geometry, Transform
list = ValueList({"None": 0, "Trim": 1, "Rotate": 2}, selected="None")
swp1 = Sweep1(Rail=projected_crvs_to_design_srf, Sections=orient.Geometry, Miter=list)

# ----
viewer = ParamViewer(crv_6)
viewer_2 = ParamViewer(clean)

profile_curve_2 = Curve(prismatic_profile_2)

X_2 = UnitX(Factor=depth_2)
# purlin
move_2 = Move(Geometry=profile_curve_2, Motion=X_2)  # -> Geometry, Transform

# ---- group: Seung's Contribution
crv_9 = Curve(reparameterize(projected_crvs_to_design_srf_3))
midpt_2 = CurveMiddle(Curve=crv_9)
number_2 = Number(0)
srf_cp_3 = SurfaceClosestPoint(Point=midpt_2, Surface=surface_for_normals_2)  # -> Point, UVPoint, Distance
pframe_2 = PerpFrame(Curve=crv_9, Parameter=number_2)
xy_3 = XYPlane(Origin=Point(0, 0, 0))
evalsrf_2 = EvaluateSurface(Surface=surface_for_normals_2, Point=srf_cp_3.UVPoint)  # -> Point, Normal, UDirection, VDirection, Frame
align_3 = AlignPlane(Plane=pframe_2, Direction=evalsrf_2.Normal)  # -> Plane, Angle
orient_2 = Orient(Geometry=move_2.Geometry, Source=xy_3, Target=align_3.Plane)  # -> Geometry, Transform
list_2 = ValueList({"None": 0, "Trim": 1, "Rotate": 2}, selected="None")
swp1_2 = Sweep1(Rail=projected_crvs_to_design_srf_3, Sections=orient_2.Geometry, Miter=list_2)

# ----
cap = CapHoles(Brep=swp1)  # -> simplify(Brep)
viewer_3 = ParamViewer(cap)
viewer_4 = ParamViewer(offsrf_2)
debrep = DeconstructBrep(Brep=cap)  # -> Faces, Edges, Vertices
panel_4 = Panel("""0
-1""")

# ---- group: CROSS BRACINGS
preview = CustomPreview(Geometry=pipe, Material=ColourSwatch(SwatchColor=RGB(117, 125, 122)))

# ----
# beams
sdiff = SolidDifference(BrepsA=cap, BrepsB=offsrf_2)
preview_2 = CustomPreview(Geometry=sdiff, Material=ColourSwatch(SwatchColor=RGB(255, 171, 36)))

item = ListItem(List=debrep.Edges, Index=Slider(11, range=0..12), Wrap=True)
item_2 = ListItem(List=debrep.Edges, Index=Slider(12, range=0..12), Wrap=True)
merge = Merge(Data1=item, Data2=item_2)
crv_10 = Curve(merge)
clean_2 = CleanTree(RemoveNulls=True, RemoveInvalid=True, RemoveEmpty=True, Tree=crv_10)  # -> flatten(Tree)
viewer_5 = ParamViewer(clean_2)
shift = ShiftList(List=clean_2, Shift=1, Wrap=False)
dispatch = Dispatch(List=clean_2, DispatchPattern=[True, False])  # -> ListA, ListB
dispatch_2 = Dispatch(List=shift, DispatchPattern=[True, False])  # -> ListA, ListB
crv_11 = Curve(graft(dispatch.ListB))
crv_12 = Curve(graft(dispatch.ListA))
crv_13 = Curve(graft(dispatch_2.ListA))
crv_14 = Curve(graft(dispatch_2.ListB))
loft = Loft(
    Curves=[crv_12, crv_11],
    Options={Adjust=False, Closed=False, LoftEnds=0, LoftSimp=0, LoftType=0, Rebuild=10, Refit=0.01})
preview_3 = CustomPreview(
    Geometry=loft,
    Material={diffuse=RGB(221, 160, 221), emission=RGB(66, 48, 66), shine=0.5, specular=RGB(255, 255, 255), transparency=0})
loft_2 = Loft(
    Curves=[crv_13, crv_14],
    Options={Adjust=False, Closed=False, LoftEnds=0, LoftSimp=0, LoftType=0, Rebuild=10, Refit=0.01})  # -> flatten(Loft)
dispatch_3 = Dispatch(List=loft_2, DispatchPattern=[True, False])  # -> ListA, ListB

# ----
# glass
swatch = ColourSwatch(SwatchColor=RGBA(228, 227, 255, 159))
preview_4 = CustomPreview(Geometry=dispatch_3.ListA, Material=swatch)
preview_5 = CustomPreview(Geometry=dispatch_3.ListB, Material=ColourSwatch(SwatchColor=RGBA(107, 255, 241, 92)))

brep = Brep(flatten(swp1_2))

cull_i = CullIndex(List=brep, Indices=panel_4, Wrap=True)

preview_6 = CustomPreview(Geometry=cull_i, Material=ColourSwatch(SwatchColor=RGB(255, 171, 36)))

# ==== cluster PrismaticProfile
width_top = ClusterInput()
width_bot = ClusterInput()
depth = ClusterInput()
width_top_2 = Number(width_top)
width_bot_2 = Number(width_bot)
depth_2 = Number(depth)
pt = ConstructPoint(XCoordinate=0, YCoordinate=expr("x/2", width_top_2), ZCoordinate=0)
pt_2 = ConstructPoint(XCoordinate=expr("-x", depth_2), YCoordinate=expr("x/2", width_bot_2), ZCoordinate=0)
pt_3 = ConstructPoint(XCoordinate=expr("-x", depth_2), YCoordinate=expr("-x/2", width_bot_2), ZCoordinate=0)
pt_4 = ConstructPoint(XCoordinate=0, YCoordinate=expr("-x/2", width_top_2), ZCoordinate=0)
ln = Line(StartPoint=pt, EndPoint=pt_2)
ln_2 = Line(StartPoint=pt_2, EndPoint=pt_3)
ln_3 = Line(StartPoint=pt_3, EndPoint=pt_4)
ln_4 = Line(StartPoint=pt_4, EndPoint=pt)
join = JoinCurves(Curves=[ln, ln_4, ln_2, ln_3], Preserve=False)
C = ClusterOutput(join)
