# Grasshopper definition dome-nodes.gh (Grasshopper 1.0.7)
# plug-ins: Weaverbird, Kangaroo2 Components, LunchBox

pick_your_mesh_surface = Mesh(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)

# ---- group: BAKE
button = Button()

# ----
# Note the unit conversion factor. The current set-up is intended for a file in millimeters.
swatch = ColourSwatch(SwatchColor=RGB(151, 171, 209))
# NOTES: Author: Mesut Sala
# Version: v0.0, April 26, 2021
# Use: Dome Nodes
# 
# Rhino file: Mesh Triangulation
# 
# Plugins used:
panel = Panel("Input")
weaverbird_s_mesh_edges = WeaverbirdsMeshEdges(MeshOrPolylines=pick_your_mesh_surface)
number_slider = Slider(300, range=0..1000)
custom_preview = CustomPreview(Geometry=pick_your_mesh_surface, Material=swatch)
panel_2 = Panel("Geometry Creation")
deconstruct_mesh = DeconstructMesh(Mesh=pick_your_mesh_surface)  # -> Vertices, Faces, Colours, Normals
removeduplicatelines = RemoveDuplicateLines(Lines=weaverbird_s_mesh_edges, Tolerance=0.01)
flip_curve = FlipCurve(Curve=removeduplicatelines)  # -> Curve, Flag
evaluate_length = EvaluateLength(Curve=weaverbird_s_mesh_edges, Length=number_slider, Normalized=False)  # -> Point, Tangent, Parameter
circle_cnr = CircleCNR(Center=deconstruct_mesh.Vertices, Normal=deconstruct_mesh.Normals, Radius=Slider(112, range=0..1000))
amplitude = Amplitude(Vector=deconstruct_mesh.Normals, Amplitude=Slider(100, range=0..100))
amplitude_2 = Amplitude(Vector=deconstruct_mesh.Normals, Amplitude=Slider(50, range=0..100))
evaluate_length_2 = EvaluateLength(Curve=flip_curve.Curve, Length=number_slider, Normalized=False)  # -> Point, Tangent, Parameter
negative = Negative(Value=amplitude)
extrude = Extrude(Base=circle_cnr, Direction=amplitude_2)
extrude_2 = Extrude(Base=circle_cnr, Direction=negative)
line = Line(StartPoint=evaluate_length.Point, EndPoint=evaluate_length_2.Point)
pipe = Pipe(Curve=removeduplicatelines, Radius=Slider(50, range=0..100), Caps=0)
cap_holes = CapHoles(Brep=[extrude, extrude_2])
pipe_2 = Pipe(Curve=line, Radius=Slider(130, range=0..1000), Caps=0)
cap_holes_2 = CapHoles(Brep=pipe_2)

colour_swatch = ColourSwatch(SwatchColor=RGB(252, 154, 94))
colour_swatch_2 = ColourSwatch(SwatchColor=RGB(163, 153, 153))
colour_swatch_3 = ColourSwatch(SwatchColor=RGB(163, 153, 153))
custom_preview_2 = CustomPreview(Geometry=cap_holes_2, Material=colour_swatch)
custom_preview_3 = CustomPreview(Geometry=cap_holes, Material=colour_swatch_3)
preview = CustomPreview(Geometry=pipe, Material=colour_swatch_2)
bake = ObjectBake(
    BakeToggle=button,
    GeometryObjects=cap_holes_2,
    Layer="WOOD STRUCTURE",
    ObjectName="GH_Obj",
    ObjectColor=colour_swatch,
    LayerColor=colour_swatch)
bake_2 = ObjectBake(
    BakeToggle=button,
    GeometryObjects=pipe,
    Layer="CROSS BEAMS",
    ObjectName="GH_Obj",
    ObjectColor=colour_swatch_2,
    LayerColor=colour_swatch_2)
bake_3 = ObjectBake(
    BakeToggle=button,
    GeometryObjects=cap_holes,
    Layer="METAL NODES",
    ObjectName="GH_Obj",
    ObjectColor=colour_swatch_3,
    LayerColor=colour_swatch_3)
