# Grasshopper definition jewel-garden-components.gh (Grasshopper 1.0.7)
# plug-ins: Pufferfish, treesloth01, LunchBox

# ----
# BAKE
button = Button()
pick_stair_curve_a = Curve(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)
planter_curve_a = Curve(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)
stand_curve_a = Curve(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)
pick_stair_offset_curve = Curve(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)
planter_offset_curve = Curve(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)
stair_solid_point_a = Slider(0.41, range=0..1)
stair_point_b = Slider(0.513, range=0..1)
planter_start_point = Slider(0.35, range=0..1)
planter_end_point = Slider(0.41, range=0..1)
stand_start_point = Slider(0.46, range=0..1)
stand_end_point = Slider(0.51, range=0..1)
stair_point_a = Slider(0.49, range=0..1)
stand_offset_curve = Curve(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)

# ----
# Note the unit conversion factor. The current set-up is intended for a file in meters.
jewel_stepping_referece = Geometry([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])

pick_stair_curve_a_2 = Curve(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)
point_a = Slider(0.45, range=0..1)
pick_an_offset_curve = Curve(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)
pick_stair_offset_curve_2 = Slider(0.43, range=0..1)

# ----
# NOTES: Author: Mesut Sala
# Version: v0.0, July, 2021
# Use: Jewel Garden Components
# 
# Rhino file: Pick curves
# Plugins used:
panel = Panel("Input/Output")
lng = ListLength(List=jewel_stepping_referece)
preview = CustomPreview(Geometry=jewel_stepping_referece, Material=ColourSwatch(SwatchColor=RGB(191, 191, 191)))
panel_2 = Panel("Geometry Creation")
color = ColourSwatch(SwatchColor=RGB(160, 201, 161))
color_2 = ColourSwatch(SwatchColor=RGB(189, 223, 143))
color_3 = ColourSwatch(SwatchColor=RGB(113, 199, 176))
number = Number(lng)
colour = Colour([color, color_2, color_3])
# LINEAR STAIRS
crv = Curve(pick_stair_curve_a_2)
crv_2 = Curve(stand_curve_a)
crv_3 = Curve(planter_curve_a)
range = Range(Domain="-1 To 1", Steps=number)
eval = EvaluateCurve(Curve=reparameterize(pick_stair_curve_a_2), Parameter=point_a)  # -> Point, Tangent, Angle
eval_2 = EvaluateCurve(Curve=reparameterize(crv), Parameter=point_a)  # -> Point, Tangent, Angle
eval_3 = EvaluateCurve(Curve=reparameterize(pick_stair_curve_a_2), Parameter=pick_stair_offset_curve_2)  # -> Point, Tangent, Angle
eval_4 = EvaluateCurve(Curve=reparameterize(pick_stair_curve_a_2), Parameter=pick_stair_offset_curve_2)  # -> Point, Tangent, Angle
interpolate_data = InterpolateData(Data=colour, Parameter=range, Interpolation=2)
# STANDS
eval_5 = EvaluateCurve(Curve=reparameterize(stand_curve_a), Parameter=stand_start_point)  # -> Point, Tangent, Angle
eval_6 = EvaluateCurve(Curve=reparameterize(crv_2), Parameter=stand_start_point)  # -> Point, Tangent, Angle
eval_7 = EvaluateCurve(Curve=reparameterize(stand_curve_a), Parameter=stand_end_point)  # -> Point, Tangent, Angle
eval_8 = EvaluateCurve(Curve=reparameterize(stand_curve_a), Parameter=stand_end_point)  # -> Point, Tangent, Angle
# PLANTER
eval_9 = EvaluateCurve(Curve=reparameterize(planter_curve_a), Parameter=planter_start_point)  # -> Point, Tangent, Angle
eval_10 = EvaluateCurve(Curve=reparameterize(crv_3), Parameter=planter_start_point)  # -> Point, Tangent, Angle
crv_4 = Curve(crv)
eval_11 = EvaluateCurve(Curve=reparameterize(planter_curve_a), Parameter=planter_end_point)  # -> Point, Tangent, Angle
eval_12 = EvaluateCurve(Curve=reparameterize(planter_curve_a), Parameter=planter_end_point)  # -> Point, Tangent, Angle
crv_5 = Curve(pick_an_offset_curve)
crv_6 = Curve(stand_offset_curve)
crv_7 = Curve(crv_2)
crv_8 = Curve(planter_offset_curve)
crv_9 = Curve(crv_3)
pick_a_curve = Curve(pick_stair_curve_a)
pick_an_offset_curve_2 = Curve(pick_stair_offset_curve)
# CURVED STAIRS
pick_a_curve_2 = Curve(pick_stair_curve_a)
pick_an_offset_curve_3 = Curve(pick_stair_offset_curve)
custom_preview = CustomPreview(Geometry=jewel_stepping_referece, Material=interpolate_data)  # disabled
crv_cp = CurveClosestPoint(Point=[eval.Point, eval_3.Point], Curve=crv_5)  # -> Point, Parameter, Distance
crv_10 = Curve(pick_a_curve)
crv_11 = Curve(pick_a_curve_2)
crv_cp_2 = CurveClosestPoint(Point=[eval_5.Point, eval_7.Point], Curve=crv_6)  # -> Point, Parameter, Distance
crv_cp_3 = CurveClosestPoint(Point=[eval_9.Point, eval_11.Point], Curve=crv_8)  # -> Point, Parameter, Distance
dispatch = Dispatch(List=crv_cp.Point, DispatchPattern=[True, False])  # -> ListA, ListB
crv_12 = Curve(pick_an_offset_curve_3)
eval_13 = EvaluateCurve(Curve=reparameterize(pick_a_curve), Parameter=stair_point_b)  # -> Point, Tangent, Angle
eval_14 = EvaluateCurve(Curve=reparameterize(crv_10), Parameter=stair_point_b)  # -> Point, Tangent, Angle
eval_15 = EvaluateCurve(Curve=reparameterize(pick_a_curve), Parameter=stair_point_a)  # -> Point, Tangent, Angle
eval_16 = EvaluateCurve(Curve=reparameterize(pick_a_curve), Parameter=stair_point_a)  # -> Point, Tangent, Angle
crv_13 = Curve(pick_an_offset_curve_2)
eval_17 = EvaluateCurve(Curve=reparameterize(pick_a_curve_2), Parameter=stair_solid_point_a)  # -> Point, Tangent, Angle
eval_18 = EvaluateCurve(Curve=reparameterize(crv_11), Parameter=stair_solid_point_a)  # -> Point, Tangent, Angle
eval_19 = EvaluateCurve(Curve=reparameterize(pick_a_curve_2), Parameter=stair_point_a)  # -> Point, Tangent, Angle
eval_20 = EvaluateCurve(Curve=reparameterize(pick_a_curve_2), Parameter=stair_point_a)  # -> Point, Tangent, Angle
crv_14 = Curve(crv_10)
crv_15 = Curve(crv_11)
dispatch_2 = Dispatch(List=crv_cp_2.Point, DispatchPattern=[True, False])  # -> ListA, ListB
dispatch_3 = Dispatch(List=crv_cp_3.Point, DispatchPattern=[True, False])  # -> ListA, ListB
ptstrimcrv = PointsTrimCurve(Curve=pick_an_offset_curve, Points=crv_cp.Point, Flip=True)  # -> flatten(Trimmed), SubDomains, Intersected
ptstrimcrv_2 = PointsTrimCurve(Curve=crv_4, Points=[eval_2.Point, eval_3.Point], Flip=True)  # -> flatten(Trimmed), SubDomains, Intersected
ln = Line(StartPoint=dispatch.ListA, EndPoint=eval.Point)
ln_2 = Line(StartPoint=dispatch.ListB, EndPoint=eval_3.Point)
ptstrimcrv_3 = PointsTrimCurve(Curve=stand_offset_curve, Points=crv_cp_2.Point, Flip=True)  # -> flatten(Trimmed), SubDomains, Intersected
ptstrimcrv_4 = PointsTrimCurve(Curve=crv_7, Points=[eval_6.Point, eval_7.Point], Flip=True)  # -> flatten(Trimmed), SubDomains, Intersected
ln_3 = Line(StartPoint=dispatch_2.ListA, EndPoint=eval_5.Point)
ln_4 = Line(StartPoint=dispatch_2.ListB, EndPoint=eval_7.Point)
ptstrimcrv_5 = PointsTrimCurve(Curve=planter_offset_curve, Points=crv_cp_3.Point, Flip=True)  # -> flatten(Trimmed), SubDomains, Intersected
ptstrimcrv_6 = PointsTrimCurve(Curve=crv_9, Points=[eval_10.Point, eval_11.Point], Flip=True)  # -> flatten(Trimmed), SubDomains, Intersected
ln_5 = Line(StartPoint=dispatch_3.ListA, EndPoint=eval_9.Point)
ln_6 = Line(StartPoint=dispatch_3.ListB, EndPoint=eval_11.Point)
viewer = ParamViewer(ptstrimcrv.Trimmed)
viewer_2 = ParamViewer(ptstrimcrv_3.Trimmed)
viewer_3 = ParamViewer(ptstrimcrv_5.Trimmed)
crv_cp_4 = CurveClosestPoint(Point=[eval_13.Point, eval_15.Point], Curve=crv_13)  # -> Point, Parameter, Distance
crv_cp_5 = CurveClosestPoint(Point=[eval_17.Point, eval_19.Point], Curve=crv_12)  # -> Point, Parameter, Distance
join = JoinCurves(Curves=[ptstrimcrv.Trimmed, ln, ln_2, ptstrimcrv_2.Trimmed], Preserve=False)
join_2 = JoinCurves(Curves=[ptstrimcrv_3.Trimmed, ln_3, ln_4, ptstrimcrv_4.Trimmed], Preserve=False)
join_3 = JoinCurves(Curves=[ptstrimcrv_5.Trimmed, ln_5, ln_6, ptstrimcrv_6.Trimmed], Preserve=False)
dispatch_4 = Dispatch(List=crv_cp_5.Point, DispatchPattern=[True, False])  # -> ListA, ListB
dispatch_5 = Dispatch(List=crv_cp_4.Point, DispatchPattern=[True, False])  # -> ListA, ListB

# ----
# HEIGHT
number_slider = Slider(0.1, range=0..1)
Z = UnitZ(Factor=number_slider)

# ----
# HEIGHT
Z_2 = UnitZ(Factor=Slider(1, range=0..1))
extr = Extrude(Base=join_2, Direction=Z_2)
cap = CapHoles(Brep=extr)

ptstrimcrv_7 = PointsTrimCurve(Curve=pick_an_offset_curve_2, Points=crv_cp_4.Point, Flip=True)  # -> flatten(Trimmed), SubDomains, Intersected
ln_7 = Line(StartPoint=dispatch_5.ListA, EndPoint=eval_13.Point)
ln_8 = Line(StartPoint=dispatch_5.ListB, EndPoint=eval_15.Point)
ptstrimcrv_8 = PointsTrimCurve(Curve=crv_14, Points=[eval_14.Point, eval_15.Point], Flip=True)  # -> flatten(Trimmed), SubDomains, Intersected
ptstrimcrv_9 = PointsTrimCurve(Curve=pick_an_offset_curve_3, Points=crv_cp_5.Point, Flip=True)  # -> flatten(Trimmed), SubDomains, Intersected
ln_9 = Line(StartPoint=dispatch_4.ListA, EndPoint=eval_17.Point)
ln_10 = Line(StartPoint=dispatch_4.ListB, EndPoint=eval_19.Point)
ptstrimcrv_10 = PointsTrimCurve(Curve=crv_15, Points=[eval_18.Point, eval_19.Point], Flip=True)  # -> flatten(Trimmed), SubDomains, Intersected
viewer_4 = ParamViewer(ptstrimcrv_9.Trimmed)
stair_based_curve = JoinCurves(Curves=join, Preserve=False)

# ----
# STAIR HEIGHT
stair_heigth = Slider(1.4, range=0..4)
stair_height = Number(stair_heigth)
riser_height = Slider(0.25, range=0..1)
division = Division(A=stair_height, B=riser_height)

extr_2 = Extrude(Base=join_3, Direction=Z)
cap_2 = CapHoles(Brep=extr_2)
preview_2 = CustomPreview(Geometry=cap_2, Material=ColourSwatch(SwatchColor=RGB(136, 253, 95)))

# ---- group: STAIR HEIGHT
# STAIR HEIGHT
number_slider_2 = Slider(1.4, range=0..10)
Z_3 = UnitZ(Factor=number_slider_2)

# ----
crv_16 = Curve(ptstrimcrv_8.Trimmed)
crv_17 = Curve(ptstrimcrv_10.Trimmed)
based_curve = JoinCurves(Curves=[ptstrimcrv_9.Trimmed, ln_9, ln_10, ptstrimcrv_10.Trimmed], Preserve=False)
viewer_5 = ParamViewer(ptstrimcrv_7.Trimmed)
planar = PlanarSrf(Edges=stair_based_curve)
stair_based_curve_2 = JoinCurves(Curves=[ptstrimcrv_7.Trimmed, ln_7, ln_8, ptstrimcrv_8.Trimmed], Preserve=False)
crv_18 = Curve(crv_17)
swatch = ColourSwatch(SwatchColor=RGB(136, 253, 95))
debrep = DeconstructBrep(Brep=cap)  # -> Faces, Edges, Vertices
brep = Brep(cap)
stair_height_2 = Number(stair_heigth)
extr_3 = Extrude(Base=based_curve, Direction=Z_3)
item = ListItem(List=debrep.Faces, Index=Slider(4, range=0..5), Wrap=True)
planar_2 = PlanarSrf(Edges=stair_based_curve_2)
# NUMBER OF STEPS
number_slider_3 = Slider(1, range=0..3)
crv_19 = Curve(ln_9)
# RAILING HEIGHT
number_slider_4 = Slider(1, range=0..1)

# ----
# NUMBER OF STEPS
stair_height_3 = Number(Z_3)
riser_height_2 = Slider(0.18, range=0..1)
division_2 = Division(A=stair_height_3, B=riser_height_2)

stair_height_4 = Number(Z_3)
srf = Surface(planar)
debrep_2 = DeconstructBrep(Brep=item)  # -> Faces, Edges, Vertices
bake = ObjectBake(BakeToggle=button, GeometryObjects=cap_2, Layer="PLANTERS", ObjectName="GH_Obj", ObjectColor=swatch, LayerColor=swatch)
round = Round(Number=division)  # -> Nearest, Floor, Ceiling
crv_20 = Curve(crv_19)
debrep_3 = DeconstructBrep(Brep=planar)  # -> Faces, Edges, Vertices
crv_21 = Curve(crv_18)
item_2 = ListItem(List=debrep_2.Edges, Index=0, Wrap=True)  # -> Item, Item1, Item2, Item3
stair_height_5 = Number(stair_height_2)
crv_22 = Curve([item_2.Item1, item_2.Item2, item_2.Item3])
srf_2 = Surface(planar_2)
crv_23 = Curve(debrep_3.Edges)
Z_4 = UnitZ(Factor=number_slider_4)
join_4 = JoinCurves(Curves=[crv_21, crv_20], Preserve=False)
crv_24 = Curve(debrep_3.Edges)
number_of_steps_needed = Panel(round.Nearest)
join_5 = JoinCurves(Curves=crv_22, Preserve=False)
debrep_4 = DeconstructBrep(Brep=planar_2)  # -> Faces, Edges, Vertices
item_3 = ListItem(List=crv_23, Index=number_slider_3, Wrap=True)
stair_height_6 = Number(stair_height_4)
crv_25 = Curve(debrep_4.Edges)
swatch_2 = ColourSwatch(SwatchColor=RGB(198, 246, 255))
panel_3 = Panel(division_2)
round_2 = Round(Number=division_2)  # -> Nearest, Floor, Ceiling
Z_5 = UnitZ(Factor=number_slider_2)
flip = FlipCurve(Curve=item_3)  # -> Curve, Flag

extr_4 = Extrude(Base=join_5, Direction=Z_4)
brep_2 = Brep(brep)
preview_3 = CustomPreview(Geometry=extr_4, Material=ColourSwatch(SwatchColor=RGB(151, 171, 209)))
preview_4 = CustomPreview(Geometry=brep_2, Material=ColourSwatch(SwatchColor=RGB(158, 158, 158)))

swatch_3 = ColourSwatch(SwatchColor=RGB(158, 158, 158))
crv_26 = Curve(debrep_4.Edges)
item_4 = ListItem(List=crv_25, Index=Slider(2, range=0..3), Wrap=True)
move = Move(Geometry=join_4, Motion=Z_5)  # -> Geometry, Transform
crv_27 = Curve(crv_16)
# RUN DEPTH
number_of_steps_needed_2 = Panel(round_2.Nearest)
bake_2 = ObjectBake(
    BakeToggle=button,
    GeometryObjects=extr_4,
    Layer="GLASS RAILING",
    ObjectName="GH_Obj",
    ObjectColor=swatch_2,
    LayerColor=swatch_2)
item_5 = ListItem(List=crv_24, Index=Slider(3, range=0..3), Wrap=True)
srf_3 = Surface(srf)
bake_3 = ObjectBake(BakeToggle=button, GeometryObjects=brep_2, Layer="SOLID", ObjectName="GH_Obj", ObjectColor=swatch_3, LayerColor=swatch_3)
crv_28 = Curve(flip.Curve)
flip_2 = FlipCurve(Curve=item_4)  # -> Curve, Flag
item_6 = ListItem(List=crv_26, Index=Slider(0, range=0..3), Wrap=True)
divide = DivideCurve(Curve=flip.Curve, Count=round.Nearest, Kinks=False)  # -> Points, Tangents, Parameters
divide_2 = DivideCurve(Curve=item_5, Count=round.Nearest, Kinks=False)  # -> Points, Tangents, Parameters
srf_4 = Surface(srf_2)
len = Length(Curve=flip_2.Curve)
len_2 = Length(Curve=item_6)
stair_height_7 = Number(stair_height_5)
crv_29 = Curve(crv_27)
panel_4 = Panel(len)
divlength = DivideLength(Curve=flip_2.Curve, Length=Slider(0.3, range=0..1))  # -> Points, Tangents, Parameters
divlength_2 = DivideLength(Curve=item_6, Length=Slider(0.3, range=0..1))  # -> Points, Tangents, Parameters
ln_11 = Line(StartPoint=divide.Points, EndPoint=divide_2.Points)
panel_5 = Panel(len_2)
lng_2 = ListLength(List=divlength.Points)
lng_3 = ListLength(List=divlength_2.Points)
stair_height_8 = Number(stair_height_7)
# NOTE:
# 
# EXTEND OR DECREASE YOUR CURVE POINT B TO MATCH THE NUMBER OF STEPS NEEDED.
number_of_steps_given = Panel(lng_2)

# ---- group: NOTE
# NOTE:
# 
# EXTEND OR DECREASE YOUR CURVE POINT B TO MATCH THE NUMBER OF STEPS NEEDED.
number_of_steps_needed_3 = Panel(number_of_steps_needed_2)
number_of_steps_given_2 = Panel(number_of_steps_given)

# ----
crv_30 = Curve(ln_11)
panel_6 = Panel(lng_3)
stair_height_9 = Number(stair_height_6)
divide_3 = DivideCurve(Curve=flip_2.Curve, Count=lng_2, Kinks=False)  # -> Points, Tangents, Parameters
divide_4 = DivideCurve(Curve=item_6, Count=lng_2, Kinks=False)  # -> Points, Tangents, Parameters
lng_4 = ListLength(List=crv_30)
ln_12 = Line(StartPoint=divide_3.Points, EndPoint=divide_4.Points)
# RISER HEIGTH
panel_7 = Panel(lng_4)
stair_height_10 = Number(stair_height_9)
crv_31 = Curve(ln_12)
srfsplit = SurfaceSplit(Surface=srf_3, Curves=crv_30)
lng_5 = ListLength(List=crv_31)
curvepoint = PointOnCurve(crv_30, parameter=0.355)
panel_8 = Panel(lng_5)
division_3 = Division(A=stair_height_7, B=lng_4)
intcrv = Interpolate(Vertices=curvepoint, Degree=3, Periodic=False, KnotStyle=1)  # -> Curve, Length, Domain
subtraction = Subtraction(A=lng_4, B=Slider(1, range=0..1))
srfsplit_2 = SurfaceSplit(Surface=srf_4, Curves=crv_31)
curvepoint_2 = PointOnCurve(crv_31, parameter=0.355)
area = Area(Geometry=srfsplit)  # -> Area, Centroid
series = Series(Start=division_3, Step=division_3, Count=subtraction)
crv_32 = Curve(crv_29)
riser_height_3 = Number(division_3)
intcrv_2 = Interpolate(Vertices=curvepoint_2, Degree=3, Periodic=False, KnotStyle=1)  # -> Curve, Length, Domain
division_4 = Division(A=stair_height_9, B=lng_5)
panel_9 = Panel(series)
crv_cp_6 = CurveCP(Point=area.Centroid, Curve=intcrv.Curve)  # -> Point, Parameter, Distance
subtraction_2 = Subtraction(A=lng_5, B=Slider(1, range=0..1))
panel_10 = Panel(division_4)
area_2 = Area(Geometry=srfsplit_2)  # -> Area, Centroid
riser_height_4 = Number(division_4)
sort = SortList(Keys=crv_cp_6.Parameter, ValuesA=srfsplit)  # -> Keys, ValuesA
series_2 = Series(Start=division_4, Step=division_4, Count=subtraction_2)
Z_6 = UnitZ(Factor=expr("-x", series))
crv_cp_7 = CurveCP(Point=area_2.Centroid, Curve=intcrv_2.Curve)  # -> Point, Parameter, Distance
Z_7 = UnitZ(Factor=series)
sort_2 = SortList(Keys=crv_cp_7.Parameter, ValuesA=srfsplit_2)  # -> Keys, ValuesA
move_2 = Move(Geometry=sort.ValuesA, Translation=Z_7)  # -> Geometry, Transform
Z_8 = UnitZ(Factor=expr("-x", series_2))
first_last = FirstLast(List=move_2.Geometry)  # -> FirstValue, LastValue
Z_9 = UnitZ(Factor=series_2)
first_last_2 = FirstLast(List=move_2.Geometry)  # -> FirstValue, LastValue
stair_height_11 = Number(stair_height_8)
vec = Vector(Z_6)
debrep_5 = DeconstructBrep(Brep=first_last.LastValue)  # -> Faces, Edges, Vertices
debrep_6 = DeconstructBrep(Brep=first_last_2.LastValue)  # -> Faces, Edges, Vertices
stair_height_12 = Number(stair_height_8)
crv_33 = Curve(crv_28)
Z_10 = UnitZ(Factor=stair_height_11)
Z_11 = UnitZ(Factor=stair_height_12)
crv_34 = Curve(item_5)
stair_height_13 = Number(stair_height_10)
move_3 = Move(Geometry=sort_2.ValuesA, Translation=Z_9)  # -> Geometry, Transform
vec_2 = Vector(Z_8)
crv_35 = Curve(crv_32)
extr_5 = Extrude(Base=crv_33, Direction=Z_10)
item_7 = ListItem(List=debrep_5.Vertices, Index=Slider(1, range=0..3), Wrap=True)
extr_6 = Extrude(Base=crv_34, Direction=Z_11)
first_last_3 = FirstLast(List=move_3.Geometry)  # -> FirstValue, LastValue
item_8 = ListItem(List=debrep_6.Vertices, Index=Slider(0, range=0..3), Wrap=True)
riser_height_5 = Number(riser_height_3)
bbx = BrepBrep(BrepA=extr_5, BrepB=move_2.Geometry)  # -> Curves, Points
riser_height_6 = Number(riser_height_3)
bbx_2 = BrepBrep(BrepA=extr_6, BrepB=move_2.Geometry)  # -> Curves, Points
debrep_7 = DeconstructBrep(Brep=first_last_3.LastValue)  # -> Faces, Edges, Vertices
Z_12 = UnitZ(Factor=1)
crv_36 = Curve(crv_35)
Z_13 = UnitZ(Factor=1)
end = EndPoints(Curve=bbx.Curves)  # -> Start, End
line = LineSDL(Start=item_7, Direction=Z_12, Length=riser_height_5)
end_2 = EndPoints(Curve=bbx_2.Curves)  # -> Start, End
extr_7 = Extrude(Base=move_2.Geometry, Direction=vec)
line_2 = LineSDL(Start=item_8, Direction=Z_13, Length=riser_height_6)
Z_14 = UnitZ(Factor=stair_height_13)
end_3 = EndPoints(Curve=line)  # -> Start, End
end_4 = EndPoints(Curve=line_2)  # -> Start, End
pt = Point(end.End)
pt_2 = Point(end_3.Start)
pt_3 = Point(end_3.End)
extr_8 = Extrude(Base=crv_36, Direction=Z_14)
pt_4 = Point(end_2.Start)
pt_5 = Point(end_4.Start)
pt_6 = Point(end_4.End)
item_9 = ListItem(List=debrep_7.Vertices, Index=Slider(1, range=0..3), Wrap=True)
riser_height_7 = Number(riser_height_4)
extr_9 = Extrude(Base=move_3.Geometry, Direction=vec_2)
entwine = Entwine(Branch00=pt, Branch01=pt_3, FlattenInputs=True)  # -> flatten(Result)
bbx_3 = BrepBrep(BrepA=extr_8, BrepB=move_3.Geometry)  # -> Curves, Points
entwine_2 = Entwine(Branch00=pt_4, Branch01=pt_6, FlattenInputs=True)  # -> flatten(Result)
Z_15 = UnitZ(Factor=1)
end_5 = EndPoints(Curve=bbx_3.Curves)  # -> Start, End
line_3 = LineSDL(Start=item_9, Direction=Z_15, Length=riser_height_7)
intcrv_3 = Interpolate(Vertices=entwine, Degree=3, Periodic=False, KnotStyle=1)  # -> Curve, Length, Domain
intcrv_4 = Interpolate(Vertices=entwine_2, Degree=3, Periodic=False, KnotStyle=1)  # -> Curve, Length, Domain
end_6 = EndPoints(Curve=line_3)  # -> Start, End
pt_7 = Point(end_5.End)
pt_8 = Point(end_6.Start)
pt_9 = Point(end_6.End)

# ---- group: RAILING
# RAILING HEIGHT
number_slider_5 = Slider(1, range=0..1)
Z_16 = UnitZ(Factor=number_slider_5)
extr_10 = Extrude(Base=move.Geometry, Direction=Z_16)
geo = Geometry(extr_10)
preview_5 = CustomPreview(Geometry=geo, Material=ColourSwatch(SwatchColor=RGB(151, 171, 209)))

# ----
entwine_3 = Entwine(Branch00=pt_7, Branch01=pt_9, FlattenInputs=True)  # -> flatten(Result)
srfsplit_3 = SurfaceSplit(Surface=extr_5, Curves=intcrv_3.Curve)
dispatch_6 = Dispatch(List=srfsplit_3, DispatchPattern=[True, False])  # -> ListA, ListB
intcrv_5 = Interpolate(Vertices=entwine_3, Degree=3, Periodic=False, KnotStyle=1)  # -> Curve, Length, Domain
srfsplit_4 = SurfaceSplit(Surface=extr_8, Curves=intcrv_5.Curve)
dispatch_7 = Dispatch(List=srfsplit_4, DispatchPattern=[True, False])  # -> ListA, ListB
srf_5 = Surface(dispatch_7.ListB)
srf_6 = Surface(dispatch_7.ListA)
srf_7 = Surface(dispatch_6.ListB)
srf_8 = Surface(dispatch_6.ListA)
srfsplit_5 = SurfaceSplit(Surface=extr_6, Curves=intcrv_4.Curve)
crv_37 = Curve(intcrv_4.Curve)
dispatch_8 = Dispatch(List=srfsplit_5, DispatchPattern=[True, False])  # -> ListA, ListB
offsrf = OffsetSurface(Surface=srf_5, Distance=Slider(0.01, range=0..0.1), BothSides=False, CreateSolid=True)
srf_9 = Surface(dispatch_8.ListA)
srf_10 = Surface(dispatch_8.ListB)
offsrf_2 = OffsetSurface(Surface=srf_9, Distance=expr("-x", Slider(0.01, range=0..0.1)), BothSides=False, CreateSolid=True)

cap_3 = CapHoles(Brep=extr_3)
preview_6 = CustomPreview(Geometry=cap_3, Material=ColourSwatch(SwatchColor=RGB(196, 188, 188)))

swatch_4 = ColourSwatch(SwatchColor=RGB(151, 171, 209))
swatch_5 = ColourSwatch(SwatchColor=RGB(158, 158, 158))

solid = Geometry(offsrf)
preview_7 = CustomPreview(Geometry=solid, Material=ColourSwatch(SwatchColor=RGB(158, 158, 158)))

swatch_6 = ColourSwatch(SwatchColor=RGB(158, 158, 158))

sdiff = SolidDifference(BrepsA=extr_9, BrepsB=offsrf)
preview_8 = CustomPreview(Geometry=sdiff, Material=ColourSwatch(SwatchColor=RGB(158, 158, 158)))

swatch_7 = ColourSwatch(SwatchColor=RGB(158, 158, 158))

Z_17 = UnitZ(Factor=number_slider_5)
extr_11 = Extrude(Base=intcrv_5.Curve, Direction=Z_17)
preview_9 = CustomPreview(Geometry=extr_11, Material=ColourSwatch(SwatchColor=RGB(151, 171, 209)))

bake_4 = ObjectBake(BakeToggle=button, GeometryObjects=cap_3, Layer="SOLID", ObjectName="GH_Obj", ObjectColor=swatch_6, LayerColor=swatch_6)
bake_5 = ObjectBake(
    BakeToggle=button,
    GeometryObjects=geo,
    Layer="MESH RAILING",
    ObjectName="GH_Obj",
    ObjectColor=swatch_4,
    LayerColor=swatch_4)
bake_6 = ObjectBake(BakeToggle=button, GeometryObjects=solid, Layer="SOLID", ObjectName="GH_Obj", ObjectColor=swatch_5, LayerColor=swatch_5)
swatch_8 = ColourSwatch(SwatchColor=RGB(151, 171, 209))
bake_7 = ObjectBake(BakeToggle=button, GeometryObjects=sdiff, Layer="SOLID", ObjectName="GH_Obj", ObjectColor=swatch_7, LayerColor=swatch_7)
offsrf_3 = OffsetSurface(Surface=srf_8, Distance=Slider(0.01, range=0..0.1), BothSides=False, CreateSolid=True)
sdiff_2 = SolidDifference(BrepsA=extr_7, BrepsB=offsrf_3)
solid_stairs = SolidDifference(BrepsA=sdiff_2, BrepsB=offsrf_2)
crv_38 = Curve(crv_37)
merge = Merge(Data1=sdiff_2, Data2=solid_stairs)
merge_2 = Merge(Data1=offsrf_3, Data2=offsrf_2)
bake_8 = ObjectBake(BakeToggle=button, GeometryObjects=extr_11, Layer="MESH", ObjectName="GH_Obj", ObjectColor=swatch_8, LayerColor=swatch_8)

# ----
# RAILING HEIGTH
number_slider_6 = Slider(1, range=0..1)
Z_18 = UnitZ(Factor=number_slider_6)
extr_12 = Extrude(Base=[intcrv_3.Curve, crv_38], Direction=Z_18)

swatch_9 = ColourSwatch(SwatchColor=RGB(158, 158, 158))
swatch_10 = ColourSwatch(SwatchColor=RGB(158, 158, 158))

solid_2 = Geometry(merge_2)
preview_10 = CustomPreview(Geometry=solid_2, Material=ColourSwatch(SwatchColor=RGB(158, 158, 158)))

preview_11 = CustomPreview(Geometry=merge, Material=ColourSwatch(SwatchColor=RGB(158, 158, 158)))

swatch_11 = ColourSwatch(SwatchColor=RGB(151, 171, 209))

preview_12 = CustomPreview(Geometry=extr_12, Material=ColourSwatch(SwatchColor=RGB(151, 171, 209)))

bake_9 = ObjectBake(
    BakeToggle=button,
    GeometryObjects=solid_2,
    Layer="SOLID",
    ObjectName="GH_Obj",
    ObjectColor=swatch_9,
    LayerColor=swatch_9)
bake_10 = ObjectBake(
    BakeToggle=button,
    GeometryObjects=merge,
    Layer="SOLID",
    ObjectName="GH_Obj",
    ObjectColor=swatch_10,
    LayerColor=swatch_10)
bake_11 = ObjectBake(
    BakeToggle=button,
    GeometryObjects=extr_12,
    Layer="MESH",
    ObjectName="GH_Obj",
    ObjectColor=swatch_11,
    LayerColor=swatch_11)
