# Grasshopper definition kiosks.gh (Grasshopper 1.0.7)
# plug-ins: Pufferfish, LunchBox

pick_your_curve = Curve(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)

button = Button()
# NOTES: Author: Mesut Sala
# Version: v0.0, June 23, 2021
# Use: Circular or an Elliptical shape Kiosks
# 
# Rhino file: Anyfile - Specify a curve
# 
# Plugins used:
# Note the unit conversion factor. The current set-up is intended for a file in meters.
# 
# Your based Cuvre must be one closed curve. Either a Circle or an Ellipse.
panel = Panel("Input")
crv = Curve(pick_your_curve)
panel_2 = Panel("Geometry Creation")
offcrv = OffsetCurve(Curve=pick_your_curve, Plane=PlaneXY(0, 0, 0), Distance=Slider(0.08, range=0..0.1), BothSides=0, Kinks=0, CapType=1)
offcrv_2 = OffsetCurve(Curve=offcrv, Plane=PlaneXY(0, 0, 0), Distance=Slider(0.15, range=0..1), BothSides=0, Kinks=0, CapType=1)
crv_2 = Curve(crv)
merge = Merge(Data1=offcrv, Data2=offcrv_2)
Z = UnitZ(Factor=Slider(0.03, range=0..0.1))
extr = Extrude(Base=merge, Direction=Z)
cap = CapHoles(Brep=extr)  # -> flatten(Brep)
crv_3 = Curve(crv_2)
panel_3 = Panel(cap)
dispatch = Dispatch(List=cap, DispatchPattern=[True, False])  # -> ListA, ListB
brep = Brep(dispatch.ListA)
brep_2 = Brep(dispatch.ListB)
sdiff = SolidDifference(BrepsA=brep, BrepsB=brep_2)

swatch = ColourSwatch(SwatchColor=RGB(122, 122, 122))
bake = ObjectBake(BakeToggle=button, GeometryObjects=sdiff, Layer="MULLIONS", ObjectName="GH_Obj", ObjectColor=swatch, LayerColor=swatch)
preview = CustomPreview(Geometry=sdiff, Material=swatch)

debrep = DeconstructBrep(Brep=sdiff)  # -> Faces, Edges, Vertices
item = ListItem(List=debrep.Faces, Index=Slider(1, range=0..3), Wrap=True)
srf = Surface(reparameterize(item))
debrep_2 = DeconstructBrep(Brep=srf)  # -> Faces, Edges, Vertices
crv_4 = Curve(crv_3)
crv_5 = Curve(debrep_2.Edges)
neg = Negative(Value=Slider(0.04, range=0..0.1))
item_2 = ListItem(List=crv_5, Index=0, Wrap=True)
number_slider = Slider(3, range=0..10)
offcrv_3 = OffsetCurve(Curve=item_2, Plane=PlaneXY(0, 0, 0), Distance=neg, BothSides=0, Kinks=0, CapType=1)
crv_6 = Curve(offcrv_3)
number_slider_2 = Slider(0.09, range=0..1)

divide = DivideCurve(Curve=crv_6, Count=Slider(10, range=0..10), Kinks=False)  # -> Points, Tangents, Parameters
divide_2 = DivideCurve(Curve=crv_6, Count=Slider(20, range=0..100), Kinks=False)  # -> Points, Tangents, Parameters

number_slider_3 = Slider(0.03, range=0..1)
dom = Domain(DomainStart=expr("-x/2", number_slider_2), DomainEnd=expr("x/2", number_slider_2))
dom_2 = Domain(DomainStart=expr("-x/2", number_slider_2), DomainEnd=expr("x/2", number_slider_2))
Z_2 = UnitZ(Factor=number_slider)
move = Move(Geometry=crv_4, Motion=Z_2)  # -> Geometry, Transform
Z_3 = UnitZ(Factor=Slider(0.3, range=0..1))
extr_2 = Extrude(Base=move.Geometry, Direction=Z_3)
dom_3 = Domain(DomainStart=expr("-x/2", number_slider_3), DomainEnd=expr("x/2", number_slider_3))
dom_4 = Domain(DomainStart=expr("-x/2", number_slider_3), DomainEnd=expr("x/2", number_slider_3))
align = AlignPlane(Plane=divide.Points, Direction=divide.Tangents)  # -> Plane, Angle
Z_4 = UnitZ(Factor=1)
extr_3 = Extrude(Base=offcrv_3, Direction=Z_2)
box = DomainBox(Base=align.Plane, X=dom, Y=dom_2, Z=number_slider)
align_2 = AlignPlane(Plane=divide_2.Points, Direction=divide_2.Tangents)  # -> Plane, Angle
line = LineSDL(Start=divide_2.Points, Direction=Z_4, Length=number_slider)
box_2 = DomainBox(Base=align_2.Plane, X=dom_3, Y=dom_4, Z=number_slider)

swatch_2 = ColourSwatch(SwatchColor=RGB(79, 79, 79))
swatch_3 = ColourSwatch(SwatchColor=RGB(122, 122, 122))
swatch_4 = ColourSwatch(SwatchColor=RGB(151, 171, 209))
cap_2 = CapHoles(Brep=extr_2)
swatch_5 = ColourSwatch(SwatchColor=RGB(153, 153, 153))
bake_2 = ObjectBake(
    BakeToggle=button,
    GeometryObjects=box_2,
    Layer="MULLIONS",
    ObjectName="GH_Obj",
    ObjectColor=swatch_2,
    LayerColor=swatch_2)
bake_3 = ObjectBake(
    BakeToggle=button,
    GeometryObjects=extr_3,
    Layer="BIG MULLIONS",
    ObjectName="GH_Obj",
    ObjectColor=swatch_3,
    LayerColor=swatch_3)
bake_4 = ObjectBake(BakeToggle=button, GeometryObjects=extr_3, Layer="GLASS", ObjectName="GH_Obj", ObjectColor=swatch_4, LayerColor=swatch_4)
bake_5 = ObjectBake(BakeToggle=button, GeometryObjects=cap_2, Layer="ROOF", ObjectName="GH_Obj", ObjectColor=swatch_5, LayerColor=swatch_5)
preview_2 = CustomPreview(Geometry=box_2, Material=swatch_2)
preview_3 = CustomPreview(Geometry=box, Material=swatch_3)
preview_4 = CustomPreview(Geometry=extr_3, Material=swatch_4)
preview_5 = CustomPreview(Geometry=cap_2, Material=swatch_5)

debrep_3 = DeconstructBrep(Brep=cap_2)  # -> Faces, Edges, Vertices
item_3 = ListItem(List=debrep_3.Faces, Index=Slider(1, range=0..3), Wrap=True)
number_slider_4 = Slider(0.1, range=0..0.1)
# Trellis
number_slider_5 = Slider(10, range=0..10)
edges = BrepEdges(Brep=item_3)  # -> Naked, Interior, NonManifold
division = Division(A=number_slider_4, B=Slider(2, range=0..10))
offcrv_4 = OffsetCurve(Curve=edges.Naked, Plane=PlaneXY(0, 0, 0), Distance=division, BothSides=0, Kinks=0, CapType=1)
divide_3 = DivideCurve(Curve=offcrv_4, Count=number_slider_5, Kinks=False)  # -> Points, Tangents, Parameters
align_3 = AlignPlane(Plane=divide_3.Points, Direction=divide_3.Tangents)  # -> Plane, Angle
dom_5 = Domain(DomainStart=expr("-x/2", number_slider_4), DomainEnd=expr("x/2", number_slider_4))
dom_6 = Domain(DomainStart=expr("-x/2", number_slider_4), DomainEnd=expr("x/2", number_slider_4))
number_slider_6 = Slider(0.45, range=0..1)
boundary = Curve(edges.Naked)
box_3 = DomainBox(Base=align_3.Plane, X=dom_5, Y=dom_6, Z=number_slider_6)
Z_5 = UnitZ(Factor=number_slider_6)
move_2 = Move(Geometry=boundary, Motion=Z_5)  # -> Geometry, Transform
offset = OffsetCurve(Curve=move_2.Geometry, Distance=Slider(1, range=0..1), Corners=1)
offset_2 = OffsetCurve(Curve=offset, Distance=Slider(0.1, range=0..0.1), Corners=1)
boundary_2 = BoundarySurfaces(Edges=offset_2)
split = SplitBrep(Brep=boundary_2, Cutter=offset)
number_slider_7 = Slider(0.25, range=0..1)
dispatch_2 = Dispatch(List=split, DispatchPattern=[True, False])  # -> ListA, ListB
srf_2 = Surface(dispatch_2.ListB)
srf_3 = Surface(dispatch_2.ListA)
edges_2 = BrepEdges(Brep=srf_3)  # -> Naked, Interior, NonManifold
Z_6 = UnitZ(Factor=number_slider_7)
crv_7 = Curve(edges_2.Naked)
curvepoint = PointOnCurve(edges_2.Naked, parameter=0.5)
curvepoint_2 = PointOnCurve(edges_2.Naked, parameter=0)
crv_8 = Curve(edges_2.Naked)
curvepoint_3 = PointOnCurve(edges_2.Naked, parameter=0.25)
curvepoint_4 = PointOnCurve(edges_2.Naked, parameter=0.75)
extr_4 = Extrude(Base=srf_2, Direction=Z_6)
ln = Line(StartPoint=curvepoint_2, EndPoint=curvepoint)
ln_2 = Line(StartPoint=curvepoint_3, EndPoint=curvepoint_4)
divide_4 = DivideCurve(Curve=ln, Count=Slider(12, range=0..100), Kinks=False)  # -> Points, Tangents, Parameters
divide_5 = DivideCurve(Curve=ln_2, Count=Slider(33, range=0..100), Kinks=False)  # -> Points, Tangents, Parameters
align_4 = AlignPlane(Plane=divide_4.Points, Direction=divide_4.Tangents)  # -> Plane, Angle
align_5 = AlignPlane(Plane=divide_5.Points, Direction=divide_5.Tangents)  # -> Plane, Angle
deplane = DeconstructPlane(Plane=align_4.Plane)  # -> Origin, XAxis, YAxis, ZAxis
deplane_2 = DeconstructPlane(Plane=align_5.Plane)  # -> Origin, XAxis, YAxis, ZAxis
number_slider_8 = Slider(25, range=0..100)
number_slider_9 = Slider(25, range=0..100)
line_2 = LineSDL(Start=deplane.Origin, Direction=expr("-x", deplane.YAxis), Length=number_slider_8)  # -> flatten(Line)
line_3 = LineSDL(Start=deplane.Origin, Direction=deplane.YAxis, Length=number_slider_8)  # -> flatten(Line)
line_4 = LineSDL(Start=deplane_2.Origin, Direction=expr("-x", deplane_2.YAxis), Length=number_slider_9)  # -> flatten(Line)
line_5 = LineSDL(Start=deplane_2.Origin, Direction=deplane_2.YAxis, Length=number_slider_9)  # -> flatten(Line)
join = JoinCurves(Curves=[line_3, line_2], Preserve=False)
num = Number(number_slider_7)
join_2 = JoinCurves(Curves=[line_5, line_4], Preserve=False)
trim = TrimWithRegion(Curve=join, Region=crv_7, Plane=crv_7)  # -> Inside, Outside
trim_2 = TrimWithRegion(Curve=join_2, Region=crv_8, Plane=crv_8)  # -> Inside, Outside
crv_9 = Curve(trim.Inside)
crv_10 = Curve(trim_2.Inside)
offcrv_5 = OffsetCurve(Curve=crv_9, Plane=PlaneXY(0, 0, 0), Distance=Slider(0.1, range=0..0.1), BothSides=0, Kinks=0, CapType=1)
offcrv_6 = OffsetCurve(Curve=crv_10, Plane=PlaneXY(0, 0, 0), Distance=Slider(0.1, range=0..0.1), BothSides=0, Kinks=0, CapType=1)
Z_7 = UnitZ(Factor=num)
Z_8 = UnitZ(Factor=num)
extr_5 = Extrude(Base=offcrv_5, Direction=Z_7)
extr_6 = Extrude(Base=offcrv_6, Direction=Z_8)
cap_3 = CapHoles(Brep=extr_5)
cap_4 = CapHoles(Brep=extr_6)

trellis = Geometry([cap_3, cap_4, extr_4, box_3])
swatch_6 = ColourSwatch(SwatchColor=RGB(79, 79, 79))
bake_6 = ObjectBake(
    BakeToggle=button,
    GeometryObjects=trellis,
    Layer="TRELLIS",
    ObjectName="GH_Obj",
    ObjectColor=swatch_6,
    LayerColor=swatch_6)
preview_6 = CustomPreview(Geometry=trellis, Material=swatch_6)
