# Grasshopper definition railing-glass-type-1.gh (Grasshopper 1.0.7)
# plug-ins: LunchBox, Pufferfish

pick_your_curve = Curve(<curve referenced from the Rhino model>)
handrail_offset = Slider(0.08, range=0..0.1)
glass_thickness = Slider(0.01, range=0..0.01)
railing_height = Slider(1.067, range=0..1.5)
baluster_distance = Slider(1.3, range=0..10)

bake = Button()

# ---- group: FLIP CURVE
_0_or_1 = Slider(0, range=0..1)
flip = FlipCurve(Curve=pick_your_curve)  # -> Curve, Flag

# ----
# NOTES: Author: Mesut Sala
# Version: v0.0, April 12, 2021
# 
# Use: Create a glass panel railing along a curve
# Note the unit conversion factor. The current set-up is intended for a file in meters.
# 
# Handrail supports are internalized in the "HANDRAIL SUPPORT".
# 
# Otherwise, if you create your own, they should be located at the (0,0,0) and be oriented.
panel = Panel("Input")
neg = Negative(Value=handrail_offset)
crv = Curve(pick_your_curve)
divlength = DivideLength(Curve=pick_your_curve, Length=baluster_distance)  # -> Points, Tangents, Parameters
num = Number(railing_height)
panel_2 = Panel("Geometry Creation")
filter = StreamFilter(Gate=_0_or_1, Stream0=flip.Curve, Stream1=crv)
lng = ListLength(List=divlength.Points)
offset = OffsetCurve(Curve=filter, Distance=neg, Plane=PlaneXY(0, 0, 0), Corners=1)
divide = DivideCurve(Curve=filter, Count=lng, Kinks=False)  # -> Points, Tangents, Parameters
panel_3 = Panel(lng)
hframe = HorizontalFrame(Curve=filter, Parameter=divide.Parameters)  # -> graft(Frame)
align = AlignPlane(Plane=divide.Points, Direction=divide.Tangents)  # -> Plane, Angle
Z = UnitZ(Factor=num)
crv_2 = Curve(offset)
subtraction = Subtraction(A=num, B=Slider(0.1524, range=0..1))

# ---- group: HANDRAIL SUPPORT
handrail_support = Geometry(flatten([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]))
viewer = ParamViewer(handrail_support)
xy = XYPlane(Origin=Point(0, 0, 0))
orient = Orient(Geometry=handrail_support, Source=xy, Target=hframe)  # -> Geometry, Transform
subtraction_2 = Subtraction(A=subtraction, B=Slider(0.06, range=0..1))
Z_2 = UnitZ(Factor=subtraction_2)
move = Move(Geometry=orient.Geometry, Motion=Z_2)  # -> Geometry, Transform

# ----
Z_3 = UnitZ(Factor=subtraction)
extr = Extrude(Base=pick_your_curve, Direction=Z)
move_2 = Move(Geometry=crv_2, Motion=Z_3)  # -> Geometry, Transform
viewer_2 = ParamViewer(hframe)
division = Division(A=Slider(0.02, range=0.01..4), B=Slider(2, range=0..10))
division_2 = Division(A=Slider(0.02, range=0.01..4), B=Slider(2, range=0..10))
brep = Brep(extr)
dom = Domain(DomainStart=expr("-x/2", division), DomainEnd=expr("x/2", division))
dom_2 = Domain(DomainStart=expr("-x/2", division_2), DomainEnd=expr("x/2", division_2))
viewer_3 = ParamViewer(brep)
division_3 = Division(A=Slider(0.03, range=0..0.1), B=Slider(2, range=0..10))
box = DomainBox(Base=align.Plane, X=dom, Y=dom_2, Z=num)  # -> simplify(flatten(Box))
splitmul = SplitBrepMultiple(Brep=brep, Cutters=box)  # -> simplify(graft(Result))
pipe = Pipe(Curve=move_2.Geometry, Radius=division_3, Caps=0)
viewer_4 = ParamViewer(move.Geometry)
viewer_5 = ParamViewer(box)
dispatch = Dispatch(List=splitmul, DispatchPattern=[True, False])  # -> ListA, ListB
panel_4 = Panel(splitmul)
viewer_6 = ParamViewer(splitmul)
split = SplitList(List=splitmul, Index=dispatch.ListA)  # -> ListA, ListB
brep_2 = Brep(split.ListA)
brep_3 = Brep(split.ListB)
viewer_7 = ParamViewer(brep_2)
clean = CleanTree(RemoveNulls=True, RemoveInvalid=True, RemoveEmpty=Toggle(True), Tree=brep_2)
viewer_8 = ParamViewer(clean)
offsrf = OffsetSurface(Surface=clean, Distance=glass_thickness, BothSides=0, CreateSolid=True)

panel_5 = Panel("BALUSTER MULLIONS")  # disabled
swatch = ColourSwatch(SwatchColor=RGB(196, 188, 188))  # disabled
swatch_2 = ColourSwatch(SwatchColor=RGB(252, 189, 105))
swatch_3 = ColourSwatch(SwatchColor=RGB(196, 188, 188))
swatch_4 = ColourSwatch(SwatchColor=RGB(151, 171, 209))
preview = CustomPreview(Geometry=offsrf, Material=swatch_4)
preview_2 = CustomPreview(Geometry=pipe, Material=swatch_2)
preview_3 = CustomPreview(Geometry=box, Material=swatch)  # disabled
bake_2 = ObjectBake(
    BakeToggle=bake,
    GeometryObjects=flatten(offsrf),
    Layer="RAILING GLASS",
    ObjectName="GH_Obj",
    ObjectColor=swatch_4,
    LayerColor=swatch_4)
bake_3 = ObjectBake(
    BakeToggle=bake,
    GeometryObjects=move.Geometry,
    Layer="HANDRAIL SUPPORTS",
    ObjectName="GH_Obj",
    ObjectColor=swatch_3,
    LayerColor=swatch_3)
bake_4 = ObjectBake(BakeToggle=bake, GeometryObjects=pipe, Layer="HANDRAILS", ObjectName="GH_Obj", ObjectColor=swatch_2, LayerColor=swatch_2)
bake_5 = ObjectBake(BakeToggle=bake, GeometryObjects=box, Layer=panel_5, ObjectName="GH_Obj", ObjectColor=swatch, LayerColor=swatch)  # disabled
preview_4 = CustomPreview(Geometry=move.Geometry, Material=swatch_3)
