# Grasshopper definition railing-glass-type - 2.gh (Grasshopper 1.0.7)
# Copyright: Safdie Architects, LLC
# plug-ins: LunchBox

# ---- group: Set-Out
curves_as_paths = Curve(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)
list = ValueList({"Regular": 0, "Goofy": 1}, selected="Regular")
trim_start = Slider(12, range=0..200)
trim_end = Slider(12, range=0..200)
flip = FlipCurve(Curve=curves_as_paths)  # -> Curve, Flag
filter = StreamFilter(Gate=list, Stream0=curves_as_paths, Stream1=flip.Curve)
panel_length = Slider(1.6, range=0.3..1.8)
unit_conversion_factor_1000 = Number(1000)
trim_ends_of_curve = TrimEndsOfCurve(R=trim_start, R_2=trim_end, curves_as_paths=filter)
baluster_single_brep = Brep(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)
list_2 = ValueList({"1. Start": 0, "2. End": 1, "3. Midpoint edge": 2, "4. Midpoint center": 3, "5. Equal": 4}, selected="5. Equal")
curves_as_paths_2 = Curve(trim_ends_of_curve)

# ---- group: Panel Size
half_joint_width = Slider(5, range=0..100)
glass_thickness = Slider(12, range=0..100)
panel_height = Slider(1100, range=0..1200)
horiz_offset = Slider(75, range=0..100)
vert_offset = Slider(75, range=0..100)

# ---- group: Handrail
handrail_radius = Slider(25, range=10..30)
handrail_height = Slider(900, range=0..1000)
handrail_offset = Slider(125, range=0..400)

# ---- group: Oven Control
balusters_guardrails = BooleanToggle(False)
handrails = BooleanToggle(False)

# ----
end_baluster_single_brep = Brep(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)
# NOTES: Version: v0.0, August, 2021
# 
# Use: Create a glass panel railing along a curve
# 
# 1. You can use the edge of a surface or polysurface if you Right-click the Curve as Path > Set one Curve without anything selected in Rhino.
# 
# 2. The "Regular" or "Goofy" value list will flip the railing orientation inside or outside of the curve. All the other slider parameters assume you are using the file's units.
# Note the unit conversion factor. The current set-up is intended for a file in millimeters, but panel lengths set in meters.
# 
# Balusters are internalized in the "Baluster (single Brep)" and "End Baluster (single Brep)" components, but can also be found here:
# 
# Otherwise, if you create your own, they should be located at the (0,0,0) and be oriented such that +y=outside, -y=inside. Each should be a single polysurface.
panel = Panel("Input/Output")
multiplication = Multiplication(A=panel_length, B=unit_conversion_factor_1000)
panel_2 = Panel("Geometry Creation")

# ---- group: Midtpoint Center
number = Number(0.5)
crv = Curve(curves_as_paths_2)
eval = EvaluateLength(Curve=crv, Length=number, Normalized=True)  # -> Point, Tangent, Parameter
shatter = Shatter(Curve=crv, Parameters=eval.Parameter)
panel_3 = Panel(multiplication)
dispatch = Dispatch(List=shatter, DispatchPattern=[True, False])  # -> ListA, ListB
cir = Circle(Plane=eval.Point, Radius=expr("x/2", panel_3))
flip_2 = FlipCurve(Curve=dispatch.ListA)  # -> Curve, Flag
ccx = CurveCurve(CurveA=flip_2.Curve, CurveB=cir)  # -> Points, ParamsA, ParamsB
ccx_2 = CurveCurve(CurveA=dispatch.ListB, CurveB=cir)  # -> Points, ParamsA, ParamsB
shatter_2 = Shatter(Curve=flip_2.Curve, Parameters=ccx.ParamsA)
shatter_3 = Shatter(Curve=dispatch.ListB, Parameters=ccx_2.ParamsA)
dispatch_2 = Dispatch(List=shatter_2, DispatchPattern=[True, False])  # -> ListA, ListB
dispatch_3 = Dispatch(List=shatter_3, DispatchPattern=[True, False])  # -> ListA, ListB
panel_4 = Panel(multiplication)
panel_5 = Panel(multiplication)
divdist = DivideDistance(Curve=dispatch_2.ListB, Distance=panel_4)  # -> reverse(flatten(Points)), Tangents, Parameters
divdist_2 = DivideDistance(Curve=dispatch_3.ListB, Distance=panel_5)  # -> flatten(Points), Tangents, Parameters
end = EndPoints(Curve=crv)  # -> flatten(Start), flatten(End)
merge = Merge(Data1=end.Start, Data2=divdist.Points, Data3=divdist_2.Points, Data4=end.End)

# ---- group: Midpoint Edge
crv_2 = Curve(curves_as_paths_2)
number_2 = Number(0.5)
eval_2 = EvaluateLength(Curve=crv_2, Length=number_2, Normalized=True)  # -> Point, Tangent, Parameter
shatter_4 = Shatter(Curve=crv_2, Parameters=eval_2.Parameter)
dispatch_4 = Dispatch(List=shatter_4, DispatchPattern=[True, False])  # -> ListA, ListB
panel_6 = Panel(multiplication)
flip_3 = FlipCurve(Curve=dispatch_4.ListA)  # -> Curve, Flag
divdist_3 = DivideDistance(Curve=dispatch_4.ListB, Distance=panel_6)  # -> Points, Tangents, Parameters
panel_7 = Panel(multiplication)
divdist_4 = DivideDistance(Curve=flip_3.Curve, Distance=panel_7)  # -> reverse(flatten(Points)), Tangents, Parameters
cull_i = CullIndex(List=divdist_3.Points, Indices=0, Wrap=True)  # -> flatten(List)
end_2 = EndPoints(Curve=crv_2)  # -> flatten(Start), flatten(End)
merge_2 = Merge(Data1=end_2.Start, Data2=divdist_4.Points, Data3=cull_i, Data4=end_2.End)

# ---- group: Equal
crv_3 = Curve(curves_as_paths_2)
panel_8 = Panel(multiplication)
len = Length(Curve=crv_3)
division = Division(A=len, B=panel_8)
round = Round(Number=division)  # -> Nearest, Floor, Ceiling
divide = DivideCurve(Curve=crv_3, Count=round.Ceiling, Kinks=False)  # -> Points, Tangents, Parameters

# ---- group: End
crv_4 = Curve(curves_as_paths_2)
flip_4 = FlipCurve(Curve=crv_4)  # -> Curve, Flag
panel_9 = Panel(multiplication)
divdist_5 = DivideDistance(Curve=flip_4.Curve, Distance=panel_9)  # -> flatten(Points), Tangents, Parameters
end_3 = EndPoints(Curve=flip_4.Curve)  # -> flatten(Start), flatten(End)
merge_3 = Merge(Data1=divdist_5.Points, Data2=end_3.End)

# ---- group: Start
panel_10 = Panel(multiplication)
crv_5 = Curve(curves_as_paths_2)
divdist_6 = DivideDistance(Curve=crv_5, Distance=panel_10)  # -> flatten(Points), Tangents, Parameters
end_4 = EndPoints(Curve=crv_5)  # -> flatten(Start), flatten(End)
merge_4 = Merge(Data1=divdist_6.Points, Data2=end_4.End)

# ---- group: Select Case
panel_11 = Panel(list_2)
filter_2 = StreamFilter(Gate=panel_11, Stream0=merge_4, Stream1=merge_3, Stream2=merge_2, Stream3=merge, Stream4=divide.Points)

# ---- group: Start Datum
curves_as_paths_3 = Curve(filter)
end_5 = EndPoints(Curve=curves_as_paths_3)  # -> Start, End
curvepoint = PointOnCurve(curves_as_paths_3, parameter=0.616)
filter_3 = StreamFilter(Gate=panel_11, Stream0=end_5.Start, Stream1=end_5.End, Stream2=curvepoint, Stream3=curvepoint)
_150 = Integer(150)
O = Text("O")
tag = TextTag3D(Location=filter_3, Text=O, Size=_150, Colour=ColourSwatch(SwatchColor=RGB(255, 0, 153)), Justification=5)

# ----
size = Slider(347, range=0..500)
points = PointList(Points=filter_2, Tags=True, Lines=True, Size=size)

crv_6 = Curve(curves_as_paths_2)
crv_cp = CurveClosestPoint(Point=filter_2, Curve=crv_6)  # -> Point, Parameter, Distance
hframe = HorizontalFrame(Curve=crv_6, Parameter=crv_cp.Parameter)

# ---- group: Balusters
_1 = Integer(1)
split = SplitList(List=hframe, Index=_1)  # -> ListA, ListB
lng = ListLength(List=split.ListB)
mid_baluster = Brep(baluster_single_brep)
end_baluster = Brep(end_baluster_single_brep)
split_2 = SplitList(List=split.ListB, Index=expr("x-1", lng))  # -> ListA, ListB
mirror = Mirror(Geometry=end_baluster, Plane=PlaneYZ(0, 0, 0))  # -> Geometry, Transform
orient = Orient(Geometry=mirror.Geometry, Source=PlaneXY(0, 0, 0), Target=split.ListA)  # -> Geometry, Transform
orient_2 = Orient(Geometry=mid_baluster, Source=PlaneXY(0, 0, 0), Target=split_2.ListA)  # -> Geometry, Transform
orient_3 = Orient(Geometry=end_baluster, Source=PlaneXY(0, 0, 0), Target=split_2.ListB)  # -> Geometry, Transform
brep = Brep(flatten([orient.Geometry, orient_2.Geometry, orient_3.Geometry]))

# ---- group: Handrail
crv_7 = Curve(curves_as_paths_2)
panel_12 = Panel(handrail_height)
panel_13 = Panel(handrail_offset)
panel_14 = Panel(handrail_radius)
offset = Offset(Curve=crv_7, Distance=panel_13, Plane=PlaneXY(0, 0, 0), Corners=1)
Z = UnitZ(Factor=panel_12)
move = Move(Geometry=offset, Motion=Z)  # -> Geometry, Transform
list_3 = ValueList({"None": 0, "Flat": 1, "Round": 2}, selected="Flat")
pipe = Pipe(Curve=move.Geometry, Radius=panel_14, Caps=list_3)

# ---- group: Panels
deplane = DeconstructPlane(Plane=hframe)  # -> Origin, XAxis, YAxis, ZAxis
panel_15 = Panel(horiz_offset)
amp = Amplitude(Vector=deplane.YAxis, Amplitude=expr("-x", panel_15))
move_2 = Move(Geometry=filter_2, Motion=amp)  # -> Geometry, Transform
panel_16 = Panel(panel_height)
panel_17 = Panel(vert_offset)
relitem = RelativeItem(Tree=simplify(graft(move_2.Geometry)), Offset="{+1}(0)", WrapPaths=False, WrapItems=False)  # -> ItemA, ItemB
ln = Line(StartPoint=relitem.ItemA, EndPoint=relitem.ItemB)  # -> flatten(Line)
Z_2 = UnitZ(Factor=panel_17)
move_3 = Move(Geometry=ln, Motion=Z_2)  # -> Geometry, Transform
end_6 = EndPoints(Curve=move_3.Geometry)  # -> Start, End
panel_18 = Panel(half_joint_width)
cir_2 = Circle(Plane=end_6.Start, Radius=panel_18)  # -> graft(Circle)
ccx_3 = CurveCurve(CurveA=simplify(graft(move_3.Geometry)), CurveB=simplify(cir_2))  # -> simplify(Points), ParamsA, ParamsB
shatter_5 = Shatter(Curve=simplify(graft(move_3.Geometry)), Parameters=simplify(ccx_3.ParamsA))
panel_19 = Panel("""True
False""")
panel_20 = Panel(half_joint_width)
cir_3 = Circle(Plane=end_6.End, Radius=panel_20)  # -> graft(Circle)
cull = CullPattern(List=shatter_5, CullPattern=invert(panel_19))
ccx_4 = CurveCurve(CurveA=simplify(graft(cull)), CurveB=simplify(cir_3))  # -> simplify(Points), ParamsA, ParamsB
shatter_6 = Shatter(Curve=simplify(graft(cull)), Parameters=simplify(ccx_4.ParamsA))
panel_21 = Panel("""True
False""")
cull_2 = CullPattern(List=shatter_6, CullPattern=panel_21)
panel_22 = Panel(glass_thickness)

# ----
subtraction = Subtraction(A=panel_16, B=panel_17)
cull_i_2 = CullIndex(List=deplane.YAxis, Indices=0, Wrap=True)

# ---- group: Panels (continued)
Z_3 = UnitZ(Factor=subtraction)
amp_2 = Amplitude(Vector=cull_i_2, Amplitude=expr("-x", panel_22))
extr = Extrude(Base=flatten(cull_2), Direction=Z_3)
extr_2 = Extrude(Base=extr, Direction=amp_2)

# ---- group: Oven
swatch = ColourSwatch(SwatchColor=RGB(120, 120, 120))
swatch_2 = ColourSwatch(SwatchColor=RGB(151, 171, 209))
swatch_3 = ColourSwatch(SwatchColor=RGB(252, 189, 105))
preview = CustomPreview(Geometry=brep, Material=swatch)
preview_2 = CustomPreview(Geometry=extr_2, Material=swatch_2)
preview_3 = CustomPreview(Geometry=pipe, Material=swatch_3)  # disabled
bake = ObjectBake(
    BakeToggle=balusters_guardrails,
    GeometryObjects=brep,
    Layer="BALUSTERS",
    ObjectName="GH_Obj",
    ObjectColor=swatch,
    LayerColor=swatch)
bake_2 = ObjectBake(
    BakeToggle=balusters_guardrails,
    GeometryObjects=extr_2,
    Layer="GUARDRAILS",
    ObjectName="GH_Obj",
    ObjectColor=swatch_2,
    LayerColor=swatch_2)
bake_3 = ObjectBake(
    BakeToggle=balusters_guardrails,
    GeometryObjects=move.Geometry,
    Layer="HANRAILS",
    ObjectName="GH_Obj",
    ObjectColor=swatch_3,
    LayerColor=swatch_3)
bake_4 = ObjectBake(
    BakeToggle=handrails,
    GeometryObjects=pipe,
    Layer="HANRAILS",
    ObjectName="GH_Obj",
    ObjectColor=swatch_3,
    LayerColor=swatch_3)

# ==== cluster TrimEndsOfCurve
curves_as_paths = ClusterInput()
curves_as_paths_2 = Curve(curves_as_paths)
end = EndPoints(Curve=curves_as_paths_2)  # -> Start, End
R = ClusterInput()
R_2 = ClusterInput()
sph = Sphere(Base=end.Start, Radius=R)
sph_2 = Sphere(Base=end.End, Radius=R_2)
bcx = BrepCurve(Brep=[sph, sph_2], Curve=curves_as_paths_2)  # -> Curves, flatten(Points)
crv_cp = CurveClosestPoint(Point=bcx.Points, Curve=curves_as_paths_2)  # -> Point, Parameter, Distance
shatter = Shatter(Curve=curves_as_paths_2, Parameters=crv_cp.Parameter)
_1 = Integer(1)
item = ListItem(List=shatter, Index=_1, Wrap=True)
i = ClusterOutput(item)
