# Grasshopper definition railing-metal.gh (Grasshopper 1.0.7)
# Copyright: Safdie Architects, LLC
# plug-ins: LunchBox

max_baluster_spacing = Panel("100")
upper_rail_height = Panel("1100")
lower_rail_height = Panel("100")
post_thickness = Panel("10")
post_width = Panel("50")
baluster_thickness = Panel("6")
baluster_width = Panel("30")
handrail_height = Panel("900")
handrail_offset = Panel("65")
handrail_radius = Panel("25")
max_post_spacing = Panel("1500")
polyline_curve_path = Curve(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)

list = ValueList({"mm": 1, "Ft": 0.00328084}, selected="Ft")
# NOTES: Use: Create a metal railing along a polycurve
# 
# v1.2 Update:
# - Improved rail orientation
# 
# Plugins used:
panel = Panel("Input")
multiplication = Multiplication(A=max_post_spacing, B=list)
multiplication_2 = Multiplication(A=max_baluster_spacing, B=list)
multiplication_3 = Multiplication(A=upper_rail_height, B=list)
multiplication_4 = Multiplication(A=lower_rail_height, B=list)
multiplication_5 = Multiplication(A=post_thickness, B=list)
multiplication_6 = Multiplication(A=post_width, B=list)
multiplication_7 = Multiplication(A=baluster_thickness, B=list)
multiplication_8 = Multiplication(A=baluster_width, B=list)
multiplication_9 = Multiplication(A=handrail_height, B=list)
multiplication_10 = Multiplication(A=handrail_offset, B=list)
multiplication_11 = Multiplication(A=handrail_radius, B=list)
panel_2 = Panel("Geometry Creation")

# ---- group: copies these across definition for cleanliness
max_post_spacing_2 = Panel(multiplication)
max_baluster_spacing_2 = Panel(multiplication_2)
upper_rail_height_2 = Panel(multiplication_3)
lower_rail_height_2 = Panel(multiplication_4)
post_thickness_2 = Panel(multiplication_5)
post_width_2 = Panel(multiplication_6)
baluster_thickness_2 = Panel(multiplication_7)
baluster_width_2 = Panel(multiplication_8)
handrail_height_2 = Panel(multiplication_9)
handrail_offset_2 = Panel(multiplication_10)
handrail_radius_2 = Panel(multiplication_11)
polyline_curve_path_2 = Curve(polyline_curve_path)

# ---- group: Post and Rail Profile
post_width_3 = Panel(post_width_2)
post_thickness_3 = Panel(post_thickness_2)
dom = ConstructDomain(DomainStart=expr("x/2", post_thickness_3), DomainEnd=expr("-x/2", post_thickness_3))
dom_2 = ConstructDomain(DomainStart=expr("x/2", post_width_3), DomainEnd=expr("-x/2", post_width_3))
rectangle = Rectangle(Plane=PlaneXY(0, 0, 0), XSize=dom, YSize=dom_2, Radius=0)  # -> Rectangle, Length

baluster_thickness_3 = Panel(baluster_thickness_2)
baluster_width_3 = Panel(baluster_width_2)
dom_3 = ConstructDomain(DomainStart=expr("x/2", baluster_thickness_3), DomainEnd=expr("-x/2", baluster_thickness_3))
dom_4 = ConstructDomain(DomainStart=expr("x/2", baluster_width_3), DomainEnd=expr("-x/2", baluster_width_3))
rectangle_2 = Rectangle(Plane=PlaneXY(0, 0, 0), XSize=dom_3, YSize=dom_4, Radius=0)  # -> Rectangle, Length

# ---- group: Top and Bottom Rails
upper_rail_height_3 = Panel(upper_rail_height_2)
lower_rail_height_3 = Panel(lower_rail_height_2)
polyline_curve_path_3 = Curve(polyline_curve_path)
Z = UnitZ(Factor=upper_rail_height_3)
Z_2 = UnitZ(Factor=lower_rail_height_3)
move = Move(Geometry=polyline_curve_path_3, Motion=Z)  # -> Geometry, Transform
move_2 = Move(Geometry=polyline_curve_path_3, Motion=Z_2)  # -> Geometry, Transform
_0 = Integer(0)
pframe = PerpFrame(Curve=reparameterize(move.Geometry), Parameter=_0)
pframe_2 = PerpFrame(Curve=reparameterize(move_2.Geometry), Parameter=_0)
post_profile = Curve(rectangle.Rectangle)
Z_3 = UnitZ(Factor=1)
align = AlignPlane(Plane=pframe, Direction=Z_3)  # -> Plane, Angle
align_2 = AlignPlane(Plane=pframe_2, Direction=Z_3)  # -> Plane, Angle
orient = Orient(Geometry=post_profile, Source=PlaneXY(0, 0, 0), Target=align.Plane)  # -> Geometry, Transform
orient_2 = Orient(Geometry=post_profile, Source=PlaneXY(0, 0, 0), Target=align_2.Plane)  # -> Geometry, Transform
swp1 = Sweep1(Rail=polyline_curve_path_3, Sections=orient.Geometry, Miter=1)
swp1_2 = Sweep1(Rail=polyline_curve_path_3, Sections=orient_2.Geometry, Miter=1)
cap = CapHoles(Brep=[swp1, swp1_2])

# ---- group: Posts
polyline_curve_path_4 = Curve(polyline_curve_path)
disc = Discontinuity(Curve=polyline_curve_path_4, Level=1)  # -> Points, Parameters
max_post_spacing_3 = Panel(max_post_spacing_2)
shatter = Shatter(Curve=polyline_curve_path_4, Parameters=disc.Parameters)
len = Length(Curve=shatter)
division = Division(A=len, B=max_post_spacing_3)
upper_rail_height_4 = Panel(upper_rail_height_2)
divide = DivideCurve(Curve=shatter, Count=division, Kinks=False)  # -> Points, Tangents, Parameters
post_profile_2 = Curve(rectangle.Rectangle)
hframe = HorizontalFrame(Curve=simplify(graft(shatter)), Parameter=simplify(divide.Parameters))
boxrec = BoxRectangle(Rectangle=post_profile_2, Height=upper_rail_height_4)
orient_3 = Orient(Geometry=boxrec, Source=PlaneXY(0, 0, 0), Target=hframe)  # -> Geometry, Transform

# ---- group: Balusters
shatter_2 = Shatter(Curve=simplify(graft(shatter)), Parameters=simplify(divide.Parameters))  # -> simplify(flatten(Segments))
max_baluster_spacing_3 = Panel(max_baluster_spacing_2)
len_2 = Length(Curve=shatter_2)
division_2 = Division(A=len_2, B=max_baluster_spacing_3)
divide_2 = DivideCurve(Curve=shatter_2, Count=division_2, Kinks=False)  # -> Points, Tangents, simplify(Parameters)
lower_rail_height_4 = Panel(lower_rail_height_2)
upper_rail_height_5 = Panel(upper_rail_height_2)
lng = ListLength(List=divide_2.Parameters)
_1 = Integer(1)
dom_5 = ConstructDomain(DomainStart=_1, DomainEnd=expr("x-2", lng))
baluster_profile = Curve(rectangle_2.Rectangle)
subset = SubList(List=divide_2.Parameters, Domain=dom_5, Wrap=True)  # -> List, Index
dom_6 = ConstructDomain(DomainStart=lower_rail_height_4, DomainEnd=upper_rail_height_5)
hframe_2 = HorizontalFrame(Curve=simplify(graft(shatter_2)), Parameter=simplify(subset.List))
boxrec_2 = BoxRectangle(Rectangle=baluster_profile, Height=dom_6)
orient_4 = Orient(Geometry=boxrec_2, Source=PlaneXY(0, 0, 0), Target=hframe_2)  # -> Geometry, Transform

# ---- group: Handrail
handrail_offset_3 = Panel(handrail_offset_2)
handrail_radius_3 = Panel(handrail_radius_2)
handrail_height_3 = Panel(handrail_height_2)
polyline_curve_path_5 = Curve(polyline_curve_path)
Z_4 = UnitZ(Factor=handrail_height_3)
integer = Integer(-1)
multiplication_12 = Multiplication(A=handrail_offset_3, B=integer)
move_3 = Move(Geometry=polyline_curve_path_5, Motion=Z_4)  # -> Geometry, Transform
offset = Offset(Curve=move_3.Geometry, Distance=multiplication_12, Plane=PlaneXY(0, 0, 0), Corners=1)
pipe = Pipe(Curve=offset, Radius=handrail_radius_3, Caps=1)

# ---- group: Oven
geo = Geometry(flatten([orient_3.Geometry, pipe, cap, orient_4.Geometry]))
bake = Button()
panel_3 = Panel("PIPE")
bake_2 = ObjectBake(
    BakeToggle=bake,
    GeometryObjects=flatten(geo),
    Layer="GH_Bake",
    ObjectName="GH_Obj",
    ObjectColor=RGB(255, 255, 255),
    LayerColor=RGB(255, 255, 255))
preview = CustomPreview(Geometry=geo, Shader=ColourSwatch(SwatchColor=RGB(107, 79, 69)))
