# Grasshopper definition retail-storefront.gh (Grasshopper 1.0.7)
# plug-ins: LunchBox, Pufferfish

# ----
# Note the unit conversion factor. The current set-up is intended for a file in meters.
pick_your_curve = Curve(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)
heigth = Slider(6, range=0..12)
length = Slider(9, range=0..15)

button = Button()
divlength = DivideLength(Curve=pick_your_curve, Length=length)  # -> Points, Tangents, Parameters
number_slider = Slider(-0.3, range=-0.3..0.3)
# NOTES: Author: Mesut Sala
# Version: v0.0, April 9, 2021
# Use: Retail Storefront
# 
# Rhino file: Anyfile - Specify a curve
# 
# Plugins used:
panel = Panel("Input")
lng = ListLength(List=divlength.Points)
panel_2 = Panel("Geometry Creation")
divide = DivideCurve(Curve=pick_your_curve, Count=lng, Kinks=False)  # -> Points, Tangents, Parameters
neg = Negative(Value=number_slider)
dom = ConstructDomain(DomainStart=Slider(-0.5, range=-0.5..0.5), DomainEnd=Slider(0.5, range=-0.5..0.5))
dom_2 = ConstructDomain(DomainStart=Slider(0, range=-0.3..0.3), DomainEnd=number_slider)
align = AlignPlane(Plane=divide.Points, Direction=divide.Tangents)  # -> Plane, Angle
Z = UnitZ(Factor=heigth)
move = Move(Geometry=pick_your_curve, Motion=Z)  # -> Geometry, Transform
box = DomainBox(Base=align.Plane, X=dom, Y=dom_2, Z=heigth)
division = Division(A=neg, B=Slider(2, range=0..10))
neg_2 = Negative(Value=Slider(1.5, range=0..10))
flatten = FlattenTree(Tree=box, Path="{0}")
offcrv = OffsetCurve(Curve=move.Geometry, Plane=PlaneXY(0, 0, 0), Distance=division, BothSides=0, Kinks=0, CapType=1)
Z_2 = UnitZ(Factor=neg_2)
trim = TrimWithBreps(Curve=pick_your_curve, Brep=flatten)  # -> Inside, Outside
subtraction = Subtraction(A=heigth, B=Slider(1.5, range=0..10))
crv = Curve(trim.Outside)
extr = Extrude(Base=offcrv, Direction=Z_2)
Z_3 = UnitZ(Factor=subtraction)
divide_2 = DivideCurve(Curve=crv, Count=Slider(6, range=0..10), Kinks=False)  # -> Points, Tangents, Parameters
extr_2 = Extrude(Base=crv, Direction=Z_3)
panel_3 = Panel("""0
-1""")
align_2 = AlignPlane(Plane=divide_2.Points, Direction=divide_2.Tangents)  # -> Plane, Angle
number_slider_2 = Slider(-0.01, range=-0.02..0.02)
number_slider_3 = Slider(0.09, range=0..1)
debrep = DeconstructBrep(Brep=extr_2)  # -> Faces, Edges, Vertices
cull_i = CullIndex(List=align_2.Plane, Indices=panel_3, Wrap=True)
item = ListItem(List=debrep.Edges, Index=0, Wrap=True)  # -> Item, Item1, Item2, Item3
dom_3 = ConstructDomain(DomainStart=Slider(-0.025, range=-0.025..0.025), DomainEnd=Slider(0.025, range=-0.025..0.025))
dom_4 = ConstructDomain(DomainStart=number_slider_2, DomainEnd=number_slider_3)
crv_2 = Curve(item.Item1)
crv_3 = Curve(item.Item3)
flip = FlipCurve(Curve=crv_2)  # -> Curve, Flag
box_2 = DomainBox(Base=align_2.Plane, X=dom_3, Y=dom_4, Z=subtraction)
cap = CapHoles(Brep=extr)
offset = OffsetCurve(Curve=[flip.Curve, crv_3], Distance=expr("-x", number_slider_2), Corners=1)  # -> flatten(Curve)
offset_2 = OffsetCurve(Curve=[flip.Curve, crv_3], Distance=expr("-x", number_slider_3), Corners=1)  # -> flatten(Curve)
end = EndPoints(Curve=offset)  # -> Start, End
end_2 = EndPoints(Curve=offset_2)  # -> Start, End
ln = Line(StartPoint=end.End, EndPoint=end_2.End)
ln_2 = Line(StartPoint=end.Start, EndPoint=end_2.Start)
join = JoinCurves(Curves=[offset, ln_2, offset_2, ln], Preserve=False)
dispatch = Dispatch(List=join, DispatchPattern=[True, False])  # -> ListA, ListB
crv_4 = Curve(dispatch.ListA)
crv_5 = Curve(dispatch.ListB)
Z_4 = UnitZ(Factor=dom_3)
neg_3 = Negative(Value=Z_4)
extr_3 = Extrude(Base=crv_4, Direction=neg_3)
extr_4 = Extrude(Base=crv_5, Direction=Z_4)
cap_2 = CapHoles(Brep=[extr_3, extr_4])
merge = Merge(Data1=box_2, Data2=cap_2)

swatch = ColourSwatch(SwatchColor=RGB(107, 107, 107))
swatch_2 = ColourSwatch(SwatchColor=RGB(151, 171, 209))
swatch_3 = ColourSwatch(SwatchColor=RGB(196, 196, 196))
swatch_4 = ColourSwatch(SwatchColor=RGB(138, 138, 138))
preview = CustomPreview(Geometry=merge, Material=swatch)
bake = ObjectBake(
    BakeToggle=button,
    GeometryObjects=cap,
    Layer="STOREFRONT",
    ObjectName="GH_Obj",
    ObjectColor=swatch_3,
    LayerColor=swatch_3)
bake_2 = ObjectBake(
    BakeToggle=button,
    GeometryObjects=extr_2,
    Layer="STOREFRONT GLAZING",
    ObjectName="GH_Obj",
    ObjectColor=swatch_2,
    LayerColor=swatch_2)
bake_3 = ObjectBake(BakeToggle=button, GeometryObjects=merge, Layer="MULLIONS", ObjectName="GH_Obj", ObjectColor=swatch, LayerColor=swatch)
bake_4 = ObjectBake(
    BakeToggle=button,
    GeometryObjects=box,
    Layer="STOREFRONT",
    ObjectName="GH_Obj",
    ObjectColor=swatch_4,
    LayerColor=swatch_4)
preview_2 = CustomPreview(Geometry=extr_2, Material=swatch_2)
preview_3 = CustomPreview(Geometry=cap, Material=swatch_3)
preview_4 = CustomPreview(Geometry=box, Material=swatch_4)
