# Grasshopper definition roof-panels.gh (Grasshopper 1.0.7)
# plug-ins: Wombat, ClipperComponents, LunchBox, treesloth01, EleFront

# NOTES: Author: Mesut Sala
# Version: v0.0, August, 2021
# Use: Event Hall Roof Panels
# 
# Rhino file: Pick curves
# Plugins used:
panel = Panel("Input/Output")
panel_2 = Panel("Geometry Creation")

top_surface = Surface(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)
U = Slider(22, range=0..100)
V = Slider(60, range=0..100)

uvdisplay = SurfaceUVDisplay(Surfaces=top_surface, Size=1)
# STEP D: UNDERSIDE OF THE ROOF
srf = Surface(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)
debrep = DeconstructBrep(Brep=top_surface)  # -> Faces, Edges, Vertices
srf_2 = Surface([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])
U_2 = Number(U)
V_2 = Number(V)

# ----
# ALTERNATIVE WAY TO CREATE TRIANGULAR PANELS WITHOUT USING 'PANELING TOOLS OR LUNCHBOX'.
U_3 = Slider(22, range=0..100)
surface = Surface(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)
divide_domain² = DivideDomain²(Domain=surface, UCount=U_3, VCount=Slider(1, range=0..100))
isotrim = Isotrim(Surface=surface, Domain=divide_domain²)
dispatch = Dispatch(List=isotrim, DispatchPattern=[True, False])  # -> ListA, ListB
surface_2 = Surface(dispatch.ListA)
surface_3 = Surface(dispatch.ListB)
surface_4 = Surface(surface_3)
deconstruct_brep = DeconstructBrep(Brep=surface_2)  # -> Faces, Edges, Vertices
surface_5 = Surface(surface_4)
V_3 = Slider(60, range=0..100)
list_item = ListItem(List=deconstruct_brep.Edges, Index=0, Wrap=True)  # -> Item, Item1, Item2, Item3
deconstruct_brep_2 = DeconstructBrep(Brep=surface_5)  # -> Faces, Edges, Vertices
flip_curve = FlipCurve(Curve=list_item.Item3)  # -> Curve, Flag
list_item_2 = ListItem(List=deconstruct_brep_2.Edges, Index=0, Wrap=True)  # -> Item, Item1, Item2, Item3
divide_curve = DivideCurve(Curve=flip_curve.Curve, Count=V_3, Kinks=False)  # -> Points, Tangents, Parameters
divide_curve_2 = DivideCurve(Curve=list_item.Item1, Count=V_3, Kinks=False)  # -> Points, Tangents, Parameters
flip_curve_2 = FlipCurve(Curve=list_item_2.Item3)  # -> Curve, Flag
point_list = PointList(Points=divide_curve.Points)
point_list_2 = PointList(Points=divide_curve_2.Points)
dispatch_2 = Dispatch(List=divide_curve.Points, DispatchPattern=[True, False])  # -> ListA, ListB
dispatch_3 = Dispatch(List=divide_curve_2.Points, DispatchPattern=[True, False])  # -> ListA, ListB
divide_curve_3 = DivideCurve(Curve=flip_curve_2.Curve, Count=V_3, Kinks=False)  # -> Points, Tangents, Parameters
divide_curve_4 = DivideCurve(Curve=list_item_2.Item1, Count=V_3, Kinks=False)  # -> Points, Tangents, Parameters
point = Point(dispatch_2.ListA)
point_2 = Point(dispatch_2.ListB)
point_3 = Point(dispatch_3.ListA)
point_4 = Point(dispatch_3.ListB)
dispatch_4 = Dispatch(List=divide_curve_4.Points, DispatchPattern=[True, False])  # -> ListA, ListB
dispatch_5 = Dispatch(List=divide_curve_3.Points, DispatchPattern=[True, False])  # -> ListA, ListB
point_list_3 = PointList(Points=divide_curve_3.Points)
weave = Weave(Pattern=[0, 1], Stream0=point, Stream1=point_4, NullGaps=False)
point_5 = Point(dispatch_4.ListA)
point_6 = Point(dispatch_4.ListB)
point_7 = Point(dispatch_5.ListA)
point_8 = Point(dispatch_5.ListB)
polyline = PolyLine(Vertices=weave, Closed=False)  # -> flatten(Polyline)
weave_2 = Weave(Pattern=[0, 1], Stream0=point_5, Stream1=point_8, NullGaps=False)
point_list_4 = PointList(Points=weave_2, Size=Slider(2, range=0..10))
explode = Explode(Curve=polyline, Recursive=True)  # -> Segments, Vertices
polyline_2 = PolyLine(Vertices=weave_2, Closed=False)  # -> flatten(Polyline)
explode_2 = Explode(Curve=polyline_2, Recursive=True)  # -> Segments, Vertices
shift_list = ShiftList(List=explode.Segments, Shift=1, Wrap=True)
partition_list = PartitionList(List=explode.Segments, Size=Slider(2, range=0..10))
partition_list_2 = PartitionList(List=shift_list, Size=Slider(2, range=0..10))
shift_list_2 = ShiftList(List=explode_2.Segments, Shift=1, Wrap=True)
join_curves = JoinCurves(Curves=partition_list_2, Preserve=False)  # -> flatten(Curves)
join_curves_2 = JoinCurves(Curves=partition_list, Preserve=False)  # -> flatten(Curves)
partition_list_3 = PartitionList(List=shift_list_2, Size=Slider(2, range=0..10))
partition_list_4 = PartitionList(List=explode_2.Segments, Size=Slider(2, range=0..10))
explode_3 = Explode(Curve=join_curves_2, Recursive=True)  # -> Segments, Vertices
explode_4 = Explode(Curve=join_curves, Recursive=True)  # -> Segments, Vertices
join_curves_3 = JoinCurves(Curves=partition_list_4, Preserve=False)  # -> flatten(Curves)
join_curves_4 = JoinCurves(Curves=partition_list_3, Preserve=False)  # -> flatten(Curves)
list_item_3 = ListItem(List=explode_3.Vertices, Index=0, Wrap=True)  # -> Item, Item1, Item2
list_item_4 = ListItem(List=explode_4.Vertices, Index=0, Wrap=True)  # -> Item, Item1, Item2
explode_5 = Explode(Curve=join_curves_3, Recursive=True)  # -> Segments, Vertices
explode_6 = Explode(Curve=join_curves_4, Recursive=True)  # -> Segments, Vertices
list_item_5 = ListItem(List=explode_5.Vertices, Index=0, Wrap=True)  # -> Item, Item1, Item2
list_item_6 = ListItem(List=explode_6.Vertices, Index=0, Wrap=True)  # -> Item, Item1, Item2
_4point_surface = _4PointSurface(CornerA=list_item_3.Item, CornerB=list_item_3.Item1, CornerC=list_item_3.Item2)
_4point_surface_2 = _4PointSurface(CornerA=list_item_4.Item, CornerB=list_item_4.Item1, CornerC=list_item_4.Item2)
_4point_surface_3 = _4PointSurface(CornerA=list_item_5.Item, CornerB=list_item_5.Item1, CornerC=list_item_5.Item2)
_4point_surface_4 = _4PointSurface(CornerA=list_item_6.Item, CornerB=list_item_6.Item1, CornerC=list_item_6.Item2)
panels = ExtendedGeometry(flatten([_4point_surface_2, _4point_surface_3, _4point_surface_4, _4point_surface]))

item = ListItem(List=debrep.Edges, Index=0, Wrap=True)  # -> Item, Item1, Item2, Item3
md_slider = MDSlider(SliderMode=0, slider_value=Point(0.5, 0.5, 0.5), x_domain=Domain(0, 1), y_domain=Domain(0, 1), z_domain=Domain(0, 1))
number_slider = Slider(31.5, range=0..1000)
# STEP A: DIAGRID PANELS
v_crv = Curve(item.Item)
debrep_2 = DeconstructBrep(Brep=srf)  # -> Faces, Edges, Vertices
revsrf = ReverseSurfaceDirection(Surface=srf_2, ReverseOption=Slider(3, range=0..3))
u_crvs = Curve([item.Item, item.Item2])
v_crs = Curve([item.Item1, item.Item3])
item_2 = ListItem(List=debrep_2.Edges, Index=0, Wrap=True)  # -> Item, Item1, Item2, Item3
iso = IsoCurve(Surface=reparameterize(srf), UVPoint=md_slider)  # -> UIsocurve, VIsocurve
netsurf = NetworkSurface(CurvesU=u_crvs, CurvesV=v_crs, Continuity=2)
trib = TrianglePanelsB(Surface=revsrf, UDivisions=Slider(23, range=0..100), VDivisions=Slider(2, range=0..100))
V_4 = Number(V_2)
U_4 = Number(U_2)
multiplication = Multiplication(A=U_2, B=V_2)
crv = Curve(item_2.Item)
area = Area(Geometry=trib)  # -> Area, Centroid
V_5 = Number(V)
crv_2 = Curve(item_2.Item3)
crv_3 = Curve(iso.VIsocurve)
dom = ConstructDomain(DomainStart=0, DomainEnd=multiplication)
crv_4 = Curve(item_2.Item1)
top_surface_2 = Surface(netsurf)
debrep_3 = DeconstructBrep(Brep=netsurf)  # -> Faces, Edges, Vertices
divide = DivideCurve(Curve=v_crv, Count=U_2, Kinks=False)  # -> Points, Tangents, Parameters
panel_3 = Panel(area.Area)
div = DivideDomain(Domain=dom, Count=U)
larger = LargerThan(FirstNumber=area.Area, SecondNumber="25")  # -> LargerThan, OrEqualTo
shift = ShiftList(List=divide.Points, Shift=1, Wrap=True)
flip = FlipCurve(Curve=crv_2)  # -> Curve, Flag
item_3 = ListItem(List=div, Index="0", Wrap=True)
addition = Addition(A=V_5, B=Slider(1, range=0..1))
dispatch_6 = Dispatch(List=trib, DispatchPattern=larger.LargerThan)  # -> ListA, ListB
dist = Distance(PointA=shift, PointB=divide.Points)
item_4 = ListItem(List=dist, Index=0, Wrap=True)
divide_2 = DivideCurve(Curve=crv_3, Count=number_slider, Kinks=False)  # -> Points, Tangents, Parameters
brep = Brep(dispatch_6.ListB)
item_5 = ListItem(List=debrep_3.Edges, Index=Slider(3, range=0..10), Wrap=True)
brep_2 = Brep(dispatch_6.ListA)
divide_3 = DivideCurve(Curve=flip.Curve, Count=number_slider, Kinks=False)  # -> Points, Tangents, Parameters
division = Division(A=item_4, B=Slider(2, range=0..10))
divide_4 = DivideCurve(Curve=crv_3, Count=number_slider, Kinks=False)  # -> Points, Tangents, Parameters
divide_5 = DivideCurve(Curve=crv_4, Count=number_slider, Kinks=False)  # -> Points, Tangents, Parameters
panel_4 = Panel(item_4)
range = Range(Domain=item_3, Steps=V)
extendsrf = ExtendSurface(Surface=top_surface_2, WestEdge=division, SouthEdge=0, EastEdge=0, NorthEdge=0, ExtensionType=True)
shift_2 = ShiftList(List=divide_2.Points, Shift=1, Wrap=False)
srf_3 = Surface(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)
shift_3 = ShiftList(List=divide_4.Points, Shift=1, Wrap=False)
ln = Line(StartPoint=shift_2, EndPoint=divide_2.Points)
int = Integer(range)
ln_2 = Line(StartPoint=shift_3, EndPoint=divide_4.Points)

debrep_4 = DeconstructBrep(Brep=brep_2)  # -> Faces, Edges, Vertices
division_2 = Division(A=Slider(4.25, range=0..10), B=Slider(12, range=0..100))
polyoffset = PolylineOffset(
    Polylines=debrep_4.Faces,
    Distance=expr("x/2", division_2),
    Plane=Plane(origin=(0, 0, 0), x=(0, 0, 0), y=(0, 0, 0)),
    Tolerance=0.01,
    ClosedFillet=1,
    OpenFillet=1,
    Miter=2)  # -> Contour, graft(Holes)
crv_5 = Curve(flatten(polyoffset.Holes))
join = JoinCurves(Curves=crv_5, Preserve=False)
explode_7 = Explode(Curve=join, Recursive=True)  # -> Segments, Vertices
disc = Discontinuity(Curve=join, Level=1)  # -> Points, Parameters
midpt = CurveMiddle(Curve=explode_7.Segments)
item_6 = ListItem(List=disc.Points, Index=0, Wrap=True)  # -> Item, Item1, Item2
item_7 = ListItem(List=midpt, Index=0, Wrap=True)  # -> Item, Item1, Item2
_0 = Point(item_7.Item)
_0_2 = Point(item_6.Item)
_1 = Point(item_6.Item1)
_2 = Point(item_6.Item2)
_1_2 = Point(item_7.Item1)
_2_2 = Point(item_7.Item2)
ln_3 = Line(StartPoint=_0, EndPoint=_1_2)
ln_4 = Line(StartPoint=_1_2, EndPoint=_2_2)
ln_5 = Line(StartPoint=_0, EndPoint=_2_2)
ln_6 = Line(StartPoint=_0, EndPoint=_0_2)
ln_7 = Line(StartPoint=_0, EndPoint=_1)
ln_8 = Line(StartPoint=_1_2, EndPoint=_1)
ln_9 = Line(StartPoint=_1_2, EndPoint=_2)
ln_10 = Line(StartPoint=_2_2, EndPoint=_2)
ln_11 = Line(StartPoint=_2_2, EndPoint=_0_2)
merge = Merge(Data1=ln_3, Data2=ln_4, Data3=ln_5)  # -> flatten(Result)
merge_2 = Merge(Data1=ln_5, Data2=ln_6, Data3=ln_11)  # -> flatten(Result)
merge_3 = Merge(Data1=ln_4, Data2=ln_9, Data3=ln_10)  # -> flatten(Result)
merge_4 = Merge(Data1=ln_3, Data2=ln_7, Data3=ln_8)  # -> flatten(Result)
join_2 = JoinCurves(Curves=merge, Preserve=False)  # -> graft(Curves)
join_3 = JoinCurves(Curves=merge_2, Preserve=False)  # -> graft(Curves)
join_4 = JoinCurves(Curves=merge_3, Preserve=False)  # -> graft(Curves)
join_5 = JoinCurves(Curves=merge_4, Preserve=False)  # -> graft(Curves)
mid_triangle = Curve(join_2)
triangle = Curve(join_3)
triangle_2 = Curve(join_4)
triangle_3 = Curve(join_5)
division_3 = Division(A=Slider(0.25, range=0..1), B=Slider(12, range=0..100))
division_4 = Division(A=Slider(0.875, range=0..1), B=Slider(12, range=0..100))
offset = OffsetCurve(Curve=mid_triangle, Distance=expr("-x", division_3), Corners=1)
boundary = BoundarySurfaces(Edges=triangle)
boundary_2 = BoundarySurfaces(Edges=triangle_2)
boundary_3 = BoundarySurfaces(Edges=triangle_3)
crv_6 = Curve(flatten(offset))
offset_2 = OffsetCurve(Curve=ln_3, Distance=expr("-x", division_4), Plane=boundary_3, Corners=1)
offset_3 = OffsetCurve(Curve=ln_4, Distance=expr("-x", division_4), Plane=boundary_2, Corners=1)
offset_4 = OffsetCurve(Curve=ln_5, Distance=division_4, Plane=boundary_3, Corners=1)
join_6 = JoinCurves(Curves=crv_6, Preserve=False)
srfsplit = SurfaceSplit(Surface=boundary, Curves=offset_4)
srfsplit_2 = SurfaceSplit(Surface=boundary_2, Curves=offset_3)
srfsplit_3 = SurfaceSplit(Surface=boundary_3, Curves=offset_2)
dispatch_7 = Dispatch(List=srfsplit_2, DispatchPattern=[True, False])  # -> ListA, ListB
dispatch_8 = Dispatch(List=srfsplit, DispatchPattern=[True, False])  # -> ListA, ListB
dispatch_9 = Dispatch(List=srfsplit_3, DispatchPattern=[True, False])  # -> ListA, ListB
trimmed_surface = Surface(dispatch_8.ListA)
trimmed_surface_2 = Surface(dispatch_9.ListA)
trimmed_surface_3 = Surface(dispatch_7.ListA)
middle_surface = BoundarySurfaces(Edges=join_6)

debrep_5 = DeconstructBrep(Brep=brep)  # -> Faces, Edges, Vertices
polyoffset_2 = PolylineOffset(
    Polylines=debrep_5.Faces,
    Distance=expr("x/2", division_2),
    Plane=Plane(origin=(0, 0, 0), x=(0, 0, 0), y=(0, 0, 0)),
    Tolerance=0.01,
    ClosedFillet=1,
    OpenFillet=1,
    Miter=2)  # -> Contour, graft(Holes)
crv_7 = Curve(flatten(polyoffset_2.Holes))
join_7 = JoinCurves(Curves=crv_7, Preserve=False)
boundary_4 = BoundarySurfaces(Edges=join_7)
debrep_6 = DeconstructBrep(Brep=flatten(boundary_4))  # -> Faces, Edges, Vertices
len = Length(Curve=debrep_6.Edges)
sort = SortList(Keys=len, ValuesA=debrep_6.Edges)  # -> Keys, ValuesA
crv_8 = Curve(sort.ValuesA)
boundary_5 = BoundarySurfaces(Edges=crv_8)
viewer = ParamViewer(debrep_6.Faces)
debrep_7 = DeconstructBrep(Brep=boundary_5)  # -> Faces, Edges, Vertices
midpt_2 = CurveMiddle(Curve=crv_8)
item_8 = ListItem(List=debrep_7.Vertices, Index=0, Wrap=True)  # -> Item, Item1, Item2
item_9 = ListItem(List=midpt_2, Index=0, Wrap=True)  # -> Item, Item1, Item2
_0_3 = Point(item_8.Item)
_1_3 = Point(item_8.Item1)
_2_3 = Point(item_8.Item2)
_0_4 = Point(item_9.Item)
_2_4 = Point(item_9.Item2)
_1_4 = Point(item_9.Item1)
ln_12 = Line(StartPoint=_2_4, EndPoint=_1_4)
ln_13 = Line(StartPoint=_2_4, EndPoint=_2_3)
ln_14 = Line(StartPoint=_2_4, EndPoint=_1_4)
ln_15 = Line(StartPoint=_2_4, EndPoint=_1_3)
ln_16 = Line(StartPoint=_2_4, EndPoint=_1_3)
ln_17 = Line(StartPoint=_2_4, EndPoint=_0_3)
ln_18 = Line(StartPoint=_1_3, EndPoint=_2_3)
ln_19 = Line(StartPoint=_2_3, EndPoint=_1_4)
ln_20 = Line(StartPoint=_1_4, EndPoint=_0_3)
merge_5 = Merge(Data1=ln_12, Data2=ln_13, Data3=ln_14, Data4=ln_15)  # -> flatten(Result)
srfsplit_4 = SurfaceSplit(Surface=debrep_6.Faces, Curves=merge_5)
division_5 = Division(A=Slider(0.875, range=0..1), B=Slider(12, range=0..100))
offset_5 = OffsetCurve(Curve=srfsplit_4, Distance=expr("-x", division_5), Corners=1)
boundary_6 = BoundarySurfaces(Edges=offset_5)

midpt_3 = CurveMiddle(Curve=ln)
trib_2 = TrianglePanelsB(Surface=extendsrf, UDivisions=U_4, VDivisions=V_4)
midpt_4 = CurveMiddle(Curve=ln_2)

debrep_8 = DeconstructBrep(Brep=srf_3)  # -> Faces, Edges, Vertices
item_10 = ListItem(List=debrep_8.Edges, Index=0, Wrap=True)  # -> Item, Item1, Item2, Item3
number_slider_2 = Slider(61, range=0..1000)
crv_9 = Curve(item_10.Item)
crv_10 = Curve(item_10.Item2)
flip_2 = FlipCurve(Curve=crv_10)  # -> Curve, Flag
divide_6 = DivideCurve(Curve=crv_9, Count=number_slider_2, Kinks=False)  # -> Points, Tangents, Parameters
divide_7 = DivideCurve(Curve=flip_2.Curve, Count=number_slider_2, Kinks=False)  # -> Points, Tangents, Parameters
shift_4 = ShiftList(List=divide_6.Points, Shift=1, Wrap=False)
ln_21 = Line(StartPoint=shift_4, EndPoint=divide_6.Points)
item_11 = ListItem(List=flatten(ln_21), Index=0, Wrap=True)
divide_8 = DivideCurve(Curve=item_11, Count=Slider(2, range=0..10), Kinks=False)  # -> Points, Tangents, Parameters
shatter = Shatter(Curve=item_11, Parameters=divide_8.Parameters)
midpt_5 = CurveMiddle(Curve=ln_21)
ln_22 = Line(StartPoint=midpt_5, EndPoint=divide_7.Points)  # -> flatten(Line)
item_12 = ListItem(List=ln_22, Index=0, Wrap=True)
item_13 = ListItem(List=shatter, Index=Slider(1, range=0..1), Wrap=True)
crv_11 = Curve(item_10.Item3)
entwine = Entwine(Branch00=midpt_5, Branch01=divide_7.Points, FlattenInputs=True)
viewer_2 = ParamViewer(entwine)
edgesrf = EdgeSurface(CurveA=item_12, CurveB=item_13, CurveC=crv_11)
relitem = RelativeItem(Tree=entwine, Offset="{0;+1}(0)", WrapPaths=False, WrapItems=False)  # -> ItemA, ItemB
relitem_2 = RelativeItem(Tree=entwine, Offset="{0;-1}(+1)", WrapPaths=False, WrapItems=False)  # -> ItemA, ItemB
relitem_3 = RelativeItem(Tree=entwine, Offset="{0;+1}(+1)", WrapPaths=False, WrapItems=False)  # -> ItemA, ItemB
brep_3 = Brep(edgesrf)
srf4pt = _4PointSurface(CornerA=relitem_3.ItemA, CornerB=relitem_3.ItemB, CornerC=relitem.ItemB)
srf4pt_2 = _4PointSurface(CornerA=relitem_3.ItemA, CornerB=relitem_3.ItemB, CornerC=relitem_2.ItemB)
merge_6 = Merge(Data1=srf4pt, Data2=srf4pt_2)
debrep_9 = DeconstructBrep(Brep=merge_6)  # -> Faces, Edges, Vertices
division_6 = Division(A=Slider(0.875, range=0..1), B=Slider(12, range=0..100))
polyoffset_3 = PolylineOffset(
    Polylines=[debrep_9.Edges, brep_3],
    Distance=division_6,
    Plane=Plane(origin=(0, 0, 0), x=(0, 0, 0), y=(0, 0, 0)),
    Tolerance=0.001,
    ClosedFillet=1,
    OpenFillet=1,
    Miter=2)  # -> Contour, graft(Holes)
crv_12 = Curve(polyoffset_3.Holes)
boundary_7 = BoundarySurfaces(Edges=crv_12)

entwine_2 = Entwine(Branch00=divide_3.Points, Branch01=midpt_3, FlattenInputs=True)
item_14 = ListItem(List=flatten(ln), Index=0, Wrap=True)
entwine_3 = Entwine(Branch00=divide_5.Points, Branch01=midpt_4, FlattenInputs=True)
ln_23 = Line(StartPoint=midpt_3, EndPoint=divide_3.Points)  # -> flatten(Line)
divide_9 = DivideCurve(Curve=item_14, Count=Slider(2, range=0..10), Kinks=False)  # -> Points, Tangents, Parameters
item_15 = ListItem(List=flatten(ln_2), Index=0, Wrap=True)
item_16 = ListItem(List=trib_2, Index=int, Wrap=True)
ln_24 = Line(StartPoint=midpt_4, EndPoint=divide_5.Points)  # -> flatten(Line)
divide_10 = DivideCurve(Curve=item_15, Count=Slider(2, range=0..10), Kinks=False)  # -> Points, Tangents, Parameters
shatter_2 = Shatter(Curve=item_14, Parameters=divide_9.Parameters)
srfsplit_5 = SurfaceSplit(Surface=item_16, Curves=flatten(item_5))
shatter_3 = Shatter(Curve=item_15, Parameters=divide_10.Parameters)
crv_13 = Curve(crv)
item_17 = ListItem(List=ln_23, Index=0, Wrap=True)
item_18 = ListItem(List=shatter_2, Index=Slider(1, range=0..1), Wrap=True)
dispatch_10 = Dispatch(List=srfsplit_5, DispatchPattern=[True, False])  # -> ListA, ListB
crv_14 = Curve(crv)
divide_11 = DivideCurve(Curve=crv_13, Count=Slider(2, range=0..10), Kinks=False)  # -> Points, Tangents, Parameters
item_19 = ListItem(List=ln_24, Index=0, Wrap=True)
item_20 = ListItem(List=shatter_3, Index=Slider(1, range=0..1), Wrap=True)
trim = TrimDataEnds(Data=trib_2, ListStart=addition, ListEnd=Slider(0, range=0..100), PathStart=0, PathEnd=0, RenumberPaths=Toggle(False))
shatter_4 = Shatter(Curve=crv_13, Parameters=divide_11.Parameters)
divide_12 = DivideCurve(Curve=crv_14, Count=Slider(2, range=0..10), Kinks=False)  # -> Points, Tangents, Parameters
srf_4 = Surface(dispatch_10.ListA)
srf_5 = Surface(dispatch_10.ListB)
shatter_5 = Shatter(Curve=crv_14, Parameters=divide_12.Parameters)
item_21 = ListItem(List=shatter_4, Index=Slider(0, range=0..1), Wrap=True)
viewer_3 = ParamViewer(entwine_2)
item_22 = ListItem(List=shatter_5, Index=Slider(1, range=0..1), Wrap=True)
merge_7 = Merge(Data1=srf_4, Data2=trim)
edgesrf_2 = EdgeSurface(CurveA=item_17, CurveB=item_18, CurveC=item_21)
relitem_4 = RelativeItem(Tree=entwine_2, Offset="{0;+1}(0)", WrapPaths=False, WrapItems=False)  # -> ItemA, ItemB
relitem_5 = RelativeItem(Tree=entwine_2, Offset="{0;+1}(+1)", WrapPaths=False, WrapItems=False)  # -> ItemA, ItemB
relitem_6 = RelativeItem(Tree=entwine_2, Offset="{0;-1}(+1)", WrapPaths=False, WrapItems=False)  # -> ItemA, ItemB
edgesrf_3 = EdgeSurface(CurveA=item_19, CurveB=item_20, CurveC=item_22)
relitem_7 = RelativeItem(Tree=entwine_3, Offset="{0;+1}(0)", WrapPaths=False, WrapItems=False)  # -> ItemA, ItemB
relitem_8 = RelativeItem(Tree=entwine_3, Offset="{0;+1}(+1)", WrapPaths=False, WrapItems=False)  # -> ItemA, ItemB
relitem_9 = RelativeItem(Tree=entwine_3, Offset="{0;-1}(+1)", WrapPaths=False, WrapItems=False)  # -> ItemA, ItemB
points = PointList(Points=relitem_6.ItemA, Size=Slider(5, range=0..10))
srf4pt_3 = _4PointSurface(CornerA=relitem_6.ItemA, CornerB=relitem_6.ItemB, CornerC=relitem_5.ItemB)
srf4pt_4 = _4PointSurface(CornerA=relitem_6.ItemA, CornerB=relitem_6.ItemB, CornerC=relitem_4.ItemA)
custom_preview = CustomPreview(Geometry=merge_7, Material=ColourSwatch(SwatchColor=RGB(152, 199, 170)))
points_2 = PointList(Points=relitem_5.ItemA, Size=Slider(5, range=0..10))
brep_4 = Brep(edgesrf_2)
points_3 = PointList(Points=relitem_9.ItemA, Size=Slider(5, range=0..10))
srf4pt_5 = _4PointSurface(CornerA=relitem_9.ItemA, CornerB=relitem_9.ItemB, CornerC=relitem_8.ItemB)
srf4pt_6 = _4PointSurface(CornerA=relitem_9.ItemA, CornerB=relitem_9.ItemB, CornerC=relitem_7.ItemA)
brep_5 = Brep(edgesrf_3)
points_4 = PointList(Points=relitem_8.ItemA, Size=Slider(5, range=0..10))
subdivided_panels = Brep([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])

# ----
# STEP B
debrep_10 = DeconstructBrep(Brep=subdivided_panels)  # -> flatten(Faces), Edges, Vertices
disc_2 = Discontinuity(Curve=debrep_10.Faces, Level=1)  # -> Points, Parameters
lng = ListLength(List=disc_2.Parameters)  # -> flatten(Length)
equals = Equality(FirstNumber=lng, SecondNumber="3")  # -> Equality, Inequality
dispatch_11 = Dispatch(List=debrep_10.Faces, DispatchPattern=equals.Equality)  # -> ListA, ListB
_3_sided_surfaces = Surface(dispatch_11.ListA)
area_2 = Area(Geometry=_3_sided_surfaces)  # -> Area, Centroid
larger_2 = LargerThan(FirstNumber=area_2.Area, SecondNumber="25")  # -> LargerThan, OrEqualTo
dispatch_12 = Dispatch(List=_3_sided_surfaces, DispatchPattern=larger_2.LargerThan)  # -> ListA, ListB
larger_3 = LargerThan(FirstNumber=dispatch_12.ListB, SecondNumber="15")  # -> LargerThan, OrEqualTo
dispatch_13 = Dispatch(List=dispatch_12.ListB, DispatchPattern=larger_3.LargerThan)  # -> ListA, ListB

equals_2 = Equality(FirstNumber=lng, SecondNumber="4")  # -> Equality, Inequality
dispatch_14 = Dispatch(List=debrep_10.Faces, DispatchPattern=equals_2.Equality)  # -> ListA, ListB
_4_sided_surfaces = Surface(dispatch_14.ListA)
debrep_11 = DeconstructBrep(Brep=_4_sided_surfaces)  # -> flatten(Faces), Edges, Vertices

merge_8 = Merge(Data1=srf4pt_3, Data2=srf4pt_4, Data3=srf4pt_5, Data4=srf4pt_6)
area_3 = Area(Geometry=merge_8)  # -> Area, Centroid
larger_4 = LargerThan(FirstNumber=area_3.Area, SecondNumber="21")  # -> LargerThan, OrEqualTo
dispatch_15 = Dispatch(List=merge_8, DispatchPattern=larger_4.LargerThan)  # -> ListA, ListB
debrep_12 = DeconstructBrep(Brep=_3_sided_surfaces)  # -> Faces, Edges, Vertices
brep_6 = Brep(dispatch_15.ListA)
brep_7 = Brep(dispatch_15.ListB)
item_23 = ListItem(List=debrep_12.Vertices, Index=0, Wrap=True)  # -> Item, Item1, Item2
area_4 = Area(Geometry=boundary_6)  # -> Area, flatten(Centroid)
srf4pt_7 = _4PointSurface(CornerA=item_23.Item, CornerB=item_23.Item1, CornerC=item_23.Item2)
custom_preview_2 = CustomPreview(Geometry=panels, Material=ColourSwatch(SwatchColor=RGB(238, 171, 255)))
panel_5 = Panel("""0
1
2
180
181
182
96
97
98
222
223
224""")
item_24 = ListItem(List=srf4pt_7, Index=0, Wrap=True)  # -> Item, Item1, Item2
points_5 = PointList(Points=area_4.Centroid, Size=Slider(1, range=0..100))
cull_i = CullIndex(List=flatten(boundary_6), Indices=panel_5, Wrap=True)
merge_9 = Merge(Data1=brep_4, Data2=brep_5, Data3=brep_7)

debrep_13 = DeconstructBrep(Brep=merge_9)  # -> Faces, Edges, Vertices
division_7 = Division(A=Slider(4.25, range=0..10), B=Slider(12, range=0..100))
polyoffset_4 = PolylineOffset(
    Polylines=debrep_13.Faces,
    Distance=expr("x/2", division_7),
    Plane=Plane(origin=(0, 0, 0), x=(0, 0, 0), y=(0, 0, 0)),
    Tolerance=0.01,
    ClosedFillet=1,
    OpenFillet=1,
    Miter=2)  # -> Contour, graft(Holes)
crv_15 = Curve(flatten(polyoffset_4.Holes))
join_8 = JoinCurves(Curves=crv_15, Preserve=False)
boundary_8 = BoundarySurfaces(Edges=join_8)
debrep_14 = DeconstructBrep(Brep=flatten(boundary_8))  # -> Faces, Edges, Vertices
len_2 = Length(Curve=debrep_14.Edges)
sort_2 = SortList(Keys=len_2, ValuesA=debrep_14.Edges)  # -> Keys, ValuesA
crv_16 = Curve(sort_2.ValuesA)
boundary_9 = BoundarySurfaces(Edges=crv_16)
viewer_4 = ParamViewer(debrep_14.Faces)
debrep_15 = DeconstructBrep(Brep=boundary_9)  # -> Faces, Edges, Vertices
midpt_6 = CurveMiddle(Curve=crv_16)
item_25 = ListItem(List=debrep_15.Vertices, Index=0, Wrap=True)  # -> Item, Item1, Item2
item_26 = ListItem(List=midpt_6, Index=0, Wrap=True)  # -> Item, Item1, Item2
_0_5 = Point(item_25.Item)
_1_5 = Point(item_25.Item1)
_2_5 = Point(item_25.Item2)
_0_6 = Point(item_26.Item)
_2_6 = Point(item_26.Item2)
_1_6 = Point(item_26.Item1)
ln_25 = Line(StartPoint=_2_6, EndPoint=_1_6)
ln_26 = Line(StartPoint=_2_6, EndPoint=_2_5)
ln_27 = Line(StartPoint=_2_6, EndPoint=_1_6)
ln_28 = Line(StartPoint=_2_6, EndPoint=_1_5)
ln_29 = Line(StartPoint=_2_6, EndPoint=_1_5)
ln_30 = Line(StartPoint=_2_6, EndPoint=_0_5)
ln_31 = Line(StartPoint=_1_5, EndPoint=_2_5)
ln_32 = Line(StartPoint=_2_5, EndPoint=_1_6)
ln_33 = Line(StartPoint=_1_6, EndPoint=_0_5)
merge_10 = Merge(Data1=ln_25, Data2=ln_26, Data3=ln_27, Data4=ln_28)  # -> flatten(Result)
srfsplit_6 = SurfaceSplit(Surface=debrep_14.Faces, Curves=merge_10)
division_8 = Division(A=Slider(0.875, range=0..1), B=Slider(12, range=0..100))
offset_6 = OffsetCurve(Curve=srfsplit_6, Distance=expr("-x", division_8), Corners=1)
boundary_10 = BoundarySurfaces(Edges=offset_6)  # -> flatten(Surfaces)

debrep_16 = DeconstructBrep(Brep=brep_6)  # -> Faces, Edges, Vertices
division_9 = Division(A=Slider(4.25, range=0..10), B=Slider(12, range=0..100))
polyoffset_5 = PolylineOffset(
    Polylines=debrep_16.Faces,
    Distance=expr("x/2", division_9),
    Plane=Plane(origin=(0, 0, 0), x=(0, 0, 0), y=(0, 0, 0)),
    Tolerance=0.01,
    ClosedFillet=1,
    OpenFillet=1,
    Miter=2)  # -> Contour, graft(Holes)
crv_17 = Curve(flatten(polyoffset_5.Holes))
join_9 = JoinCurves(Curves=crv_17, Preserve=False)
explode_8 = Explode(Curve=join_9, Recursive=True)  # -> Segments, Vertices
disc_3 = Discontinuity(Curve=join_9, Level=1)  # -> Points, Parameters
midpt_7 = CurveMiddle(Curve=explode_8.Segments)
item_27 = ListItem(List=disc_3.Points, Index=0, Wrap=True)  # -> Item, Item1, Item2
item_28 = ListItem(List=midpt_7, Index=0, Wrap=True)  # -> Item, Item1, Item2
_0_7 = Point(item_28.Item)
_0_8 = Point(item_27.Item)
_1_7 = Point(item_27.Item1)
_2_7 = Point(item_27.Item2)
_1_8 = Point(item_28.Item1)
_2_8 = Point(item_28.Item2)
ln_34 = Line(StartPoint=_0_7, EndPoint=_1_8)
ln_35 = Line(StartPoint=_1_8, EndPoint=_2_8)
ln_36 = Line(StartPoint=_0_7, EndPoint=_2_8)
ln_37 = Line(StartPoint=_0_7, EndPoint=_0_8)
ln_38 = Line(StartPoint=_0_7, EndPoint=_1_7)
ln_39 = Line(StartPoint=_1_8, EndPoint=_1_7)
ln_40 = Line(StartPoint=_1_8, EndPoint=_2_7)
ln_41 = Line(StartPoint=_2_8, EndPoint=_2_7)
ln_42 = Line(StartPoint=_2_8, EndPoint=_0_8)
merge_11 = Merge(Data1=ln_34, Data2=ln_35, Data3=ln_36)  # -> flatten(Result)
merge_12 = Merge(Data1=ln_36, Data2=ln_37, Data3=ln_42)  # -> flatten(Result)
merge_13 = Merge(Data1=ln_35, Data2=ln_40, Data3=ln_41)  # -> flatten(Result)
merge_14 = Merge(Data1=ln_34, Data2=ln_38, Data3=ln_39)  # -> flatten(Result)
join_10 = JoinCurves(Curves=merge_11, Preserve=False)  # -> graft(Curves)
join_11 = JoinCurves(Curves=merge_12, Preserve=False)  # -> graft(Curves)
join_12 = JoinCurves(Curves=merge_13, Preserve=False)  # -> graft(Curves)
join_13 = JoinCurves(Curves=merge_14, Preserve=False)  # -> graft(Curves)
triangle_4 = Curve(join_13)
triangle_5 = Curve(join_11)
mid_triangle_2 = Curve(join_10)
triangle_6 = Curve(join_12)
division_10 = Division(A=Slider(0.25, range=0..1), B=Slider(12, range=0..100))
division_11 = Division(A=Slider(0.875, range=0..1), B=Slider(12, range=0..100))
offset_7 = OffsetCurve(Curve=mid_triangle_2, Distance=expr("-x", division_10), Corners=1)
boundary_11 = BoundarySurfaces(Edges=triangle_5)
boundary_12 = BoundarySurfaces(Edges=triangle_6)
boundary_13 = BoundarySurfaces(Edges=triangle_4)
crv_18 = Curve(flatten(offset_7))
offset_8 = OffsetCurve(Curve=ln_34, Distance=expr("-x", division_11), Plane=boundary_13, Corners=1)
offset_9 = OffsetCurve(Curve=ln_35, Distance=expr("-x", division_11), Plane=boundary_12, Corners=1)
offset_10 = OffsetCurve(Curve=ln_36, Distance=division_11, Plane=boundary_13, Corners=1)
join_14 = JoinCurves(Curves=crv_18, Preserve=False)
srfsplit_7 = SurfaceSplit(Surface=boundary_11, Curves=offset_10)
srfsplit_8 = SurfaceSplit(Surface=boundary_12, Curves=offset_9)
srfsplit_9 = SurfaceSplit(Surface=boundary_13, Curves=offset_8)
dispatch_16 = Dispatch(List=srfsplit_8, DispatchPattern=[True, False])  # -> ListA, ListB
dispatch_17 = Dispatch(List=srfsplit_7, DispatchPattern=[True, False])  # -> ListA, ListB
dispatch_18 = Dispatch(List=srfsplit_9, DispatchPattern=[True, False])  # -> ListA, ListB
trimmed_surface_4 = Surface(dispatch_17.ListA)
trimmed_surface_5 = Surface(dispatch_18.ListA)
trimmed_surface_6 = Surface(dispatch_16.ListA)
middle_surface_2 = BoundarySurfaces(Edges=join_14)

debrep_17 = DeconstructBrep(Brep=dispatch_13.ListA)  # -> flatten(Faces), Edges, Vertices
debrep_18 = DeconstructBrep(Brep=dispatch_13.ListB)  # -> flatten(Faces), Edges, Vertices
debrep_19 = DeconstructBrep(Brep=dispatch_12.ListA)  # -> flatten(Faces), Edges, Vertices

srfcenter = SurfaceCenter(Surface=debrep_18.Faces)  # -> Center, Normal, Frame
item_29 = ListItem(List=debrep_18.Faces, Index="26", Wrap=True)
cull_i_2 = CullIndex(List=debrep_18.Faces, Indices="26", Wrap=True)
points_6 = PointList(Points=srfcenter.Center)
merge_15 = Merge(Data1=debrep_19.Faces, Data2=item_29)

_3_point_panel_a = Brep(merge_15)
_3_point_panel_b = Brep(debrep_17.Faces)
_3_point_panel_c = Brep(cull_i_2)
_4_point_panel_a = Brep(debrep_11.Faces)

merge_16 = Merge(Data1=middle_surface, Data2=trimmed_surface, Data3=trimmed_surface_3, Data4=trimmed_surface_2)
area_5 = Area(Geometry=merge_16)  # -> Area, flatten(Centroid)
panel_6 = Panel("""0
46
47
48
22
115
116
117""")
points_7 = PointList(Points=area_5.Centroid, Size=Slider(1, range=0..100))
cull_i_3 = CullIndex(List=flatten(merge_16), Indices=panel_6, Wrap=True)
_3_point_panel_b_2 = Brep(_3_point_panel_b)
_3_point_panel_c_2 = Brep(_3_point_panel_c)
_3_point_panel_c_3 = Brep(_4_point_panel_a)
brep_8 = Brep(_3_point_panel_a)

debrep_20 = DeconstructBrep(Brep=brep_8)  # -> Faces, Edges, Vertices
# STEP C: SUB-DIVISIONS
number_slider_3 = Slider(4.25, range=0..10)
division_12 = Division(A=number_slider_3, B=Slider(12, range=0..100))
polyoffset_6 = PolylineOffset(
    Polylines=debrep_20.Faces,
    Distance=expr("x/2", division_12),
    Plane=Plane(origin=(0, 0, 0), x=(0, 0, 0), y=(0, 0, 0)),
    Tolerance=0.01,
    ClosedFillet=1,
    OpenFillet=1,
    Miter=2)  # -> Contour, graft(Holes)
crv_19 = Curve(flatten(polyoffset_6.Holes))
join_15 = JoinCurves(Curves=crv_19, Preserve=False)
explode_9 = Explode(Curve=join_15, Recursive=True)  # -> Segments, Vertices
disc_4 = Discontinuity(Curve=join_15, Level=1)  # -> Points, Parameters
midpt_8 = CurveMiddle(Curve=explode_9.Segments)
item_30 = ListItem(List=disc_4.Points, Index=0, Wrap=True)  # -> Item, Item1, Item2
item_31 = ListItem(List=midpt_8, Index=0, Wrap=True)  # -> Item, Item1, Item2
_0_9 = Point(item_31.Item)
_0_10 = Point(item_30.Item)
_1_9 = Point(item_30.Item1)
_2_9 = Point(item_30.Item2)
_1_10 = Point(item_31.Item1)
_2_10 = Point(item_31.Item2)
ln_43 = Line(StartPoint=_0_9, EndPoint=_1_10)
ln_44 = Line(StartPoint=_1_10, EndPoint=_2_10)
ln_45 = Line(StartPoint=_0_9, EndPoint=_2_10)
ln_46 = Line(StartPoint=_0_9, EndPoint=_0_10)
ln_47 = Line(StartPoint=_0_9, EndPoint=_1_9)
ln_48 = Line(StartPoint=_1_10, EndPoint=_1_9)
ln_49 = Line(StartPoint=_1_10, EndPoint=_2_9)
ln_50 = Line(StartPoint=_2_10, EndPoint=_2_9)
ln_51 = Line(StartPoint=_2_10, EndPoint=_0_10)
merge_17 = Merge(Data1=ln_43, Data2=ln_44, Data3=ln_45)  # -> flatten(Result)
merge_18 = Merge(Data1=ln_45, Data2=ln_46, Data3=ln_51)  # -> flatten(Result)
merge_19 = Merge(Data1=ln_44, Data2=ln_49, Data3=ln_50)  # -> flatten(Result)
merge_20 = Merge(Data1=ln_43, Data2=ln_47, Data3=ln_48)  # -> flatten(Result)
join_16 = JoinCurves(Curves=merge_17, Preserve=False)  # -> graft(Curves)
join_17 = JoinCurves(Curves=merge_18, Preserve=False)  # -> graft(Curves)
join_18 = JoinCurves(Curves=merge_19, Preserve=False)  # -> graft(Curves)
join_19 = JoinCurves(Curves=merge_20, Preserve=False)  # -> graft(Curves)
triangle_7 = Curve(join_19)
mid_triangle_3 = Curve(join_16)
triangle_8 = Curve(join_17)
triangle_9 = Curve(join_18)
division_13 = Division(A=Slider(0.25, range=0..1), B=Slider(12, range=0..100))
division_14 = Division(A=Slider(0.875, range=0..1), B=Slider(12, range=0..100))
offset_11 = OffsetCurve(Curve=mid_triangle_3, Distance=expr("-x", division_13), Corners=1)
boundary_14 = BoundarySurfaces(Edges=triangle_8)
boundary_15 = BoundarySurfaces(Edges=triangle_9)
boundary_16 = BoundarySurfaces(Edges=triangle_7)
crv_20 = Curve(flatten(offset_11))
offset_12 = OffsetCurve(Curve=ln_43, Distance=expr("-x", division_14), Plane=boundary_16, Corners=1)
offset_13 = OffsetCurve(Curve=ln_44, Distance=expr("-x", division_14), Plane=boundary_15, Corners=1)
offset_14 = OffsetCurve(Curve=ln_45, Distance=division_14, Plane=boundary_16, Corners=1)
join_20 = JoinCurves(Curves=crv_20, Preserve=False)
srfsplit_10 = SurfaceSplit(Surface=boundary_14, Curves=offset_14)
srfsplit_11 = SurfaceSplit(Surface=boundary_15, Curves=offset_13)
srfsplit_12 = SurfaceSplit(Surface=boundary_16, Curves=offset_12)
dispatch_19 = Dispatch(List=srfsplit_11, DispatchPattern=[True, False])  # -> ListA, ListB
dispatch_20 = Dispatch(List=srfsplit_10, DispatchPattern=[True, False])  # -> ListA, ListB
dispatch_21 = Dispatch(List=srfsplit_12, DispatchPattern=[True, False])  # -> ListA, ListB
trimmed_surface_7 = Surface(dispatch_20.ListA)
trimmed_surface_8 = Surface(dispatch_19.ListA)
trimmed_surface_9 = Surface(dispatch_21.ListA)
middle_surface_3 = BoundarySurfaces(Edges=join_20)

debrep_21 = DeconstructBrep(Brep=_3_point_panel_b_2)  # -> Faces, Edges, Vertices
polyoffset_7 = PolylineOffset(
    Polylines=debrep_21.Faces,
    Distance=expr("x/2", division_12),
    Plane=Plane(origin=(0, 0, 0), x=(0, 0, 0), y=(0, 0, 0)),
    Tolerance=0.01,
    ClosedFillet=1,
    OpenFillet=1,
    Miter=2)  # -> Contour, graft(Holes)
crv_21 = Curve(flatten(polyoffset_7.Holes))
join_21 = JoinCurves(Curves=crv_21, Preserve=False)
boundary_17 = BoundarySurfaces(Edges=join_21)
debrep_22 = DeconstructBrep(Brep=flatten(boundary_17))  # -> Faces, Edges, Vertices
len_3 = Length(Curve=debrep_22.Edges)
sort_3 = SortList(Keys=len_3, ValuesA=debrep_22.Edges)  # -> Keys, ValuesA
viewer_5 = ParamViewer(debrep_22.Faces)
crv_22 = Curve(sort_3.ValuesA)
boundary_18 = BoundarySurfaces(Edges=crv_22)
debrep_23 = DeconstructBrep(Brep=boundary_18)  # -> Faces, Edges, Vertices
midpt_9 = CurveMiddle(Curve=crv_22)
item_32 = ListItem(List=debrep_23.Vertices, Index=0, Wrap=True)  # -> Item, Item1, Item2
item_33 = ListItem(List=midpt_9, Index=0, Wrap=True)  # -> Item, Item1, Item2
_0_11 = Point(item_32.Item)
_1_11 = Point(item_32.Item1)
_2_11 = Point(item_32.Item2)
_0_12 = Point(item_33.Item)
_2_12 = Point(item_33.Item2)
_1_12 = Point(item_33.Item1)
ln_52 = Line(StartPoint=_2_12, EndPoint=_1_12)
ln_53 = Line(StartPoint=_2_12, EndPoint=_2_11)
ln_54 = Line(StartPoint=_2_12, EndPoint=_1_12)
ln_55 = Line(StartPoint=_2_12, EndPoint=_1_11)
ln_56 = Line(StartPoint=_2_12, EndPoint=_1_11)
ln_57 = Line(StartPoint=_2_12, EndPoint=_0_11)
ln_58 = Line(StartPoint=_1_11, EndPoint=_2_11)
ln_59 = Line(StartPoint=_2_11, EndPoint=_1_12)
ln_60 = Line(StartPoint=_1_12, EndPoint=_0_11)
merge_21 = Merge(Data1=ln_52, Data2=ln_53, Data3=ln_54, Data4=ln_55)  # -> flatten(Result)
srfsplit_13 = SurfaceSplit(Surface=debrep_22.Faces, Curves=merge_21)
division_15 = Division(A=Slider(0.875, range=0..1), B=Slider(12, range=0..100))
offset_15 = OffsetCurve(Curve=srfsplit_13, Distance=expr("-x", division_15), Corners=1)
boundary_19 = BoundarySurfaces(Edges=offset_15)

debrep_24 = DeconstructBrep(Brep=flatten(_3_point_panel_c_2))  # -> Faces, Edges, Vertices
item_34 = ListItem(List=debrep_24.Edges, Index=0, Wrap=True)  # -> Item, Item1, Item2
edgesrf_4 = EdgeSurface(CurveA=item_34.Item, CurveB=item_34.Item1, CurveC=item_34.Item2)
polyoffset_8 = PolylineOffset(
    Polylines=edgesrf_4,
    Distance=expr("x/2", division_12),
    Plane=Plane(origin=(0, 0, 0), x=(0, 0, 0), y=(0, 0, 0)),
    Tolerance=0.01,
    ClosedFillet=1,
    OpenFillet=1,
    Miter=2)  # -> Contour, graft(Holes)
crv_23 = Curve(flatten(polyoffset_8.Holes))
join_22 = JoinCurves(Curves=crv_23, Preserve=False)
boundary_20 = BoundarySurfaces(Edges=join_22)

debrep_25 = DeconstructBrep(Brep=flatten(_3_point_panel_c_3))  # -> Faces, Edges, Vertices
item_35 = ListItem(List=debrep_25.Edges, Index=0, Wrap=True)  # -> Item, Item1, Item2, Item3
edgesrf_5 = EdgeSurface(CurveA=item_35.Item, CurveB=item_35.Item1, CurveC=item_35.Item2, CurveD=item_35.Item3)
polyoffset_9 = PolylineOffset(
    Polylines=edgesrf_5,
    Distance=expr("x/2", division_12),
    Plane=Plane(origin=(0, 0, 0), x=(0, 0, 0), y=(0, 0, 0)),
    Tolerance=0.01,
    ClosedFillet=1,
    OpenFillet=1,
    Miter=2)  # -> Contour, graft(Holes)
crv_24 = Curve(flatten(polyoffset_9.Holes))
join_23 = JoinCurves(Curves=crv_24, Preserve=False)
boundary_21 = BoundarySurfaces(Edges=join_23)
debrep_26 = DeconstructBrep(Brep=boundary_21)  # -> Faces, Edges, Vertices
len_4 = Length(Curve=debrep_26.Edges)
sort_4 = SortList(Keys=len_4, ValuesA=debrep_26.Edges)  # -> Keys, ValuesA
panel_7 = Panel("""23
17
1
9
12
8""")
panel_8 = Panel("""17
1
9
12""")
panel_9 = Panel("""23
8""")
brep_9 = Brep(debrep_26.Faces)
crv_25 = Curve(sort_4.ValuesA)
boundary_22 = BoundarySurfaces(Edges=crv_25)  # -> flatten(Surfaces)
cull_i_4 = CullIndex(List=flatten(boundary_22), Indices=panel_7, Wrap=True)
item_36 = ListItem(List=boundary_22, Index=panel_9, Wrap=True)
item_37 = ListItem(List=boundary_22, Index=panel_8, Wrap=True)
debrep_27 = DeconstructBrep(Brep=cull_i_4)  # -> flatten(Faces), Edges, Vertices
debrep_28 = DeconstructBrep(Brep=item_36)  # -> flatten(Faces), Edges, Vertices
debrep_29 = DeconstructBrep(Brep=item_37)  # -> flatten(Faces), Edges, Vertices
midpt_10 = CurveMiddle(Curve=debrep_27.Edges)
midpt_11 = CurveMiddle(Curve=debrep_29.Edges)
item_38 = ListItem(List=midpt_10, Index=0, Wrap=True)  # -> Item, Item1, Item2, Item3
item_39 = ListItem(List=debrep_27.Vertices, Index=0, Wrap=True)  # -> Item, Item1, Item2, Item3
item_40 = ListItem(List=debrep_28.Vertices, Index=0, Wrap=True)  # -> Item, Item1, Item2, Item3
item_41 = ListItem(List=midpt_11, Index=0, Wrap=True)  # -> Item, Item1, Item2, Item3
item_42 = ListItem(List=debrep_29.Vertices, Index=0, Wrap=True)  # -> Item, Item1, Item2, Item3
_1_13 = Point(item_38.Item1)
_2_13 = Point(item_38.Item2)
_0_13 = Point(item_39.Item)
_1_14 = Point(item_39.Item1)
_2_14 = Point(item_39.Item2)
_1_15 = Point(item_40.Item1)
_2_15 = Point(item_40.Item2)
_3 = Point(item_40.Item3)
_0_14 = Point(item_41.Item)
_3_2 = Point(item_41.Item3)
_0_15 = Point(item_42.Item)
_0_16 = Point(item_38.Item)
_3_3 = Point(item_38.Item3)
_3_4 = Point(item_39.Item3)
_0_17 = Point(item_40.Item)
_1_16 = Point(item_41.Item1)
_2_16 = Point(item_41.Item2)
_1_17 = Point(item_42.Item1)
_2_17 = Point(item_42.Item2)
_3_5 = Point(item_42.Item3)
ln_61 = Line(StartPoint=_3_4, EndPoint=_0_16)
ln_62 = Line(StartPoint=_2_14, EndPoint=_0_16)
ln_63 = Line(StartPoint=_3, EndPoint=_1_15)
ln_64 = Line(StartPoint=_1_17, EndPoint=_3_2)
ln_65 = Line(StartPoint=_2_17, EndPoint=_3_2)
merge_22 = Merge(Data1=ln_61, Data2=ln_62, Data3=ln_63, Data4=ln_64, Data5=ln_65)  # -> flatten(Result)
srfsplit_14 = SurfaceSplit(Surface=brep_9, Curves=merge_22)
division_16 = Division(A=Slider(0.875, range=0..1), B=Slider(12, range=0..100))
offset_16 = OffsetCurve(Curve=srfsplit_14, Distance=expr("-x", division_16), Corners=1)
boundary_23 = BoundarySurfaces(Edges=offset_16)

merge_23 = Merge(Data1=middle_surface_2, Data2=trimmed_surface_4, Data3=trimmed_surface_6, Data4=trimmed_surface_5)
area_6 = Area(Geometry=merge_23)  # -> Area, flatten(Centroid)
panel_10 = Panel("""96
416
417
418
31
221
222
223
127
509
510
511
95
413
414
415""")
points_8 = PointList(Points=area_6.Centroid, Size=Slider(1, range=0..100))
cull_i_5 = CullIndex(List=flatten(merge_23), Indices=panel_10, Wrap=True)

# ----
# ALTERNATIVE OPTION TO SUBDIVIDE THE BIG TRIANGLE USING THE PLUGIN.
number_slider_4 = Slider(1, range=0..1)
trisub = SubdivideTriangle(
    TriangularCurve=join_15,
    Subdivide=number_slider_4,
    Boolean1=True,
    Boolean2=True,
    Boolean3=True,
    Boolean4=True,
    Wires=True)  # -> TriangleCellsA, TriangleCellsB
division_17 = Division(A=Slider(0.875, range=0..1), B=Slider(12, range=0..100))
offset_17 = OffsetCurve(Curve=trisub.TriangleCellsA, Distance=expr("-x", division_17), Corners=1)
