# Grasshopper definition roof-type-1.gh (Grasshopper 1.0.7)
# Copyright: Safdie Architects, LLC
# plug-ins: LunchBox

pick_your_surface = Surface(graft(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))
pick_your_curve = Curve(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)

# ----
# Note the unit conversion factor. The current set-up is intended for a file in meters.
number_slider = Slider(1.5, range=0..10)

# ----
# BAKE
button = Button()

pick_your_surface_2 = Surface(graft(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))
pick_your_curve_2 = Curve(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)
flip = FlipCurve(Curve=pick_your_curve)  # -> Curve, Flag
flip_2 = FlipCurve(Curve=pick_your_curve_2)  # -> Curve, Flag
# NOTES: Author: Mesut Sala / Seung Kim
# Version: v0.0, June, 2021
# Use: Tokyo Roof
# 
# Rhino file: Specify a Curve and a Surface
panel = Panel("Input")
len = Length(Curve=pick_your_curve)
srf = Surface(pick_your_surface)
filter = StreamFilter(Gate=Slider(0, range=0..1), Stream0=pick_your_curve, Stream1=flip.Curve)
division = Division(A=len, B=number_slider)
panel_2 = Panel("Geometry Creation")
panel_3 = Panel(len)
divide = DivideCurve(Curve=filter, Count=division, Kinks=False)  # -> Points, Tangents, Parameters
panel_4 = Panel(division)
xy = XYPlane(Origin=divide.Points)
align = AlignPlane(Plane=xy, Direction=divide.Tangents)  # -> Plane, Angle
deplane = DeconstructPlane(Plane=align.Plane)  # -> Origin, XAxis, YAxis, ZAxis
srf_2 = Surface(srf)
line = LineSDL(Start=align.Plane, Direction=deplane.YAxis, Length=Slider(100, range=0..100))
project = Project(Curve=line, Brep=pick_your_surface, Direction=Vector(0, 0, 1))
srf_3 = Surface(srf_2)

# ---- group: Rectangle Wood Frames
projected_crvs_to_design_srf = Curve(graft(project))
surface_for_normals = Surface(srf_3)

# WOOD DEPTH AND LENGTH
depth = Slider(0.6, range=0..10)
width_top = Slider(0.25, range=0..10)
prismatic_profile = PrismaticProfile(depth=depth, width_top=width_top, width_bot=width_top)

# ----
profile_curve = Curve(prismatic_profile)

X = UnitX(Factor=depth)
move = Move(Geometry=profile_curve, Motion=X)  # -> Geometry, Transform

# ---- group: Rectangle Wood Frames
crv = Curve(reparameterize(projected_crvs_to_design_srf))
midpt = CurveMiddle(Curve=crv)
number = Number(0)
srf_cp = SurfaceClosestPoint(Point=midpt, Surface=surface_for_normals)  # -> Point, UVPoint, Distance
pframe = PerpFrame(Curve=crv, Parameter=number)
xy_2 = XYPlane(Origin=Point(0, 0, 0))
evalsrf = EvaluateSurface(Surface=surface_for_normals, Point=srf_cp.UVPoint)  # -> Point, Normal, UDirection, VDirection, Frame
orient = Orient(Geometry=move.Geometry, Source=xy_2, Target=pframe)  # -> Geometry, Transform
align_2 = AlignPlane(Plane=pframe, Direction=evalsrf.Normal)  # -> Plane, Angle
list = ValueList({"None": 0, "Trim": 1, "Rotate": 2}, selected="None")
swp1 = Sweep1(Rail=projected_crvs_to_design_srf, Sections=orient.Geometry, Miter=list)

# ----
cap = CapHoles(Brep=swp1)
debrep = DeconstructBrep(Brep=cap)  # -> Faces, Edges, Vertices
debrep_2 = DeconstructBrep(Brep=cap)  # -> Faces, Edges, Vertices

wood = Brep(cap)
swatch = ColourSwatch(SwatchColor=RGB(252, 189, 105))
preview = CustomPreview(Geometry=wood, Material=swatch)
bake = ObjectBake(BakeToggle=button, GeometryObjects=wood, Layer="WOOD", ObjectName="GH_Obj", ObjectColor=swatch, LayerColor=swatch)

number_slider_2 = Slider(10, range=0..10)
md_slider = MDSlider(SliderMode=0, slider_value=Point(0.5, 0.5, 0.5), x_domain=Domain(0, 1), y_domain=Domain(0, 1), z_domain=Domain(0, 1))
item = ListItem(List=debrep_2.Faces, Index=Slider(5, range=0..10), Wrap=True)
item_2 = ListItem(List=debrep.Edges, Index=Slider(9, range=0..10), Wrap=True)
item_3 = ListItem(List=debrep.Edges, Index=Slider(10, range=0..10), Wrap=True)
evalsrf_2 = EvaluateSurface(Surface=reparameterize(item), Point=md_slider)  # -> Point, Normal, UDirection, VDirection, Frame
merge = Merge(Data1=item_2, Data2=item_3)
panel_5 = Panel(merge)
amp = Amplitude(Vector=evalsrf_2.Normal, Amplitude=Slider(0.05, range=0..0.1))
crv_2 = Curve(merge)
extr = Extrude(Base=item, Direction=amp)
crv_3 = Curve(merge)
clean = CleanTree(RemoveNulls=True, RemoveInvalid=True, RemoveEmpty=True, Tree=crv_2)  # -> flatten(Tree)
viewer = ParamViewer(clean)

metal = Brep(extr)
swatch_2 = ColourSwatch(SwatchColor=RGB(107, 107, 107))
preview_2 = CustomPreview(Geometry=metal, Material=swatch_2)
bake_2 = ObjectBake(BakeToggle=button, GeometryObjects=metal, Layer="METAL", ObjectName="GH_Obj", ObjectColor=swatch_2, LayerColor=swatch_2)

shift = ShiftList(List=clean, Shift=1, Wrap=False)
dispatch = Dispatch(List=clean, DispatchPattern=[True, False])  # -> ListA, ListB
dispatch_2 = Dispatch(List=shift, DispatchPattern=[True, False])  # -> ListA, ListB
crv_4 = Curve(graft(dispatch.ListA))
crv_5 = Curve(graft(dispatch.ListB))
crv_6 = Curve(graft(dispatch_2.ListB))
crv_7 = Curve(graft(dispatch_2.ListA))
loft = Loft(Curves=[crv_4, crv_5], Options={Adjust=False, Closed=False, LoftEnds=0, LoftSimp=0, LoftType=0, Rebuild=10, Refit=0.01})
crv_8 = Curve(crv_3)
loft_2 = Loft(Curves=[crv_7, crv_6], Options={Adjust=False, Closed=False, LoftEnds=0, LoftSimp=0, LoftType=0, Rebuild=10, Refit=0.01})
md_slider_2 = MDSlider(SliderMode=0, slider_value=Point(0.5, 0.5, 0.5), x_domain=Domain(0, 1), y_domain=Domain(0, 1), z_domain=Domain(0, 1))
dispatch_3 = Dispatch(List=crv_8, DispatchPattern=[True, False])  # -> ListA, ListB
crv_9 = Curve(flatten(dispatch_3.ListA))
crv_10 = Curve(flatten(dispatch_3.ListB))
iso = IsoCurve(Surface=reparameterize(loft_2), UVPoint=md_slider_2)  # -> UIsocurve, flatten(VIsocurve)

cull_i = CullIndex(List=crv_10, Indices="-1", Wrap=True)
cull_i_2 = CullIndex(List=crv_9, Indices="1", Wrap=True)

viewer_2 = ParamViewer(iso.VIsocurve)
Z = UnitZ(Factor=Slider(0.5, range=0..1))
clean_2 = CleanTree(RemoveNulls=True, RemoveInvalid=True, RemoveEmpty=False, Tree=cull_i_2)  # -> simplify(graft(Tree))
clean_3 = CleanTree(RemoveNulls=True, RemoveInvalid=True, RemoveEmpty=False, Tree=cull_i)  # -> simplify(graft(Tree))
move_2 = Move(Geometry=iso.VIsocurve, Motion=Z)  # -> Geometry, Transform
viewer_3 = ParamViewer(clean_3)
viewer_4 = ParamViewer(clean_2)
viewer_5 = ParamViewer(move_2.Geometry)
clean_4 = CleanTree(RemoveNulls=True, RemoveInvalid=True, RemoveEmpty=False, Tree=move_2.Geometry)  # -> simplify(graft(Tree))
loft_3 = Loft(
    Curves=[clean_2, clean_4],
    Options={Adjust=False, Closed=False, LoftEnds=0, LoftSimp=0, LoftType=3, Rebuild=10, Refit=0.01})
viewer_6 = ParamViewer(clean_4)
srf_4 = Surface(loft_3)

pv_glass = Brep(loft_3)
swatch_3 = ColourSwatch(SwatchColor=RGB(196, 196, 196))
preview_3 = CustomPreview(Geometry=pv_glass, Material=swatch_3)
bake_3 = ObjectBake(BakeToggle=button, GeometryObjects=pv_glass, Layer="PV", ObjectName="GH_Obj", ObjectColor=swatch_3, LayerColor=swatch_3)

debrep_3 = DeconstructBrep(Brep=srf_4)  # -> Faces, Edges, Vertices
loft_4 = Loft(
    Curves=[clean_3, clean_4],
    Options={Adjust=False, Closed=False, LoftEnds=0, LoftSimp=0, LoftType=0, Rebuild=10, Refit=0.01})
number_slider_3 = Slider(3, range=0..10)
crv_11 = Curve(debrep_3.Edges)
srf_5 = Surface(loft_4)

glass = Brep(loft_4)
swatch_4 = ColourSwatch(SwatchColor=RGB(151, 171, 209))
preview_4 = CustomPreview(Geometry=glass, Material=swatch_4)
bake_4 = ObjectBake(BakeToggle=button, GeometryObjects=glass, Layer="GLASS", ObjectName="GH_Obj", ObjectColor=swatch_4, LayerColor=swatch_4)

debrep_4 = DeconstructBrep(Brep=srf_5)  # -> Faces, Edges, Vertices
item_4 = ListItem(List=debrep_3.Edges, Index=Slider(1, range=0..3), Wrap=True)
item_5 = ListItem(List=debrep_3.Edges, Index=Slider(3, range=0..3), Wrap=True)
divlength = DivideLength(Curve=crv_11, Length=number_slider_3)  # -> Points, Tangents, Parameters
flip_3 = FlipCurve(Curve=item_4)  # -> Curve, Flag
flip_4 = FlipCurve(Curve=item_5)  # -> Curve, Flag
number_slider_4 = Slider(3, range=0..10)
item_6 = ListItem(List=debrep_4.Edges, Index=Slider(1, range=0..3), Wrap=True)
item_7 = ListItem(List=debrep_4.Edges, Index=Slider(3, range=0..3), Wrap=True)
divlength_2 = DivideLength(Curve=flip_3.Curve, Length=number_slider_3)  # -> Points, Tangents, Parameters
divlength_3 = DivideLength(Curve=item_5, Length=number_slider_3)  # -> Points, Tangents, Parameters
flip_5 = FlipCurve(Curve=item_7)  # -> Curve, Flag
flip_6 = FlipCurve(Curve=item_6)  # -> Curve, Flag
ln = Line(StartPoint=divlength_2.Points, EndPoint=divlength_3.Points)  # -> flatten(Line)
divlength_4 = DivideLength(Curve=flip_6.Curve, Length=number_slider_4)  # -> Points, Tangents, Parameters
divlength_5 = DivideLength(Curve=item_7, Length=number_slider_4)  # -> Points, Tangents, Parameters
ln_2 = Line(StartPoint=divlength_4.Points, EndPoint=divlength_5.Points)

joints = Curve([ln_2, ln])
swatch_5 = ColourSwatch(SwatchColor=RGB(8, 1, 1))
bake_5 = ObjectBake(
    BakeToggle=button,
    GeometryObjects=joints,
    Layer="JOINTS",
    ObjectName="GH_Obj",
    ObjectColor=swatch_5,
    LayerColor=swatch_5)
preview_5 = CustomPreview(Geometry=joints, Material=swatch_5)

pipe = Pipe(Curve=joints, Radius=Slider(0.02, range=0..0.1), Caps=0)
preview_6 = CustomPreview(Geometry=pipe, Material=ColourSwatch(SwatchColor=RGB(54, 54, 54)))

# ==== cluster PrismaticProfile
width_top = ClusterInput()
width_bot = ClusterInput()
depth = ClusterInput()
width_top_2 = Number(width_top)
width_bot_2 = Number(width_bot)
depth_2 = Number(depth)
pt = ConstructPoint(XCoordinate=0, YCoordinate=expr("x/2", width_top_2), ZCoordinate=0)
pt_2 = ConstructPoint(XCoordinate=expr("-x", depth_2), YCoordinate=expr("x/2", width_bot_2), ZCoordinate=0)
pt_3 = ConstructPoint(XCoordinate=expr("-x", depth_2), YCoordinate=expr("-x/2", width_bot_2), ZCoordinate=0)
pt_4 = ConstructPoint(XCoordinate=0, YCoordinate=expr("-x/2", width_top_2), ZCoordinate=0)
ln = Line(StartPoint=pt, EndPoint=pt_2)
ln_2 = Line(StartPoint=pt_2, EndPoint=pt_3)
ln_3 = Line(StartPoint=pt_3, EndPoint=pt_4)
ln_4 = Line(StartPoint=pt_4, EndPoint=pt)
join = JoinCurves(Curves=[ln, ln_4, ln_2, ln_3], Preserve=False)
C = ClusterOutput(join)
