# Grasshopper definition roof-type-2.gh (Grasshopper 1.0.7)
# Copyright: Safdie Architects, LLC
# plug-ins: LunchBox

# ----
# BAKE
button = Button()

pick_your_surface = Surface(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)
pick_your_curve = Curve(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)

# ----
# Note the unit conversion factor. The current set-up is intended for a file in meters.
number_slider = Slider(1.5, range=0..10)
# NOTES: Author: Mesut Sala
# Version: v0.0, June, 2021
# Use: Simple Roof
# 
# Rhino file: Specify a Curve and a Surface
# 
# Plugins used:
panel = Panel("Input/Output")
len = Length(Curve=pick_your_curve)
srf = Surface(pick_your_surface)
panel_2 = Panel("Geometry Creation")
division = Division(A=len, B=number_slider)
divide = DivideCurve(Curve=pick_your_curve, Count=division, Kinks=False)  # -> Points, Tangents, Parameters
panel_3 = Panel(division)
xy = XYPlane(Origin=divide.Points)
align = AlignPlane(Plane=xy, Direction=divide.Tangents)  # -> Plane, Angle
deplane = DeconstructPlane(Plane=align.Plane)  # -> Origin, XAxis, YAxis, ZAxis
line = LineSDL(Start=align.Plane, Direction=deplane.YAxis, Length=Slider(100, range=0..100))
project = Project(Curve=line, Brep=pick_your_surface, Direction=Vector(0, 0, 1))
srf_2 = Surface(srf)
srf_3 = Surface(srf_2)

# ---- group: Rectangle Wood Frames
projected_crvs_to_design_srf = Curve(graft(project))
surface_for_normals = Surface(srf_3)

# WOOD DEPTH AND LENGTH
depth = Slider(0.6, range=0..10)
width_top = Slider(0.25, range=0..10)
prismatic_profile = PrismaticProfile(depth=depth, width_top=width_top, width_bot=width_top)

# ----
profile_curve = Curve(prismatic_profile)

X = UnitX(Factor=depth)
move = Move(Geometry=profile_curve, Motion=X)  # -> Geometry, Transform

# ---- group: Rectangle Wood Frames
crv = Curve(reparameterize(projected_crvs_to_design_srf))
number = Number(0)
midpt = CurveMiddle(Curve=crv)
srf_cp = SurfaceClosestPoint(Point=midpt, Surface=surface_for_normals)  # -> Point, UVPoint, Distance
pframe = PerpFrame(Curve=crv, Parameter=number)
evalsrf = EvaluateSurface(Surface=surface_for_normals, Point=srf_cp.UVPoint)  # -> Point, Normal, UDirection, VDirection, Frame
xy_2 = XYPlane(Origin=Point(0, 0, 0))
orient = Orient(Geometry=move.Geometry, Source=xy_2, Target=pframe)  # -> Geometry, Transform
align_2 = AlignPlane(Plane=pframe, Direction=evalsrf.Normal)  # -> Plane, Angle
list = ValueList({"None": 0, "Trim": 1, "Rotate": 2}, selected="None")
swp1 = Sweep1(Rail=projected_crvs_to_design_srf, Sections=orient.Geometry, Miter=list)

# ----
cap = CapHoles(Brep=swp1)
debrep = DeconstructBrep(Brep=cap)  # -> Faces, Edges, Vertices
debrep_2 = DeconstructBrep(Brep=cap)  # -> Faces, Edges, Vertices
number_slider_2 = Slider(10, range=0..10)

wood = Brep(cap)
preview = CustomPreview(Geometry=wood, Material=ColourSwatch(SwatchColor=RGB(255, 171, 36)))

md_slider = MDSlider(SliderMode=0, slider_value=Point(0.5, 0.5, 0.5), x_domain=Domain(0, 1), y_domain=Domain(0, 1), z_domain=Domain(0, 1))
item = ListItem(List=debrep.Faces, Index=Slider(5, range=0..10), Wrap=True)
item_2 = ListItem(List=debrep_2.Edges, Index=Slider(10, range=0..10), Wrap=True)
evalsrf_2 = EvaluateSurface(Surface=reparameterize(item), Point=md_slider)  # -> Point, Normal, UDirection, VDirection, Frame
item_3 = ListItem(List=debrep_2.Edges, Index=Slider(9, range=0..10), Wrap=True)
merge = Merge(Data1=item_3, Data2=item_2)
amp = Amplitude(Vector=evalsrf_2.Normal, Amplitude=Slider(0.05, range=0..0.1))
panel_4 = Panel(merge)
crv_2 = Curve(merge)
extr = Extrude(Base=item, Direction=amp)
viewer = ParamViewer(crv_2)
clean = CleanTree(RemoveNulls=True, RemoveInvalid=True, RemoveEmpty=True, Tree=crv_2)  # -> flatten(Tree)

metal = Brep(extr)
swatch = ColourSwatch(SwatchColor=RGB(107, 107, 107))
bake = ObjectBake(BakeToggle=button, GeometryObjects=metal, Layer="METAL", ObjectName="GH_Obj", ObjectColor=swatch, LayerColor=swatch)
preview_2 = CustomPreview(Geometry=metal, Material=swatch)

shift = ShiftList(List=clean, Shift=1, Wrap=False)
viewer_2 = ParamViewer(clean)
dispatch = Dispatch(List=clean, DispatchPattern=[True, False])  # -> ListA, ListB
dispatch_2 = Dispatch(List=shift, DispatchPattern=[True, False])  # -> ListA, ListB
crv_3 = Curve(graft(dispatch.ListA))
crv_4 = Curve(graft(dispatch.ListB))
crv_5 = Curve(graft(dispatch_2.ListB))
crv_6 = Curve(graft(dispatch_2.ListA))
loft = Loft(Curves=[crv_3, crv_4], Options={Adjust=False, Closed=False, LoftEnds=0, LoftSimp=0, LoftType=0, Rebuild=10, Refit=0.01})
loft_2 = Loft(Curves=[crv_6, crv_5], Options={Adjust=False, Closed=False, LoftEnds=0, LoftSimp=0, LoftType=0, Rebuild=10, Refit=0.01})  # -> flatten(Loft)
preview_3 = CustomPreview(
    Geometry=loft,
    Material={diffuse=RGB(221, 160, 221), emission=RGB(66, 48, 66), shine=0.5, specular=RGB(255, 255, 255), transparency=0})
viewer_3 = ParamViewer(loft_2)
dispatch_3 = Dispatch(List=loft_2, DispatchPattern=[True, False])  # -> ListA, ListB

glass = Surface(dispatch_3.ListB)
solid = Surface(dispatch_3.ListA)
swatch_2 = ColourSwatch(SwatchColor=RGB(164, 195, 255))
swatch_3 = ColourSwatch(SwatchColor=RGB(252, 255, 255))
preview_4 = CustomPreview(Geometry=glass, Material=swatch_2)
preview_5 = CustomPreview(Geometry=solid, Material=swatch_3)
bake_2 = ObjectBake(BakeToggle=button, GeometryObjects=solid, Layer="SOLID", ObjectName="GH_Obj", ObjectColor=swatch_3, LayerColor=swatch_3)
bake_3 = ObjectBake(BakeToggle=button, GeometryObjects=glass, Layer="GLASS", ObjectName="GH_Obj", ObjectColor=swatch_2, LayerColor=swatch_2)

# ==== cluster PrismaticProfile
width_top = ClusterInput()
width_bot = ClusterInput()
depth = ClusterInput()
width_top_2 = Number(width_top)
width_bot_2 = Number(width_bot)
depth_2 = Number(depth)
pt = ConstructPoint(XCoordinate=0, YCoordinate=expr("x/2", width_top_2), ZCoordinate=0)
pt_2 = ConstructPoint(XCoordinate=expr("-x", depth_2), YCoordinate=expr("x/2", width_bot_2), ZCoordinate=0)
pt_3 = ConstructPoint(XCoordinate=expr("-x", depth_2), YCoordinate=expr("-x/2", width_bot_2), ZCoordinate=0)
pt_4 = ConstructPoint(XCoordinate=0, YCoordinate=expr("-x/2", width_top_2), ZCoordinate=0)
ln = Line(StartPoint=pt, EndPoint=pt_2)
ln_2 = Line(StartPoint=pt_2, EndPoint=pt_3)
ln_3 = Line(StartPoint=pt_3, EndPoint=pt_4)
ln_4 = Line(StartPoint=pt_4, EndPoint=pt)
join = JoinCurves(Curves=[ln, ln_4, ln_2, ln_3], Preserve=False)
C = ClusterOutput(join)
