# Grasshopper definition roof-type-3.gh (Grasshopper 1.0.7)
# plug-ins: PTComponentLibrary

crv = Curve([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])
crv_2 = Curve([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])

dispatch = Dispatch(List=crv_2, DispatchPattern=[True, False])  # -> ListA, ListB
dispatch_2 = Dispatch(List=crv, DispatchPattern=[True, False])  # -> ListA, ListB
crv_3 = Curve(dispatch_2.ListB)
# NOTES: Author: Mesut Sala
# Version: v0.0, December, 2021
# 
# Use: Re-create your surface with Network Srf
# Note the unit conversion factor. The current set-up is intended for a file in meters.
panel = Panel("Input")
netsurf = NetworkSurface(CurvesU=crv, CurvesV=crv_2, Continuity=2)
panel_2 = Panel("Geometry Creation")
flip = FlipCurve(Curve=crv_3)  # -> Curve, Flag
flip_2 = Flip(Surface=netsurf)  # -> Surface, Result
divlength = DivideLength(Curve=crv_3, Length=Slider(3.3, range=0..10))  # -> Points, Tangents, Parameters
# IF YOU NEED TO FLIP YOUR SURFACE,
# YOU MAY NEED TO SWITCH THESE CURVES.
crv_4 = Curve(dispatch.ListB)
midpt = CurveMiddle(Curve=crv_2)
unit = UnitVector(Vector=crv_2)
unit_2 = UnitVector(Vector=crv)
midpt_2 = CurveMiddle(Curve=crv)
lng = ListLength(List=divlength.Points)
divide = DivideCurve(Curve=crv_3, Count=lng, Kinks=False)  # -> Points, Tangents, Parameters
srf = Surface(flip_2.Surface)
vdis = VectorDisplay(Anchor=midpt_2, Vector=unit_2)
vdis_2 = VectorDisplay(Anchor=midpt, Vector=unit)
divide_2 = DivideCurve(Curve=crv_4, Count=Slider(6, range=0..10), Kinks=False)  # -> Points, Tangents, Parameters
xy = XYPlane(Origin=divide.Points)
align = AlignPlane(Plane=xy, Direction=divide.Tangents)  # -> Plane, Angle
vec = Vector(divide.Tangents)
srf_cp = SurfaceClosestPoint(Point=divide_2.Points, Surface=srf)  # -> Point, UVPoint, Distance
deplane = DeconstructPlane(Plane=align.Plane)  # -> Origin, XAxis, YAxis, ZAxis
srf_2 = Surface(srf)
iso = IsoCurve(Surface=srf, UVPoint=srf_cp.UVPoint)  # -> UIsocurve, VIsocurve

number_slider = Slider(0.6, range=0.1..1)

line = LineSDL(Start=align.Plane, Direction=deplane.YAxis, Length=Slider(100, range=0..100))
crv_5 = Curve(flatten(iso.UIsocurve))
project = Project(Curve=line, Brep=srf_2, Direction=Vector(0, 0, 1))
width_top = Number(number_slider)
depth = Number(Slider(1, range=0.1..1))
width_bot = Number(number_slider)
pt = ConstructPoint(XCoordinate=0, YCoordinate=expr("x/12", width_top), ZCoordinate=0)
pt_2 = ConstructPoint(XCoordinate=expr("-x", depth), YCoordinate=expr("x/2", width_bot), ZCoordinate=0)
pt_3 = ConstructPoint(XCoordinate=expr("-x", depth), YCoordinate=expr("-x/2", width_bot), ZCoordinate=0)
pt_4 = ConstructPoint(XCoordinate=0, YCoordinate=expr("-x/12", width_top), ZCoordinate=0)
ln = Line(StartPoint=pt, EndPoint=pt_2)
ln_2 = Line(StartPoint=pt_2, EndPoint=pt_3)
ln_3 = Line(StartPoint=pt_3, EndPoint=pt_4)
ln_4 = Line(StartPoint=pt_4, EndPoint=pt)
join = JoinCurves(Curves=[ln, ln_4, ln_2, ln_3], Preserve=False)
crv_6 = Curve(project)
vec_2 = Vector(vec)
crvs_on_design_srf = Curve(graft(crv_5))
surface_for_normals = Surface(srf)
profile_curve = Curve(join)
crv_7 = Curve(reparameterize(crvs_on_design_srf))
midpt_3 = CurveMiddle(Curve=crv_7)
number = Number(0)
srf_cp_2 = SurfaceClosestPoint(Point=midpt_3, Surface=surface_for_normals)  # -> Point, UVPoint, Distance
pframe = PerpFrame(Curve=crv_7, Parameter=number)
X = UnitX(Factor=1)
evalsrf = EvaluateSurface(Surface=surface_for_normals, Point=srf_cp_2.UVPoint)  # -> Point, Normal, UDirection, VDirection, Frame
move = Move(Geometry=profile_curve, Motion=X)  # -> Geometry, Transform
align_2 = AlignPlane(Plane=pframe, Direction=evalsrf.Normal)  # -> Plane, Angle
xy_2 = XYPlane(Origin=Point(0, 0, 0))
orient = Orient(Geometry=move.Geometry, Source=xy_2, Target=align_2.Plane)  # -> Geometry, Transform
list = ValueList({"None": 0, "Trim": 1, "Rotate": 2}, selected="None")
swp1 = Sweep1(Rail=crvs_on_design_srf, Sections=orient.Geometry, Miter=list)

cap = CapHoles(Brep=swp1)
preview = CustomPreview(Geometry=cap, Material=ColourSwatch(SwatchColor=RGB(255, 192, 71)))

debrep = DeconstructBrep(Brep=cap)  # -> Faces, Edges, Vertices
item = ListItem(List=debrep.Faces, Index=Slider(0, range=0..3), Wrap=True)
debrep_2 = DeconstructBrep(Brep=item)  # -> Faces, Edges, Vertices
crv_8 = Curve(crv_6)
crv_9 = Curve(project)
vec_3 = Vector(vec_2)
item_2 = ListItem(List=debrep_2.Edges, Index=Slider(3, range=0..3), Wrap=True)
item_3 = ListItem(List=debrep_2.Edges, Index=Slider(0, range=0..3), Wrap=True)
ptuvcrvs = IntersectCurves(CU=flatten(item_3), CV=flatten(crv_9))
ptuvcrvs_2 = IntersectCurves(CU=flatten(item_2), CV=flatten(crv_8))
crv_10 = Curve(simplify(flatten(item_2)))
crv_11 = Curve(simplify(flatten(item_3)))
xy_3 = XYPlane(Origin=ptuvcrvs)
toggle = BooleanToggle(False)
midpt_4 = CurveMiddle(Curve=item_2)  # -> simplify(flatten(Midpoint))
midpt_5 = CurveMiddle(Curve=item_3)  # -> simplify(flatten(Midpoint))
align_3 = AlignPlane(Plane=xy_3, Direction=vec_3)  # -> Plane, Angle
flip_3 = FlipCurve(Curve=crv_11)  # -> Curve, Flag
deplane_2 = DeconstructPlane(Plane=align_3.Plane)  # -> Origin, XAxis, YAxis, ZAxis
shift = ShiftList(List=crv_10, Shift="1", Wrap=toggle)  # -> graft(List)
shift_2 = ShiftList(List=flip_3.Curve, Shift="-1", Wrap=toggle)  # -> graft(List)
loft = Loft(
    Curves=[shift_2, shift],
    Options={Adjust=False, Closed=False, LoftEnds=0, LoftSimp=0, LoftType=0, Rebuild=10, Refit=0.01})  # -> flatten(Loft)
shift_3 = ShiftList(List=midpt_4, Shift="1", Wrap=toggle)
shift_4 = ShiftList(List=midpt_5, Shift="-1", Wrap=toggle)
dispatch_3 = Dispatch(List=loft, DispatchPattern=[True, False])  # -> ListA, ListB
dist = Distance(PointA=shift_3, PointB=shift_4)
srf_3 = Surface(dispatch_3.ListA)
srf_4 = Surface(dispatch_3.ListB)
line_2 = LineSDL(Start=ptuvcrvs, Direction=deplane_2.YAxis, Length=dist)  # -> simplify(Line)
panel_3 = Panel(dist)
toggle_2 = BooleanToggle(True)
panel_4 = Panel("""True
False""")
clean = CleanTree(RemoveNulls=toggle_2, RemoveInvalid=toggle_2, RemoveEmpty=toggle_2, Tree=line_2)  # -> flatten(Tree)
number_slider_2 = Slider(0.3, range=0..1)
cull = CullPattern(List=clean, CullPattern=panel_4)
viewer = ParamViewer(clean)
Z = UnitZ(Factor=expr("-x", Slider(0.18, range=0..1)))
pipe = Pipe(Curve=cull, Radius=Slider(0.13, range=0..1), Caps=0)
panel_5 = Panel(clean)

move_2 = Move(Geometry=[srf_3, srf_4], Motion=Z)  # -> Geometry, Transform
preview_2 = CustomPreview(Geometry=move_2.Geometry, Material=ColourSwatch(SwatchColor=RGB(134, 255, 255)))

move_3 = Move(Geometry=pipe, Motion=Z)  # -> Geometry, Transform
preview_3 = CustomPreview(Geometry=move_3.Geometry, Material=ColourSwatch(SwatchColor=RGB(158, 158, 158)))
