# Grasshopper definition towers-facades.gh (Grasshopper 1.0.7)
# plug-ins: Sasquatch, treesloth01, Pufferfish

# NOTES: Author: Mesut Sala
# Version: v0.0, July, 2021
# Use: Towers
# 
# Rhino file: Pick your tower's based curve
# 
# Plugins used:
# Note the unit conversion factor. The current set-up is intended for a file in meters.
panel = Panel("Input")

# ---- group: LOBBY
f2f = Slider(3.3, range=0..100)
n_of_floors = Slider(2, range=0..100)

# ---- group: COMMERCIAL
f2f_2 = Slider(3.3, range=0..100)
n_of_floors_2 = Slider(2, range=0..100)

# ---- group: RESIDENTIAL
f2f_3 = Slider(3.3, range=0..100)
n_of_floors_3 = Slider(18, range=0..100)

n_of_floors_4 = Slider(26, range=0..100)

# ---- group: MECHANICAL
f2f_4 = Slider(6.6, range=0..100)
n_of_floors_5 = Slider(2, range=0..100)

# ---- group: RESIDENTIAL
n_of_floors_6 = Slider(25, range=0..100)

# ---- group: COMMERCIAL
f2f_5 = Slider(6, range=0..100)
n_of_floors_7 = Slider(2, range=0..100)

# ---- group: LOBBY
f2f_6 = Slider(8, range=0..100)
n_of_floors_8 = Slider(2, range=0..100)

# ---- group: RESIDENTIAL
f2f_7 = Slider(3.3, range=0..100)
n_of_floors_9 = Slider(20, range=0..100)

# ---- group: MECHANICAL
n_of_floors_10 = Slider(1, range=0..100)
f2f_8 = Slider(8, range=0..100)

# ----
panel_2 = Panel("Geometry Creation")

# ---- group: RESIDENTIAL
n_of_floors_11 = Slider(25, range=0..100)

# ---- group: LOBBY
# FACADE OPTION (CRV BASED)
f2f_9 = Slider(8, range=0..100)
n_of_floors_12 = Slider(2, range=0..100)

# ---- group: COMMERCIAL
n_of_floors_13 = Slider(2, range=0..100)
f2f_10 = Slider(6, range=0..100)

# ---- group: RESIDENTIAL
f2f_11 = Slider(3.3, range=0..100)
n_of_floors_14 = Slider(20, range=0..100)

# ---- group: MECHANICAL
f2f_12 = Slider(8, range=0..100)
n_of_floors_15 = Slider(1, range=0..100)

# ---- group: RESIDENTIAL
n_of_floors_16 = Slider(25, range=0..100)

n_of_floors_17 = Slider(20, range=0..100)
f2f_13 = Slider(3.3, range=0..100)

# ---- group: LOBBY
# FACADE OPTION (CRV BASED)
f2f_14 = Slider(8, range=0..100)
n_of_floors_18 = Slider(2, range=0..100)

# ---- group: COMMERCIAL
f2f_15 = Slider(6, range=0..100)
n_of_floors_19 = Slider(2, range=0..100)

# ---- group: MECHANICAL
f2f_16 = Slider(8, range=0..100)
n_of_floors_20 = Slider(1, range=0..100)

# ----
dup = DuplicateData(Data=f2f_3, Number=n_of_floors_4, Order=True)
dup_2 = DuplicateData(Data=f2f, Number=n_of_floors, Order=True)
dup_3 = DuplicateData(Data=f2f_2, Number=n_of_floors_2, Order=True)
dup_4 = DuplicateData(Data=f2f_3, Number=n_of_floors_3, Order=True)
dup_5 = DuplicateData(Data=f2f_4, Number=n_of_floors_5, Order=True)
dup_6 = DuplicateData(Data=f2f_7, Number=n_of_floors_6, Order=True)
dup_7 = DuplicateData(Data=f2f_6, Number=n_of_floors_8, Order=True)
dup_8 = DuplicateData(Data=f2f_5, Number=n_of_floors_7, Order=True)
dup_9 = DuplicateData(Data=f2f_7, Number=n_of_floors_9, Order=True)
dup_10 = DuplicateData(Data=f2f_8, Number=n_of_floors_10, Order=True)

pick_a_surface = Surface(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)
grid_division = Slider(10, range=0..10)
f2f_height = Slider(6.6, range=0..10)

# ----
# WORK IN PROGRESS
# FACADE OPTION (SRF BASED)
swatch = ColourSwatch(SwatchColor=RGB(154, 174, 217))

pick_a_surface_2 = Surface(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)
f2f_height_2 = Slider(6.6, range=0..10)
grid_division_2 = Slider(10, range=0..10)

merge = Merge(Data1=dup_2, Data2=dup_3, Data3=dup_4, Data4=dup_5, Data5=dup)  # -> flatten(Result)
dup_11 = DuplicateData(Data=f2f_11, Number=n_of_floors_11, Order=True)
dup_12 = DuplicateData(Data=f2f_9, Number=n_of_floors_12, Order=True)
dup_13 = DuplicateData(Data=f2f_10, Number=n_of_floors_13, Order=True)
dup_14 = DuplicateData(Data=f2f_11, Number=n_of_floors_14, Order=True)
dup_15 = DuplicateData(Data=f2f_12, Number=n_of_floors_15, Order=True)
# WORK IN PROGRESS
# DIAGRID FACADE OPTION (SRF BASED)
swatch_2 = ColourSwatch(SwatchColor=RGB(154, 174, 217))
merge_2 = Merge(Data1=dup_7, Data2=dup_8, Data3=dup_9, Data4=dup_10, Data5=dup_6)  # -> flatten(Result)
dup_16 = DuplicateData(Data=f2f_13, Number=n_of_floors_16, Order=True)
dup_17 = DuplicateData(Data=f2f_14, Number=n_of_floors_18, Order=True)
dup_18 = DuplicateData(Data=f2f_15, Number=n_of_floors_19, Order=True)
dup_19 = DuplicateData(Data=f2f_13, Number=n_of_floors_17, Order=True)
dup_20 = DuplicateData(Data=f2f_16, Number=n_of_floors_20, Order=True)
# DIAGRID OPTION FACADE (CRV BASED)
pt = Point(Point(0, 55, 0))

rectangle = Rectangle(Plane=pt, XSize=Slider(30, range=0..100), YSize=Slider(30, range=0..100), Radius=0)  # -> Rectangle, Length
base_curve = Curve(rectangle.Rectangle)

ma = MassAddition(Input=merge)  # -> Result, PartialResults
pt_2 = Point(Point(0, 0, 0))

rectangle_2 = Rectangle(Plane=pt_2, XSize=Slider(30, range=0..100), YSize=Slider(30, range=0..100), Radius=0)  # -> Rectangle, Length
base_curve_2 = Curve(rectangle_2.Rectangle)

merge_3 = Merge(Data1=dup_12, Data2=dup_13, Data3=dup_14, Data4=dup_15, Data5=dup_11)  # -> flatten(Result)
num = Number(grid_division)
ma_2 = MassAddition(Input=merge_2)  # -> Result, PartialResults
debrep = DeconstructBrep(Brep=pick_a_surface)  # -> Faces, Edges, Vertices
preview = CustomPreview(Geometry=pick_a_surface, Material=swatch)
num_2 = Number(grid_division_2)
merge_4 = Merge(Data1=dup_17, Data2=dup_18, Data3=dup_19, Data4=dup_20, Data5=dup_16)  # -> flatten(Result)
preview_2 = CustomPreview(Geometry=pick_a_surface_2, Material=swatch_2)
debrep_2 = DeconstructBrep(Brep=pick_a_surface_2)  # -> Faces, Edges, Vertices
pt_3 = Point(Point(0, 110, 0))

rectangle_3 = Rectangle(Plane=pt_3, XSize=Slider(30, range=0..100), YSize=Slider(30, range=0..100), Radius=0)  # -> Rectangle, Length
base_curve_3 = Curve(rectangle_3.Rectangle)

ma_3 = MassAddition(Input=merge_3)  # -> Result, PartialResults
ma_4 = MassAddition(Input=merge_4)  # -> Result, PartialResults
item = ListItem(List=debrep.Edges, Index=Slider(3, range=0..3), Wrap=True)
item_2 = ListItem(List=debrep_2.Edges, Index=Slider(3, range=0..3), Wrap=True)
Z = UnitZ(Factor=ma_2.PartialResults)
end = EndPoints(Curve=item)  # -> Start, End
base_curve_4 = Curve(base_curve)
Z_2 = UnitZ(Factor=ma.PartialResults)
end_2 = EndPoints(Curve=item_2)  # -> Start, End
base_curve_5 = Curve(base_curve_2)
base_curve_6 = Curve(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)
move = Move(Geometry=base_curve, Motion=Z_2)  # -> Geometry, Transform
merge_5 = Merge(Data1=move.Geometry, Data2=base_curve)  # -> flatten(Result)
Z_3 = UnitZ(Factor=1)
move_2 = Move(Geometry=base_curve_2, Motion=Z)  # -> Geometry, Transform
merge_6 = Merge(Data1=move_2.Geometry, Data2=base_curve_2)  # -> flatten(Result)
Z_4 = UnitZ(Factor=1)
base_curve_7 = Curve(base_curve_3)
Z_5 = UnitZ(Factor=ma_3.PartialResults)
area = Area(Geometry=merge_5)  # -> Area, Centroid
base_curve_8 = Curve(base_curve_6)
area_2 = Area(Geometry=merge_6)  # -> Area, Centroid
Z_6 = UnitZ(Factor=ma_4.PartialResults)
boundary = BoundarySurfaces(Edges=[base_curve, move.Geometry])
item_3 = ListItem(List=debrep_2.Edges, Index=Slider(2, range=0..3), Wrap=True)  # -> flatten(Item)
ma_5 = MassAddition(Input=area.Area)  # -> Result, PartialResults
move_3 = Move(Geometry=base_curve_3, Motion=Z_5)  # -> Geometry, Transform
merge_7 = Merge(Data1=move_3.Geometry, Data2=base_curve_3)  # -> flatten(Result)
Z_7 = UnitZ(Factor=ma.Result)
base_curve_9 = Curve(base_curve_4)
number_slider = Slider(3, range=0..3)
boundary_2 = BoundarySurfaces(Edges=[base_curve_2, move_2.Geometry])
contour = Contour(Shape=pick_a_surface, Point=end.End, Direction=Z_3, Distance=f2f_height)  # -> flatten(Contours)
ma_6 = MassAddition(Input=area_2.Area)  # -> Result, PartialResults
move_4 = Move(Geometry=base_curve_6, Motion=Z_6)  # -> Geometry, Transform
area_3 = Area(Geometry=merge_7)  # -> Area, Centroid
base_curve_10 = Curve(base_curve_5)
contour_2 = Contour(Shape=pick_a_surface_2, Point=end_2.Start, Direction=Z_4, Distance=f2f_height_2)  # -> flatten(Contours)
number_slider_2 = Slider(3, range=0..3)
Z_8 = UnitZ(Factor=Slider(0.3, range=0..1))

total_area = Panel(ma_5.Result)
f2f_height_3 = Panel(ma.PartialResults)
total_height = Panel(ma.Result)

refirst = RemoveFirstItem(List=boundary, NumberOfItems=1)
Z_9 = UnitZ(Factor=ma_2.Result)
item_4 = ListItem(List=debrep.Edges, Index=Slider(0, range=0..3), Wrap=True)  # -> flatten(Item)
explode = Explode(Curve=base_curve_9, Recursive=True)  # -> Segments, Vertices
refirst_2 = RemoveFirstItem(List=boundary_2, NumberOfItems=1)

# ----
# BALCONY OPTION FACADE (CRV BASED)
number_slider_3 = Slider(0.3, range=0..1)
Z_10 = UnitZ(Factor=number_slider_3)
floors = Extrude(Base=refirst_2, Direction=expr("-x", Z_10))
preview_3 = CustomPreview(Geometry=floors, Material=ColourSwatch(SwatchColor=RGB(128, 128, 128)))

total_height_2 = Panel(ma_2.Result)
f2f_height_4 = Panel(ma_2.PartialResults)
total_area_2 = Panel(ma_6.Result)

boundary_3 = BoundarySurfaces(Edges=[base_curve_3, move_3.Geometry])
ma_7 = MassAddition(Input=area_3.Area)  # -> Result, PartialResults
flip = FlipCurve(Curve=contour)  # -> Curve, Flag
explode_2 = Explode(Curve=base_curve_10, Recursive=True)  # -> Segments, Vertices
base_curve_11 = Curve(base_curve_7)
number_slider_4 = Slider(3, range=0..3)
box = Extrude(Base=base_curve_4, Direction=Z_7)
flip_2 = FlipCurve(Curve=contour_2)  # -> Curve, Flag
floors_2 = Extrude(Base=refirst, Direction=expr("-x", Z_8))
Z_11 = UnitZ(Factor=ma_3.Result)
box_2 = Extrude(Base=base_curve_5, Direction=Z_9)
item_5 = ListItem(List=explode.Segments, Index=number_slider, Wrap=True)
flip_3 = FlipCurve(Curve=item_4)  # -> Curve, Flag

total_height_3 = Panel(ma_3.Result)
f2f_height_5 = Panel(ma_3.PartialResults)
total_area_3 = Panel(ma_7.Result)

refirst_3 = RemoveFirstItem(List=boundary_3, NumberOfItems=1)

Z_12 = UnitZ(Factor=Slider(0.3, range=0..1))
floors_3 = Extrude(Base=refirst_3, Direction=expr("-x", Z_12))
preview_4 = CustomPreview(Geometry=floors_3, Material=ColourSwatch(SwatchColor=RGB(128, 128, 128)))

tower_height = Number(total_height)
item_6 = ListItem(List=explode_2.Segments, Index=number_slider_2, Wrap=True)
num_3 = Number(num)
Z_13 = UnitZ(Factor=ma_4.Result)
explode_3 = Explode(Curve=base_curve_11, Recursive=True)  # -> Segments, Vertices

total_height_4 = Panel(ma_4.Result)
f2f_height_6 = Panel(ma_4.PartialResults)

num_4 = Number(num_2)
tower_height_2 = Number(total_height_2)
debrep_3 = DeconstructBrep(Brep=refirst)  # -> Faces, Edges, Vertices
crv = Curve(item_5)
box_3 = Extrude(Base=base_curve_7, Direction=Z_11)
debrep_4 = DeconstructBrep(Brep=refirst_2)  # -> Faces, Edges, Vertices
crv_2 = Curve(move_4.Geometry)
base_curve_12 = Curve(base_curve_8)
crv_3 = Curve(item_6)
item_7 = ListItem(List=explode_3.Segments, Index=number_slider_4, Wrap=True)
box_4 = Extrude(Base=base_curve_8, Direction=Z_13)
Z_14 = UnitZ(Factor=tower_height)
divide = DivideCurve(Curve=[flip_3.Curve, contour], Count=num_3, Kinks=False)  # -> simplify(Points), Tangents, Parameters
tower_height_3 = Number(total_height_3)
crv_4 = Curve(crv)
Z_15 = UnitZ(Factor=tower_height_2)
tower_height_4 = Number(total_height_4)
preview_5 = CustomPreview(Geometry=floors_2, Material=ColourSwatch(SwatchColor=RGB(128, 128, 128)))
divide_2 = DivideCurve(Curve=[flip_2.Curve, item_3], Count=num_4, Kinks=False)  # -> simplify(Points), Tangents, Parameters
debrep_5 = DeconstructBrep(Brep=refirst_3)  # -> Faces, Edges, Vertices
crv_5 = Curve(item_7)
tower_height_5 = Number(tower_height)
flip_4 = FlipMatrix(Data=divide.Points)
glass = Extrude(Base=crv_3, Direction=Z_15)
glass_2 = Extrude(Base=crv, Direction=Z_14)
crv_6 = Curve(base_curve_12)
Z_16 = UnitZ(Factor=tower_height_3)
item_8 = ListItem(List=debrep_3.Edges, Index=number_slider, Wrap=True)
merge_8 = Merge(Data1=item_8, Data2=crv)  # -> flatten(Result)
flip_5 = FlipMatrix(Data=divide_2.Points)
Z_17 = UnitZ(Factor=tower_height_4)
glass_3 = Extrude(Base=crv_5, Direction=Z_16)

panel_3 = Panel("""True
False""")
crv_7 = Curve(merge_8)
cull = CullPattern(List=crv_7, CullPattern=panel_3)

shift = ShiftList(List=divide.Points, Shift=1, Wrap=True)
preview_6 = CustomPreview(Geometry=glass_2, Material=ColourSwatch(SwatchColor=RGB(154, 174, 217)))
glass_4 = Extrude(Base=crv_6, Direction=Z_17)
shift_2 = ShiftList(List=flip_5, Shift=1, Wrap=True)
preview_7 = CustomPreview(Geometry=glass, Material=ColourSwatch(SwatchColor=RGB(154, 174, 217)))
relitem = RelativeItem(Tree=flip_4, Offset="{0}[+1]", WrapPaths=False, WrapItems=False)  # -> ItemA, ItemB
relitem_2 = RelativeItem(Tree=flip_5, Offset="{1}[+1]", WrapPaths=False, WrapItems=False)  # -> ItemA, ItemB
points = PointList(Points=flip_4, Size=Slider(1, range=0..10))
preview_8 = CustomPreview(Geometry=glass_3, Material=ColourSwatch(SwatchColor=RGB(154, 174, 217)))
ln = Line(StartPoint=divide.Points, EndPoint=shift)  # -> flatten(Line)
tower_height_6 = Number(tower_height_2)
f2f_height_7 = Number(f2f_height_4)
points_2 = PointList(Points=flip_5, Size=Slider(4, range=0..10))
item_9 = ListItem(List=debrep_4.Edges, Index=number_slider_2, Wrap=True)
ln_2 = Line(StartPoint=flip_5, EndPoint=shift_2)  # -> flatten(Line)
crv_8 = Curve(crv_6)
preview_9 = CustomPreview(Geometry=glass_4, Material=ColourSwatch(SwatchColor=RGB(154, 174, 217)))
ln_3 = Line(StartPoint=relitem.ItemA, EndPoint=relitem.ItemB)  # -> flatten(Line)
ln_4 = Line(StartPoint=relitem_2.ItemA, EndPoint=relitem_2.ItemB)  # -> flatten(Line)
crv_9 = Curve(crv_3)

number_slider_5 = Slider(3.6, range=0..10)
divlength = DivideLength(Curve=crv_9, Length=number_slider_5)  # -> Points, Tangents, Parameters

crv_10 = Curve(graft(cull))

divlength_2 = DivideLength(Curve=crv_10, Length=Slider(3.6, range=0..10))  # -> Points, Tangents, Parameters
lng = ListLength(List=divlength_2.Points)

divide_3 = DivideCurve(Curve=crv_4, Count=lng, Kinks=False)  # -> simplify(Points), Tangents, Parameters
first_last = FirstLast(List=divide_3.Points)  # -> FirstValue, LastValue

number_slider_6 = Slider(1, range=0..1)
division = Division(A=Slider(1, range=0..1), B=number_slider_6)
division_2 = Division(A=Slider(0.4, range=0..1), B=number_slider_6)
dom = Domain(DomainStart=expr("-x/2", division_2), DomainEnd=expr("x/2", division_2))
dom_2 = Domain(DomainStart=expr("-x/2", division), DomainEnd=expr("x/2", division))
domain_box = DomainBox(Base=[first_last.FirstValue, first_last.LastValue], X=dom_2, Y=dom, Z=tower_height_5)  # -> simplify(flatten(Box))

item_10 = ListItem(List=debrep_5.Edges, Index=number_slider_4, Wrap=True)
tower_height_7 = Number(tower_height_4)
crv_11 = Curve(crv_5)

number_slider_7 = Slider(9, range=0..10)
divlength_3 = DivideLength(Curve=crv_11, Length=number_slider_7)  # -> Points, Tangents, Parameters

len = Length(Curve=crv_9)
divlength_4 = DivideLength(Curve=item_9, Length=number_slider_5)  # -> Points, Tangents, Parameters
tower_height_8 = Number(tower_height_3)
crv_12 = Curve(crv_6)

number_slider_8 = Slider(3.6, range=0..10)
divlength_5 = DivideLength(Curve=crv_12, Length=number_slider_8)  # -> Points, Tangents, Parameters

lng_2 = ListLength(List=divlength.Points)

cap_holes = CapHoles(Brep=domain_box)
preview_10 = CustomPreview(Geometry=cap_holes, Material=ColourSwatch(SwatchColor=RGB(128, 128, 128)))

divide_4 = DivideCurve(Curve=crv_10, Count=lng, Kinks=False)  # -> simplify(Points), Tangents, Parameters
panel_4 = Panel(len)
len_2 = Length(Curve=crv_11)
lng_3 = ListLength(List=divlength_4.Points)
divide_5 = DivideCurve(Curve=crv_9, Count=lng_2, Kinks=False)  # -> Points, Tangents, Parameters
len_3 = Length(Curve=crv_12)
divide_6 = DivideCurve(Curve=item_9, Count=lng_3, Kinks=False)  # -> Points, Tangents, Parameters
division_3 = Division(A=number_slider_7, B=Slider(2, range=0..10))
lng_4 = ListLength(List=divlength_3.Points)
lng_5 = ListLength(List=divlength_5.Points)
viewer = ParamViewer(divide_4.Points)
panel_5 = Panel(len_2)
divide_7 = DivideCurve(Curve=crv_11, Count=lng_4, Kinks=False)  # -> Points, Tangents, Parameters
crv_13 = Curve(item_9)
divide_8 = DivideCurve(Curve=crv_12, Count=lng_5, Kinks=False)  # -> Points, Tangents, Parameters
panel_6 = Panel(len_3)
shift_3 = ShiftList(List=divide_7.Points, Shift=1, Wrap=False)
align_plane = AlignPlane(Plane=divide_5.Points, Direction=divide_5.Tangents)  # -> Plane, Angle
crv_14 = Curve(item_8)
crv_15 = Curve(crv_2)
align_plane_2 = AlignPlane(Plane=divide_7.Points, Direction=divide_7.Tangents)  # -> Plane, Angle
ln_5 = Line(StartPoint=divide_7.Points, EndPoint=shift_3)
align_plane_3 = AlignPlane(Plane=divide_8.Points, Direction=divide_8.Tangents)  # -> Plane, Angle
division_4 = Division(A=number_slider_8, B=Slider(2, range=0..10))
viewer_2 = ParamViewer(crv_15)
shift_4 = ShiftList(List=divide_8.Points, Shift=1, Wrap=False)
crv_16 = Curve(crv_13)
shift_5 = ShiftList(List=divide_6.Points, Shift=1, Wrap=False)
tower_height_9 = Number(tower_height_2)

number_slider_9 = Slider(1, range=0..1)
number_slider_10 = Slider(0.2, range=0..1)
division_5 = Division(A=Slider(1, range=0..1), B=number_slider_9)
division_6 = Division(A=number_slider_10, B=number_slider_9)
dom_3 = Domain(DomainStart=expr("-x/2", division_6), DomainEnd=expr("x/2", division_6))
dom_4 = Domain(DomainStart=expr("-x/2", division_5), DomainEnd=expr("x/2", division_5))
domain_box_2 = DomainBox(Base=align_plane.Plane, X=dom_4, Y=dom_3, Z=tower_height_9)  # -> simplify(flatten(Box))

offset = OffsetCurve(Curve=item_8, Distance=expr("+0.2", 1), Corners=1)
crv_17 = Curve(item_10)
division_7 = Division(A=number_slider_10, B=Slider(2, range=0..10))
tower_height_10 = Number(tower_height_3)

number_slider_11 = Slider(1, range=0..2)
number_slider_12 = Slider(1, range=0..1)
division_8 = Division(A=Slider(1, range=0..2.5), B=number_slider_11)
division_9 = Division(A=number_slider_12, B=number_slider_11)
dom_5 = Domain(DomainStart=expr("-x/2", division_9), DomainEnd=expr("x/2", division_9))
dom_6 = Domain(DomainStart=expr("-x/2", division_8), DomainEnd=expr("x/2", division_8))
domain_box_3 = DomainBox(Base=align_plane_2.Plane, X=dom_6, Y=dom_5, Z=tower_height_10)  # -> simplify(flatten(Box))

split = SplitWithBreps(Curve=crv_9, Brep=domain_box_2)  # -> Curve, Points
offset_2 = OffsetCurve(Curve=item_9, Distance=division_7, Corners=1)
tower_height_11 = Number(tower_height_4)

number_slider_13 = Slider(1, range=0..1)
number_slider_14 = Slider(0.2, range=0..1)
division_10 = Division(A=Slider(1, range=0..1), B=number_slider_13)
division_11 = Division(A=number_slider_14, B=number_slider_13)
dom_7 = Domain(DomainStart=expr("-x/2", division_11), DomainEnd=expr("x/2", division_11))
dom_8 = Domain(DomainStart=expr("-x/2", division_10), DomainEnd=expr("x/2", division_10))
domain_box_4 = DomainBox(Base=align_plane_3.Plane, X=dom_8, Y=dom_7, Z=tower_height_11)  # -> simplify(flatten(Box))

split_2 = SplitWithBreps(Curve=ln_5, Brep=domain_box_3)  # -> Curve, Points
ln_6 = Line(StartPoint=divide_8.Points, EndPoint=shift_4)
end_3 = EndPoints(Curve=crv_14)  # -> Start, End
end_4 = EndPoints(Curve=offset)  # -> Start, End
offset_3 = OffsetCurve(Curve=crv_15, Distance=expr("+0.2", number_slider_14), Corners=1)  # -> flatten(Curve)
crv_18 = Curve(split_2.Curve)
offset_4 = OffsetCurve(Curve=item_10, Distance=expr("+0.2", number_slider_12), Corners=1)
end_5 = EndPoints(Curve=crv_16)  # -> Start, End
end_6 = EndPoints(Curve=offset_2)  # -> Start, End
end_7 = EndPoints(Curve=crv_15)  # -> Start, End
end_8 = EndPoints(Curve=offset_3)  # -> Start, End
crv_19 = Curve(split.Curve)
dispatch = Dispatch(List=crv_18, DispatchPattern=[True, False])  # -> ListA, ListB
split_3 = SplitWithBreps(Curve=ln_6, Brep=domain_box_4)  # -> Curve, Points
ln_7 = Line(StartPoint=end_3.End, EndPoint=end_4.End)
ln_8 = Line(StartPoint=end_3.Start, EndPoint=end_4.Start)
end_9 = EndPoints(Curve=crv_17)  # -> Start, End
end_10 = EndPoints(Curve=offset_4)  # -> Start, End
ln_9 = Line(StartPoint=end_7.End, EndPoint=end_8.End)
divide_9 = DivideCurve(Curve=dispatch.ListB, Count=division_3, Kinks=False)  # -> Points, Tangents, Parameters
ln_10 = Line(StartPoint=end_7.Start, EndPoint=end_8.Start)
dispatch_2 = Dispatch(List=crv_19, DispatchPattern=[True, False])  # -> ListA, ListB
ln_11 = Line(StartPoint=end_5.Start, EndPoint=end_6.Start)
ln_12 = Line(StartPoint=end_5.End, EndPoint=end_6.End)
viewer_3 = ParamViewer(offset_3)
panel_7 = Panel("""0
-1""")
crv_20 = Curve(split_3.Curve)
merge_9 = Merge(Data1=ln_8, Data2=ln_7, Data3=offset, Data4=crv_14)
crv_21 = Curve(dispatch_2.ListA)
crv_22 = Curve(dispatch_2.ListB)

Z_18 = UnitZ(Factor=Slider(0.8, range=0..1))

ln_13 = Line(StartPoint=end_9.End, EndPoint=end_10.End)
ln_14 = Line(StartPoint=end_9.Start, EndPoint=end_10.Start)
dispatch_3 = Dispatch(List=crv_20, DispatchPattern=[True, False])  # -> ListA, ListB
merge_10 = Merge(Data1=ln_11, Data2=ln_12, Data3=offset_2, Data4=crv_16)

Z_19 = UnitZ(Factor=Slider(0.8, range=0..1))

merge_11 = Merge(Data1=ln_10, Data2=ln_9, Data3=crv_15, Data4=offset_3)
join = JoinCurves(Curves=merge_9, Preserve=False)
crv_23 = Curve(dispatch_3.ListB)
midpt = CurveMiddle(Curve=crv_22)

# ---- group: MULLIONS
tower_height_12 = Number(tower_height_6)
Z_20 = UnitZ(Factor=1)
line = LineSDL(Start=midpt, Direction=Z_20, Length=tower_height_12)

# ----
number_slider_15 = Slider(1, range=0..1)
division_12 = Division(A=Slider(0.05, range=0..0.1), B=number_slider_15)
division_13 = Division(A=Slider(0.1, range=0..1), B=number_slider_15)
dom_9 = Domain(DomainStart=expr("-x/2", division_13), DomainEnd=expr("x/2", division_13))
dom_10 = Domain(DomainStart=expr("-x/2", division_12), DomainEnd=expr("x/2", division_12))
domain_box_5 = DomainBox(Base=midpt, X=dom_10, Y=dom_9, Z=tower_height_12)  # -> simplify(flatten(Box))

join_2 = JoinCurves(Curves=merge_10, Preserve=False)
merge_12 = Merge(Data1=ln_14, Data2=ln_13, Data3=offset_4, Data4=crv_17)
join_3 = JoinCurves(Curves=merge_11, Preserve=False)
divide_10 = DivideCurve(Curve=crv_23, Count=division_4, Kinks=False)  # -> Points, Tangents, Parameters
cull_i = CullIndex(List=divide_9.Points, Indices=panel_7, Wrap=True)

# ---- group: MULLIONS
tower_height_13 = Number(tower_height_8)
Z_21 = UnitZ(Factor=divide_9.Tangents)
line_2 = LineSDL(Start=cull_i, Direction=Z_21, Length=tower_height_13)

# ----
Z_22 = UnitZ(Factor=Slider(0.8, range=0..1))

boundary_4 = BoundarySurfaces(Edges=join)
align_plane_4 = AlignPlane(Plane=cull_i, Direction=divide_9.Tangents)  # -> Plane, Angle

number_slider_16 = Slider(1, range=0..1)
division_14 = Division(A=Slider(0.05, range=0..0.1), B=number_slider_16)
division_15 = Division(A=Slider(0.1, range=0..1), B=number_slider_16)
dom_11 = Domain(DomainStart=expr("-x/2", division_15), DomainEnd=expr("x/2", division_15))
dom_12 = Domain(DomainStart=expr("-x/2", division_14), DomainEnd=expr("x/2", division_14))
domain_box_6 = DomainBox(Base=align_plane_4.Plane, X=dom_12, Y=dom_11, Z=tower_height_8)  # -> simplify(flatten(Box))

Z_23 = UnitZ(Factor=Slider(0.8, range=0..1))

boundary_5 = BoundarySurfaces(Edges=join_2)
join_4 = JoinCurves(Curves=merge_12, Preserve=False)
panel_8 = Panel("""0
-1""")
extr = Extrude(Base=boundary_4, Direction=expr("-x", Z_18))
extr_2 = Extrude(Base=boundary_5, Direction=expr("-x", Z_19))
boundary_6 = BoundarySurfaces(Edges=join_3)
boundary_7 = BoundarySurfaces(Edges=join_4)

horizontal_ribs = CapHoles(Brep=extr)
preview_11 = CustomPreview(Geometry=horizontal_ribs, Material=ColourSwatch(SwatchColor=RGB(128, 128, 128)))

extr_3 = Extrude(Base=boundary_7, Direction=expr("-x", Z_22))
cap = CapHoles(Brep=extr_2)
cull_i_2 = CullIndex(List=divide_10.Points, Indices=panel_8, Wrap=True)

# ---- group: MULLIONS
tower_height_14 = Number(tower_height_7)
Z_24 = UnitZ(Factor=divide_10.Tangents)
line_3 = LineSDL(Start=cull_i_2, Direction=Z_24, Length=tower_height_14)

# ----
extr_4 = Extrude(Base=boundary_6, Direction=expr("-x", Z_23))

brep = Brep([domain_box_2, cap])  # "|| __"
preview_12 = CustomPreview(Geometry=brep, Material=ColourSwatch(SwatchColor=RGB(128, 128, 128)))

cap_2 = CapHoles(Brep=extr_3)
align_plane_5 = AlignPlane(Plane=cull_i_2, Direction=divide_10.Tangents)  # -> Plane, Angle

number_slider_17 = Slider(1, range=0..1)
division_16 = Division(A=Slider(0.05, range=0..0.1), B=number_slider_17)
division_17 = Division(A=Slider(0.1, range=0..1), B=number_slider_17)
dom_13 = Domain(DomainStart=expr("-x/2", division_17), DomainEnd=expr("x/2", division_17))
dom_14 = Domain(DomainStart=expr("-x/2", division_16), DomainEnd=expr("x/2", division_16))
domain_box_7 = DomainBox(Base=align_plane_5.Plane, X=dom_14, Y=dom_13, Z=tower_height_7)  # -> simplify(flatten(Box))

preview_13 = CustomPreview(Geometry=domain_box_6, Material=ColourSwatch(SwatchColor=RGB(128, 128, 128)))

cap_3 = CapHoles(Brep=extr_4)

brep_2 = Brep([domain_box_3, cap_2])  # "|| __"
preview_14 = CustomPreview(Geometry=brep_2, Material=ColourSwatch(SwatchColor=RGB(128, 128, 128)))

# ---- group: SOLID BALCONY
ln_15 = Line(StartPoint=divide_6.Points, EndPoint=shift_5)
split_4 = SplitWithBreps(Curve=ln_15, Brep=domain_box_2)  # -> Curve, Points
crv_24 = Curve(split_4.Curve)
dispatch_4 = Dispatch(List=crv_24, DispatchPattern=[True, False])  # -> ListA, ListB
panel_9 = Panel("""False
False
True
True""")
crv_25 = Curve(dispatch_4.ListB)
cull_2 = CullPattern(List=flatten(crv_25), CullPattern=panel_9)
viewer_4 = ParamViewer(crv_25)
crv_26 = Curve(cull_2)
offset_5 = OffsetCurve(Curve=crv_26, Distance=Slider(2, range=0..10), Corners=1)  # -> flatten(Curve)
end_11 = EndPoints(Curve=crv_26)  # -> Start, End
viewer_5 = ParamViewer(offset_5)
viewer_6 = ParamViewer(end_11.Start)
crv_27 = Curve(crv_26)
end_12 = EndPoints(Curve=offset_5)  # -> Start, End
ln_16 = Line(StartPoint=end_11.Start, EndPoint=end_12.Start)
ln_17 = Line(StartPoint=end_11.End, EndPoint=end_12.End)
edgesrf = EdgeSurface(CurveA=crv_27, CurveB=ln_16, CurveC=offset_5, CurveD=ln_17)
join_5 = JoinCurves(Curves=[ln_16, offset_5, ln_17], Preserve=False)
unit_z = UnitZ(Factor=Slider(0.89, range=0..1))
offset_6 = OffsetCurve(Curve=join_5, Distance=expr("-x", Slider(0.08, range=0..0.1)), Corners=1)

# ---- group: CONC. BALCONY
ln_18 = Line(StartPoint=divide_6.Points, EndPoint=shift_5)
split_5 = SplitWithBreps(Curve=ln_18, Brep=domain_box_2)  # -> Curve, Points
crv_28 = Curve(split_5.Curve)
dispatch_5 = Dispatch(List=crv_28, DispatchPattern=[True, False])  # -> ListA, ListB
panel_10 = Panel("""True
False
False
True""")
crv_29 = Curve(dispatch_5.ListB)
viewer_7 = ParamViewer(crv_29)
cull_3 = CullPattern(List=flatten(crv_29), CullPattern=panel_10)
crv_30 = Curve(cull_3)
offset_7 = OffsetCurve(Curve=crv_30, Distance=Slider(2, range=0..10), Corners=1)  # -> flatten(Curve)
end_13 = EndPoints(Curve=crv_30)  # -> Start, End
viewer_8 = ParamViewer(offset_7)
crv_31 = Curve(crv_30)
viewer_9 = ParamViewer(end_13.Start)
end_14 = EndPoints(Curve=offset_7)  # -> Start, End
ln_19 = Line(StartPoint=end_13.Start, EndPoint=end_14.Start)
ln_20 = Line(StartPoint=end_13.End, EndPoint=end_14.End)
edgesrf_2 = EdgeSurface(CurveA=crv_31, CurveB=ln_19, CurveC=offset_7, CurveD=ln_20)
join_6 = JoinCurves(Curves=[ln_19, offset_7, ln_20], Preserve=False)
Z_25 = UnitZ(Factor=Slider(1, range=0..1))
extr_5 = Extrude(Base=join_6, Direction=Z_25)

# ----
brep_3 = Brep([domain_box_4, cap_3])  # "|| __"
preview_15 = CustomPreview(Geometry=brep_3, Material=ColourSwatch(SwatchColor=RGB(128, 128, 128)))

preview_16 = CustomPreview(Geometry=domain_box_5, Material=ColourSwatch(SwatchColor=RGB(128, 128, 128)))

preview_17 = CustomPreview(Geometry=domain_box_7, Material=ColourSwatch(SwatchColor=RGB(128, 128, 128)))

# ---- group: SOLID BALCONY
move_5 = Move(Geometry=offset_6, Motion=unit_z)  # -> Geometry, Transform
Z_26 = UnitZ(Factor=expr("-x", Slider(0.2, range=0..1)))
Z_27 = UnitZ(Factor=Slider(1, range=0..1))
extr_6 = Extrude(Base=edgesrf, Direction=Z_26)
extr_7 = Extrude(Base=join_5, Direction=Z_27)
division_18 = Division(A=Slider(0.03, range=0..0.1), B=Slider(2, range=0..10))
pipe = Pipe(Curve=move_5.Geometry, Radius=division_18, Caps=0)
preview_18 = CustomPreview(Geometry=extr_6, Material=ColourSwatch(SwatchColor=RGB(128, 128, 128)))
preview_19 = CustomPreview(Geometry=extr_7, Material=ColourSwatch(SwatchColor=RGB(169, 208, 245)))
preview_20 = CustomPreview(Geometry=pipe, Material=ColourSwatch(SwatchColor=RGB(128, 128, 128)))

# ----
join_7 = JoinCurves(Curves=ln, Preserve=False)  # -> simplify(graft(Curves))
crv_32 = Curve(graft(join_7))
end_15 = EndPoints(Curve=join_7)  # -> Start, End
viewer_10 = ParamViewer(join_7)
rail = Curve(join_7)
curvepoint = PointOnCurve(crv_32, parameter=0.063)
vec2pt = Vector2Pt(PointA=end_15.Start, PointB=curvepoint, Unitize=False)  # -> Vector, Length
pl = PlaneNormal(Origin=Point(0, 0, 0), ZAxis=vec2pt.Vector)

division_19 = Division(A=Slider(1, range=0..1), B=Slider(2, range=0..10))
rectangle_4 = Rectangle(Plane=pl, XSize=division_19, YSize=division_19, Radius=0)  # -> Rectangle, Length

join_8 = JoinCurves(Curves=ln_3, Preserve=False)  # -> simplify(graft(Curves))
crv_33 = Curve(graft(join_8))
end_16 = EndPoints(Curve=join_8)  # -> Start, End
viewer_11 = ParamViewer(join_8)
rail_2 = Curve(join_8)
curvepoint_2 = PointOnCurve(crv_33, parameter=0.063)
vec2pt_2 = Vector2Pt(PointA=end_16.Start, PointB=curvepoint_2, Unitize=False)  # -> Vector, Length
pl_2 = PlaneNormal(Origin=Point(0, 0, 0), ZAxis=vec2pt_2.Vector)
rectangle_5 = Rectangle(Plane=pl_2, XSize=division_19, YSize=division_19, Radius=0)  # -> Rectangle, Length
area_4 = Area(Geometry=rectangle_5.Rectangle)  # -> Area, Centroid
vec2pt_3 = Vector2Pt(PointA=area_4.Centroid, PointB=end_16.Start, Unitize=False)  # -> Vector, Length
move_6 = Move(Geometry=rectangle_5.Rectangle, Motion=vec2pt_3.Vector)  # -> simplify(Geometry), Transform
swp1 = Sweep1(Rail=rail_2, Sections=move_6.Geometry, Miter=1)

join_9 = JoinCurves(Curves=[flip.Curve, contour], Preserve=False)  # -> simplify(graft(Curves))
crv_34 = Curve(graft(join_9))
end_17 = EndPoints(Curve=join_9)  # -> Start, End
viewer_12 = ParamViewer(join_9)
rail_3 = Curve(join_9)
curvepoint_3 = PointOnCurve(crv_34, parameter=0.063)
vec2pt_4 = Vector2Pt(PointA=end_17.Start, PointB=curvepoint_3, Unitize=False)  # -> Vector, Length
pl_3 = PlaneNormal(Origin=Point(0, 0, 0), ZAxis=vec2pt_4.Vector)
rectangle_6 = Rectangle(Plane=pl_3, XSize=division_19, YSize=division_19, Radius=0)  # -> Rectangle, Length
area_5 = Area(Geometry=rectangle_6.Rectangle)  # -> Area, Centroid
vec2pt_5 = Vector2Pt(PointA=area_5.Centroid, PointB=end_17.Start, Unitize=False)  # -> Vector, Length
move_7 = Move(Geometry=rectangle_6.Rectangle, Motion=vec2pt_5.Vector)  # -> simplify(Geometry), Transform
swp1_2 = Sweep1(Rail=rail_3, Sections=move_7.Geometry, Miter=1)

area_6 = Area(Geometry=rectangle_4.Rectangle)  # -> Area, Centroid
vec2pt_6 = Vector2Pt(PointA=area_6.Centroid, PointB=end_15.Start, Unitize=False)  # -> Vector, Length
move_8 = Move(Geometry=rectangle_4.Rectangle, Motion=vec2pt_6.Vector)  # -> simplify(Geometry), Transform
swp1_3 = Sweep1(Rail=rail, Sections=move_8.Geometry, Miter=1)

cap_4 = CapHoles(Brep=swp1_3)
brep_4 = Brep(cap_4)
preview_21 = CustomPreview(Geometry=brep_4, Material=ColourSwatch(SwatchColor=RGB(128, 128, 128)))

cap_5 = CapHoles(Brep=swp1)
brep_5 = Brep(cap_5)
preview_22 = CustomPreview(Geometry=brep_5, Material=ColourSwatch(SwatchColor=RGB(128, 128, 128)))

cap_6 = CapHoles(Brep=swp1_2)
brep_6 = Brep(cap_6)
preview_23 = CustomPreview(Geometry=brep_6, Material=ColourSwatch(SwatchColor=RGB(128, 128, 128)))

join_10 = JoinCurves(Curves=ln_2, Preserve=False)  # -> simplify(graft(Curves))
crv_35 = Curve(graft(join_10))
end_18 = EndPoints(Curve=join_10)  # -> Start, End
viewer_13 = ParamViewer(join_10)
rail_4 = Curve(join_10)
curvepoint_4 = PointOnCurve(crv_35, parameter=0.063)
vec2pt_7 = Vector2Pt(PointA=end_18.Start, PointB=curvepoint_4, Unitize=False)  # -> Vector, Length
pl_4 = PlaneNormal(Origin=Point(0, 0, 0), ZAxis=vec2pt_7.Vector)

division_20 = Division(A=Slider(1, range=0..1), B=Slider(2, range=0..10))
rectangle_7 = Rectangle(Plane=pl_4, XSize=division_20, YSize=division_20, Radius=0)  # -> Rectangle, Length

join_11 = JoinCurves(Curves=ln_4, Preserve=False)  # -> simplify(graft(Curves))
crv_36 = Curve(graft(join_11))
end_19 = EndPoints(Curve=join_11)  # -> Start, End
viewer_14 = ParamViewer(join_11)
rail_5 = Curve(join_11)
curvepoint_5 = PointOnCurve(crv_36, parameter=0.063)
vec2pt_8 = Vector2Pt(PointA=end_19.Start, PointB=curvepoint_5, Unitize=False)  # -> Vector, Length
pl_5 = PlaneNormal(Origin=Point(0, 0, 0), ZAxis=vec2pt_8.Vector)
rectangle_8 = Rectangle(Plane=pl_5, XSize=division_20, YSize=division_20, Radius=0)  # -> Rectangle, Length
area_7 = Area(Geometry=rectangle_8.Rectangle)  # -> Area, Centroid
vec2pt_9 = Vector2Pt(PointA=area_7.Centroid, PointB=end_19.Start, Unitize=False)  # -> Vector, Length
move_9 = Move(Geometry=rectangle_8.Rectangle, Motion=vec2pt_9.Vector)  # -> simplify(Geometry), Transform
swp1_4 = Sweep1(Rail=rail_5, Sections=move_9.Geometry, Miter=1)

join_12 = JoinCurves(Curves=flip_2.Curve, Preserve=False)  # -> simplify(graft(Curves))
crv_37 = Curve(graft(join_12))
end_20 = EndPoints(Curve=join_12)  # -> Start, End
viewer_15 = ParamViewer(join_12)
rail_6 = Curve(join_12)
curvepoint_6 = PointOnCurve(crv_37, parameter=0.063)
vec2pt_10 = Vector2Pt(PointA=end_20.Start, PointB=curvepoint_6, Unitize=False)  # -> Vector, Length
pl_6 = PlaneNormal(Origin=Point(0, 0, 0), ZAxis=vec2pt_10.Vector)
rectangle_9 = Rectangle(Plane=pl_6, XSize=division_20, YSize=division_20, Radius=0)  # -> Rectangle, Length
area_8 = Area(Geometry=rectangle_9.Rectangle)  # -> Area, Centroid
vec2pt_11 = Vector2Pt(PointA=area_8.Centroid, PointB=end_20.Start, Unitize=False)  # -> Vector, Length
move_10 = Move(Geometry=rectangle_9.Rectangle, Motion=vec2pt_11.Vector)  # -> simplify(Geometry), Transform
swp1_5 = Sweep1(Rail=rail_6, Sections=move_10.Geometry, Miter=1)

area_9 = Area(Geometry=rectangle_7.Rectangle)  # -> Area, Centroid
vec2pt_12 = Vector2Pt(PointA=area_9.Centroid, PointB=end_18.Start, Unitize=False)  # -> Vector, Length
move_11 = Move(Geometry=rectangle_7.Rectangle, Motion=vec2pt_12.Vector)  # -> simplify(Geometry), Transform
swp1_6 = Sweep1(Rail=rail_4, Sections=move_11.Geometry, Miter=1)

cap_7 = CapHoles(Brep=swp1_6)
brep_7 = Brep(cap_7)
preview_24 = CustomPreview(Geometry=brep_7, Material=ColourSwatch(SwatchColor=RGB(128, 128, 128)))

cap_8 = CapHoles(Brep=swp1_4)
brep_8 = Brep(cap_8)
preview_25 = CustomPreview(Geometry=brep_8, Material=ColourSwatch(SwatchColor=RGB(128, 128, 128)))

cap_9 = CapHoles(Brep=swp1_5)
brep_9 = Brep(cap_9)
preview_26 = CustomPreview(Geometry=brep_9, Material=ColourSwatch(SwatchColor=RGB(128, 128, 128)))

relitem_3 = RelativeItem(Tree=divide_4.Points, Offset="{1}[-1]", WrapPaths=False, WrapItems=False)  # -> ItemA, ItemB
ln_21 = Line(StartPoint=relitem_3.ItemA, EndPoint=relitem_3.ItemB)  # -> flatten(Line)
join_13 = JoinCurves(Curves=ln_21, Preserve=False)  # -> simplify(graft(Curves))
crv_38 = Curve(graft(join_13))
end_21 = EndPoints(Curve=join_13)  # -> Start, End
viewer_16 = ParamViewer(join_13)
rail_7 = Curve(join_13)
curvepoint_7 = PointOnCurve(crv_38, parameter=0.063)
vec2pt_13 = Vector2Pt(PointA=end_21.Start, PointB=curvepoint_7, Unitize=False)  # -> Vector, Length
pl_7 = PlaneNormal(Origin=Point(0, 0, 0), ZAxis=vec2pt_13.Vector)

relitem_4 = RelativeItem(Tree=divide_4.Points, Offset="{1}[+1]", WrapPaths=False, WrapItems=False)  # -> ItemA, ItemB
ln_22 = Line(StartPoint=relitem_4.ItemA, EndPoint=relitem_4.ItemB)  # -> flatten(Line)
join_14 = JoinCurves(Curves=ln_22, Preserve=False)  # -> simplify(graft(Curves))
crv_39 = Curve(graft(join_14))
end_22 = EndPoints(Curve=join_14)  # -> Start, End
viewer_17 = ParamViewer(join_14)
rail_8 = Curve(join_14)
curvepoint_8 = PointOnCurve(crv_39, parameter=0.063)
vec2pt_14 = Vector2Pt(PointA=end_22.Start, PointB=curvepoint_8, Unitize=False)  # -> Vector, Length
pl_8 = PlaneNormal(Origin=Point(0, 0, 0), ZAxis=vec2pt_14.Vector)

division_21 = Division(A=Slider(1, range=0..1), B=Slider(2, range=0..10))
rectangle_10 = Rectangle(Plane=pl_8, XSize=division_21, YSize=division_21, Radius=0)  # -> Rectangle, Length

rectangle_11 = Rectangle(Plane=pl_7, XSize=division_21, YSize=division_21, Radius=0)  # -> Rectangle, Length
area_10 = Area(Geometry=rectangle_11.Rectangle)  # -> Area, Centroid
vec2pt_15 = Vector2Pt(PointA=area_10.Centroid, PointB=end_21.Start, Unitize=False)  # -> Vector, Length
move_12 = Move(Geometry=rectangle_11.Rectangle, Motion=vec2pt_15.Vector)  # -> simplify(Geometry), Transform
viewer_18 = ParamViewer(move_12.Geometry)
swp1_7 = Sweep1(Rail=rail_7, Sections=move_12.Geometry, Miter=1)

area_11 = Area(Geometry=rectangle_10.Rectangle)  # -> Area, Centroid
vec2pt_16 = Vector2Pt(PointA=area_11.Centroid, PointB=end_22.Start, Unitize=False)  # -> Vector, Length
move_13 = Move(Geometry=rectangle_10.Rectangle, Motion=vec2pt_16.Vector)  # -> simplify(Geometry), Transform
swp1_8 = Sweep1(Rail=rail_8, Sections=move_13.Geometry, Miter=1)

viewer_19 = ParamViewer(move_13.Geometry)

cap_10 = CapHoles(Brep=swp1_7)
brep_10 = Brep(cap_10)
preview_27 = CustomPreview(Geometry=brep_10, Material=ColourSwatch(SwatchColor=RGB(128, 128, 128)))

cap_11 = CapHoles(Brep=swp1_8)
brep_11 = Brep(cap_11)
preview_28 = CustomPreview(Geometry=brep_11, Material=ColourSwatch(SwatchColor=RGB(128, 128, 128)))

# ---- group: CONC. BALCONY
number_slider_18 = Slider(0.1, range=0..1)
Z_28 = UnitZ(Factor=expr("-x", Slider(0.2, range=0..1)))
extr_8 = Extrude(Base=edgesrf_2, Direction=Z_28)
swatch_3 = ColourSwatch(SwatchColor=RGB(128, 128, 128))
preview_29 = CustomPreview(Geometry=extr_8, Material=swatch_3)

# ----
offsrf = OffsetSurface(Surface=extr_5, Distance=number_slider_18, BothSides=0, CreateSolid=True)

# ---- group: CONC. BALCONY (continued)
preview_30 = CustomPreview(Geometry=offsrf, Material=swatch_3)
